# Dynamo graph AutoCAD_CreateLayers.dyn (Dynamo 2.5.2.7915)

file_path = Filename("..\..\CIVIL3D\Templates\Layers.xlsx")  # graph input
file_from_path = FileObject(path=file_path)
code_block = CodeBlock { "Sheet1"; false; }
importExcel = Data.ImportExcel(file=file_from_path, sheetName=code_block.out0, readAsStrings=code_block.out1, showExcel=code_block.out1)
transpose = List.Transpose(lists=importExcel)
code_block_2 = CodeBlock(lists=transpose)
# ---------- code_block_2.designscript (33 lines) ----------
colors = lists[1];
linetypes = lists[2];
lineweigths = lists[3];
"Continuous";
"0,82,165";
"LineWeight030";


























layers = lists[0];
# ----------------------------------------
current = Autodesk.AutoCAD.DynamoNodes.Document.Current()
isNull = Object.IsNull()  # unwired: obj
replaceByCondition = Replace(item=code_block_2.colors, replaceWith=code_block_2.out4, condition=isNull)
python_script = Python(IN[0]=replaceByCondition)
# ---------- python_script.python (12 lines) ----------
colors = IN[0]
r = []
g = []
b = []

for col in colors:
	r.append(col.rpartition(",")[0].rpartition(",")[0])
	g.append(col.rpartition(",")[0].rpartition(",")[2])
	b.append(col.rpartition(",")[2])
	
OUT = r,g,b
	
# ----------------------------------------
code_block_3 = CodeBlock(colors=python_script) { r=colors[0]; g=colors[1]; b=colors[2]; }
toNumber = String.ToNumber(str=code_block_3.r)
toNumber_2 = String.ToNumber(str=code_block_3.g)
toNumber_3 = String.ToNumber(str=code_block_3.b)
byARGB = Color.ByARGB(r=toNumber, g=toNumber_2, b=toNumber_3)
replaceByCondition_2 = Replace(item=code_block_2.linetypes, replaceWith=code_block_2.out3, condition=isNull)
replaceByCondition_3 = Replace(item=code_block_2.lineweigths, replaceWith=code_block_2.out5, condition=isNull)
create = Autodesk.AutoCAD.DynamoNodes.Layer.Create(name=code_block_2.layers, document=current, color=byARGB, linetype=replaceByCondition_2, lineweight=replaceByCondition_3)
