# Dynamo graph AutoCAD_CreateLayersAlternative.dyn (Dynamo 2.5.2.7915)

current = Autodesk.AutoCAD.DynamoNodes.Document.Current()
modelSpace = Autodesk.AutoCAD.DynamoNodes.Document.ModelSpace(document=current)
file_path = Filename("E:\01-PE\03-CALC\VIACOM\CIVIL3D\Trabalho\GGB\40662G3GP_PatologiasBase.xlsx")
file_from_path = FileObject(path=file_path)
code_block = CodeBlock { "DATABASE"; true; }
importExcel = Data.ImportExcel(file=file_from_path, sheetName=code_block.out0, readAsStrings=code_block.out1, showExcel=code_block.out1)
code_block_2 = CodeBlock { 0; }
removeItemAtIndex = List.RemoveItemAtIndex(list=importExcel, indices=code_block_2)
transpose = List.Transpose(lists=removeItemAtIndex)
code_block_3 = CodeBlock(layers=transpose) { layers[4]; }
count = List.Count(list=code_block_3)
randomList = Math.RandomList(amount=count)
code_block_4 = CodeBlock { 255; }
mul = randomList * code_block_4
ceiling = Math.Ceiling(number=mul)
randomList_2 = Math.RandomList(amount=count)
code_block_5 = CodeBlock { 255; }
mul_2 = randomList_2 * code_block_5
ceiling_2 = Math.Ceiling(number=mul_2)
randomList_3 = Math.RandomList(amount=count)
code_block_6 = CodeBlock { 255; }
mul_3 = randomList_3 * code_block_6
ceiling_3 = Math.Ceiling(number=mul_3)
byARGB = Color.ByARGB(r=ceiling, g=ceiling_2, b=ceiling_3)
create = Autodesk.AutoCAD.DynamoNodes.Layer.Create(name=code_block_3, document=current, color=byARGB)
