# Dynamo graph AutoCAD_MtextToExcel.dyn (Dynamo 2.5.2.7915)
# packages: Civil3DToolkit 1.1.30

select_objects = ObjectsSelection()  # 68 picked in the model; graph input
contents = Autodesk.AutoCAD.DynamoNodes.MText.Contents(mText=select_objects)
boolean = BoolSelector(false)
clean = List.Clean(list=contents, preserveIndices=boolean)
python_script = Python(IN[0]=clean)
# ---------- python_script.python (14 lines) ----------
mtexts = IN[0]
kms = []
areas = []
areas_ = []
for text in mtexts:
	kms.append(text.rpartition("\P")[0])
	areas.append(text.rpartition("\P")[2])

for a in areas:
	a_ = a[:-3]
	areas_.append(a_)
	
OUT = kms,areas_
	
# ----------------------------------------
transpose = List.Transpose(lists=python_script)

# group: EXPORT TO EXCEL
file_path = Directory("C:\Users\GGB\Desktop")  # graph input
file_name = StringInput("")  # graph input
python_script_2 = Python(IN[0]=file_path, IN[1]=file_name)
# ---------- python_script_2.python (3 lines) ----------
path = IN[0];
name = IN[1];
OUT = str(path) + '\\' + str(name) + ".xls";
# ----------------------------------------
string = StringInput("Sheet1")
number = DoubleInput(0)
boolean_2 = BoolSelector(true)
exportExcel = Data.ExportExcel(filePath=python_script_2, sheetName=string, startRow=number, startCol=number, data=transpose, overWrite=boolean_2)
