# Dynamo graph Civil3D_CorridorSurfaces.dyn (Dynamo 2.5.2.7915)
# packages: Civil3DToolkit 1.1.30

corridor = CorridorNameDropDown("eco_")  # graph input
name = Autodesk.Civil.DynamoNodes.CivilObject.Name(civilObject=corridor)
nome_pavimento = StringInput("Pavimento")  # graph input
nome_caixa_pavimento = StringInput("Cx")  # graph input
code_block = CodeBlock(pav=nome_pavimento, cx=nome_caixa_pavimento) { [pav,cx]; ["Top","Datum"]; }
python_script = Python(IN[0]=name, IN[1]=code_block.out0, IN[2]=code_block.out1)
# ---------- python_script.python (68 lines) ----------
# Load the Python Standard and DesignScript Libraries
import sys
import clr

# Add Assemblies for AutoCAD and Civil3D
clr.AddReference('AcMgd')
clr.AddReference('AcCoreMgd')
clr.AddReference('AcDbMgd')
clr.AddReference('AecBaseMgd')
clr.AddReference('AecPropDataMgd')
clr.AddReference('AeccDbMgd')

# Import references from AutoCAD
from Autodesk.AutoCAD.Runtime import *
from Autodesk.AutoCAD.ApplicationServices import *
from Autodesk.AutoCAD.EditorInput import *
from Autodesk.AutoCAD.DatabaseServices import *
from Autodesk.AutoCAD.Geometry import *

# Import references from Civil3D
from Autodesk.Civil.ApplicationServices import *
from Autodesk.Civil.DatabaseServices import *

adoc = Application.DocumentManager.MdiActiveDocument
civdoc = CivilApplication.ActiveDocument
editor = adoc.Editor


def corr_surf(cor_,surf_,link_):
	with adoc.LockDocument():
		with adoc.Database as db:
			with db.TransactionManager.StartTransaction() as t:
					# Get corridor from corridor collection               
				corId = civdoc.CorridorCollection[cor_]
				cor = t.GetObject(corId, OpenMode.ForWrite)

				try:
					surf = cor.CorridorSurfaces[surf_]
					surf.AddLinkCode(link_,True)
				except:
					cor.CorridorSurfaces.Add(surf_)
					surf = cor.CorridorSurfaces[surf_]
					surf.AddLinkCode(link_,True)
				
				#surf.IsBuild = True
				
				bndyCount = surf.Boundaries.Count
				if bndyCount == 0:
					surf.Boundaries.AddCorridorExtentsBoundary("Corridor Boundary(1)")
				
				cor.Rebuild()
				
				t.Commit()
	return surf

corr_ = IN[0]
surfaces_ = IN[1]
links_ = IN[2]

output_ = []

output_.append(corr_surf(corr_,surfaces_[0],links_[0]))
output_.append(corr_surf(corr_,surfaces_[1],links_[1]))

#editor.Regen()

OUT = output_
            
# ----------------------------------------
