# Dynamo graph Civil3D_CorridorTargets.dyn (Dynamo 2.5.2.7915)
# packages: Civil3DToolkit 1.1.30

corridor = CorridorNameDropDown("eco")  # graph input
baselines = Autodesk.Civil.DynamoNodes.Corridor.Baselines(corridor=corridor)
regions = Autodesk.Civil.DynamoNodes.Baseline.Regions(baseline=baselines)
getRegionTargetInfos = Autodesk.Civil.DynamoNodes.CorridorExtensions.CorridorExtensions.GetRegionTargetInfos(region=regions)
target = SurfaceNamesDropDown("Terreno_NPG")  # graph input
setTargets = Autodesk.Civil.DynamoNodes.CorridorExtensions.SubassemblyTargetInfo.SetTargets(subassemblyTargetInfo=getRegionTargetInfos, targets=target)
boolean = BoolSelector(false)
addTargetInfoToRegion = Autodesk.Civil.DynamoNodes.CorridorExtensions.CorridorExtensions.AddTargetInfoToRegion(region=regions, targetInfo=setTargets, rebuild=boolean)
boolean_2 = BoolSelector(false)
corridor_frequency = DoubleInput(5)  # graph input
number = DoubleInput(0)
boolean_3 = BoolSelector(true)
setFrequency = Autodesk.Civil.DynamoNodes.CorridorExtensions.CorridorExtensions.SetFrequency(region=addTargetInfoToRegion, atOffsetTargetsStartEnds=boolean_2, atHorizontalGeomPoints=boolean_2, atTargetGeomPoints=boolean_2, atProfileGeomPoints=boolean_2, atHighLowPoints=boolean_2, atSuperPoints=boolean_2, curveFreq=corridor_frequency, profileFreq=corridor_frequency, spiralFreq=corridor_frequency, tangentFreq=corridor_frequency, targetFreq=corridor_frequency, midOrdinate=corridor_frequency, midOrdinateTarget=corridor_frequency, curveOption=number, targetOption=corridor_frequency, rebuild=boolean_3)
