# Dynamo graph Civil3D_CreateCorridor.dyn (Dynamo 2.5.2.7915)
# packages: Civil3DToolkit 1.1.30

# group: INPUT
corridor_name = StringInput("eco")  # graph input
alignment = AlignmentNamesDropDown("Ecopista")  # graph input

# group: CORRIDOR BASELINE AND REGION
byName = Autodesk.Civil.DynamoNodes.CorridorExtensions.CorridorExtensions.ByName(name=corridor_name)
name = Autodesk.Civil.DynamoNodes.CivilObject.Name(civilObject=alignment)
profiles = Autodesk.Civil.DynamoNodes.Alignment.Profiles(alignment=alignment)
name_2 = Autodesk.Civil.DynamoNodes.CivilObject.Name(civilObject=profiles)
boolean = BoolSelector(false)
addBaseline = Autodesk.Civil.DynamoNodes.CorridorExtensions.CorridorExtensions.AddBaseline(corridor=byName, baselineName=corridor_name, alignmentName=name, profileName=name_2, rebuild=boolean)
getAssemblies = Autodesk.Civil.DynamoNodes.CorridorExtensions.Assembly.GetAssemblies()
name_3 = Autodesk.Civil.DynamoNodes.CivilObject.Name(civilObject=getAssemblies)
code_block = CodeBlock(align=alignment) { start = Alignment.StartStation(align); end = Alignment.EndStation(align); }
addRegion = Autodesk.Civil.DynamoNodes.CorridorExtensions.CorridorExtensions.AddRegion(baseline=addBaseline, name=corridor_name, assemblyName=name_3, start=code_block.start, end=code_block.end, rebuild=boolean)

# group: CORRIDOR FREQUENCY
boolean_2 = BoolSelector(false)
corridor_frequency = DoubleInput(1)  # graph input
number = DoubleInput(0)
boolean_3 = BoolSelector(true)
setFrequency = Autodesk.Civil.DynamoNodes.CorridorExtensions.CorridorExtensions.SetFrequency(region=addRegion, atOffsetTargetsStartEnds=boolean_2, atHorizontalGeomPoints=boolean_2, atTargetGeomPoints=boolean_2, atProfileGeomPoints=boolean_2, atHighLowPoints=boolean_2, atSuperPoints=boolean_2, curveFreq=corridor_frequency, profileFreq=corridor_frequency, spiralFreq=corridor_frequency, tangentFreq=corridor_frequency, targetFreq=corridor_frequency, midOrdinate=corridor_frequency, midOrdinateTarget=corridor_frequency, curveOption=number, targetOption=corridor_frequency, rebuild=boolean_3)
