# Dynamo graph Civil3D_IntersectionPointsToCOGOPoints.dyn "AutoCAD_IntersectionPoints" (Dynamo 2.5.2.7915)
# packages: Civil3DToolkit 1.1.30

select_objects = ObjectsSelection()  # 1454 picked in the model
geometry = Autodesk.AutoCAD.DynamoNodes.Object.Geometry(object=select_objects)
intersect = Geometry.Intersect(geometry=geometry, other=geometry, lacing=CrossProduct)
code_block = CodeBlock { false; }
clean = List.Clean(list=intersect, preserveIndices=code_block)
flatten = List.Flatten(list=clean)
type = Object.Type(obj=flatten)
code_block_2 = CodeBlock { "Point"; }
contains = String.Contains(str=type, searchFor=code_block_2)
filterByBoolMask = List.FilterByBoolMask(list=flatten, mask=contains)
code_block_3 = CodeBlock { "0"; }
current = Autodesk.AutoCAD.DynamoNodes.Document.Current()
byGeometry = Autodesk.Civil.DynamoNodes.CogoPoint.ByGeometry(geometry=filterByBoolMask.in, layer=code_block_3, document=current, lacing=Longest)
