# Dynamo graph Civil3D_PatologiesOnAlignment.dyn (Dynamo 2.5.2.7915)
# packages: Civil3DToolkit 1.1.30

file_path = Filename("E:\01-PE\03-CALC\VIACOM\CIVIL3D\Trabalho\GGB\40662G3GP_PatologiasBase_Civil3D.xlsx")
file_from_path = FileObject(path=file_path)
code_block = CodeBlock { "Sheet1"; false; }
importExcel = Data.ImportExcel(file=file_from_path, sheetName=code_block.out0, readAsStrings=code_block.out1, showExcel=code_block.out1)
code_block_2 = CodeBlock { 0; }
removeItemAtIndex = List.RemoveItemAtIndex(list=importExcel, indices=code_block_2)
transpose = List.Transpose(lists=removeItemAtIndex)
code_block_3 = CodeBlock(kmi=transpose) { kmi[0]; }
alignments = AlignmentNamesDropDown("A41_Dir")
code_block_4 = CodeBlock(offsets=transpose) { offsets[4]; }
python_script = Python(IN[0]=code_block_3, IN[1]=alignments, IN[2]=code_block_4)
# ---------- python_script.python (75 lines) ----------
__author__ = 'Goncalo Bastos - bastos.g.goncalo@gmail.com'
__copyright__ = '2022'
__version__ = '1.0.0'

##############################################################

# Load the Python Standard and DesignScript Libraries
import sys
import clr

# Add Assemblies for AutoCAD and Civil3D
clr.AddReference('AcMgd')
clr.AddReference('AcCoreMgd')
clr.AddReference('AcDbMgd')
clr.AddReference('AecBaseMgd')
clr.AddReference('AecPropDataMgd')
clr.AddReference('AeccDbMgd')
clr.AddReference('ProtoGeometry')
clr.AddReference('AutoCADNodes')
clr.AddReference('Civil3DNodes')   
clr.AddReference('Autodesk.Civil3DToolkit')
clr.AddReference('DSCoreNodes')

# Import references from AutoCAD
from Autodesk.AutoCAD.Runtime import *
from Autodesk.AutoCAD.ApplicationServices import *
from Autodesk.AutoCAD.EditorInput import *
from Autodesk.AutoCAD.DatabaseServices import *
from Autodesk.AutoCAD.Geometry import *

# Import references from Civil3D
from Autodesk.Civil.ApplicationServices import *
from Autodesk.Civil.DatabaseServices import *

# Import references from Dynamo
import Autodesk.AutoCAD.DynamoNodes as DA
import Autodesk.Civil.DynamoNodes as DC
import Autodesk.DesignScript.Geometry as DS
import DSCore
from Autodesk.AutoCAD.DynamoNodes import *
from Autodesk.Civil.DynamoNodes import *
#from Autodesk.DesignScript.Geometry import *
from DSCore import *


##############################################################

STATIONS = IN[0]
ALIGN = IN[1]
OFFSETS = IN[2]


CS = []

for i,station in enumerate(STATIONS):
	CS.append(DC.Alignment.CoordinateSystemByStationOffset(ALIGN, station,OFFSETS[i]))





"""
adoc = Application.DocumentManager.MdiActiveDocument
editor = adoc.Editor
db = adoc.Database

with adoc.LockDocument():
    with db:
        with db.TransactionManager.StartTransaction() as t:

            #t.Commit()
            pass
"""

OUT = CS
# ----------------------------------------
origin = CoordinateSystem.Origin(coordinateSystem=python_script, lacing=Longest)
code_block_5 = CodeBlock(kmf=transpose) { kmf[1]; }
python_script_2 = Python(IN[0]=code_block_5, IN[1]=alignments, IN[2]=code_block_4, IN[3]=code_block_3)
# ---------- python_script_2.python (79 lines) ----------
__author__ = 'Goncalo Bastos - bastos.g.goncalo@gmail.com'
__copyright__ = '2022'
__version__ = '1.0.0'

##############################################################

# Load the Python Standard and DesignScript Libraries
import sys
import clr

# Add Assemblies for AutoCAD and Civil3D
clr.AddReference('AcMgd')
clr.AddReference('AcCoreMgd')
clr.AddReference('AcDbMgd')
clr.AddReference('AecBaseMgd')
clr.AddReference('AecPropDataMgd')
clr.AddReference('AeccDbMgd')
clr.AddReference('ProtoGeometry')
clr.AddReference('AutoCADNodes')
clr.AddReference('Civil3DNodes')   
clr.AddReference('Autodesk.Civil3DToolkit')
clr.AddReference('DSCoreNodes')

# Import references from AutoCAD
from Autodesk.AutoCAD.Runtime import *
from Autodesk.AutoCAD.ApplicationServices import *
from Autodesk.AutoCAD.EditorInput import *
from Autodesk.AutoCAD.DatabaseServices import *
from Autodesk.AutoCAD.Geometry import *

# Import references from Civil3D
from Autodesk.Civil.ApplicationServices import *
from Autodesk.Civil.DatabaseServices import *

# Import references from Dynamo
import Autodesk.AutoCAD.DynamoNodes as DA
import Autodesk.Civil.DynamoNodes as DC
import Autodesk.DesignScript.Geometry as DS
import DSCore
from Autodesk.AutoCAD.DynamoNodes import *
from Autodesk.Civil.DynamoNodes import *
#from Autodesk.DesignScript.Geometry import *
from DSCore import *


##############################################################

STATIONS = IN[0]
ALIGN = IN[1]
OFFSETS = IN[2]
S = IN[3]


CS = []

for i,station in enumerate(STATIONS):
	try:
		CS.append(DC.Alignment.CoordinateSystemByStationOffset(ALIGN, station,OFFSETS[i]))
	except:
		CS.append(DC.Alignment.CoordinateSystemByStationOffset(ALIGN,S[i],30))





"""
adoc = Application.DocumentManager.MdiActiveDocument
editor = adoc.Editor
db = adoc.Database

with adoc.LockDocument():
    with db:
        with db.TransactionManager.StartTransaction() as t:

            #t.Commit()
            pass
"""

OUT = CS
# ----------------------------------------
origin_2 = CoordinateSystem.Origin(coordinateSystem=python_script_2, lacing=Longest)
byStartPointEndPoint = Line.ByStartPointEndPoint(startPoint=origin, endPoint=origin_2, lacing=Longest)
code_block_6 = CodeBlock { "@AUX"; }
current = Autodesk.AutoCAD.DynamoNodes.Document.Current()
modelSpace = Autodesk.AutoCAD.DynamoNodes.Document.ModelSpace(document=current)
byGeometry = Autodesk.AutoCAD.DynamoNodes.Object.ByGeometry(geometry=byStartPointEndPoint, layer=code_block_6, block=modelSpace)
code_block_7 = CodeBlock(layers=transpose) { layers[5]; }
code_block_8 = CodeBlock(LOC=transpose) { LOC[2]; }
