# Dynamo graph Civil3D_PlaceBlocksAlongAlignment.dyn (Dynamo 2.5.2.7915)
# packages: Civil3DToolkit 1.1.30

# group: INPUT
file_path = Filename("No file selected.")  # graph input
alignments = AlignmentNamesDropDown()  # nothing selected; graph input
dimensão_puxada = DoubleInput(10)  # graph input

# group: DATA
file_from_path = FileObject(path=file_path)
code_block = CodeBlock { "CIVIL-DYNAMO"; false; }
importExcel = Data.ImportExcel(file=file_from_path, sheetName=code_block.out0, showExcel=code_block.out1)
code_block_2 = CodeBlock { 0; }
removeItemAtIndex = List.RemoveItemAtIndex(list=importExcel, indices=code_block_2)
transpose = List.Transpose(lists=removeItemAtIndex)
code_block_3 = CodeBlock(a=transpose)
# ---------- code_block_3.designscript (56 lines) ----------
//KM;
a[0];

//OFFSET;
a[1];

//ROTAÇÃO POSTE;
a[2];

//BLOCO POSTE;
a[3];

//ROTAÇÃO PUXADA;
a[4];

//BLOCO SINAL1;
a[5];

//ROTAÇÃO SINAL1;
a[6];

//BLOCO SINAL 2;
a[7];

//ROTAÇÃO SINAL 2;
a[8];

//BLOCO POSTE
a[9];

//ROTAÇÃO POSTE
a[10];

//DIST AUX 2
a[11];

//DIST AUX 3
a[12];

//ROT AUX 2
a[13];

//OFFSET BLOCO 1
a[14];

//NOME BLOCO 1
a[15];

//OFFSET BLOCO 2
a[16];

//NOME BLOCO 2
a[17];

//OFFSET KM
a[18];
# ----------------------------------------

# group: BLOCO POSTE (PLANTA)
current = Autodesk.AutoCAD.DynamoNodes.Document.Current()
blockByName = Autodesk.AutoCAD.DynamoNodes.Document.BlockByName(document=current, name=code_block_3.out3)
coordinateSystemByStationOffset = Autodesk.Civil.DynamoNodes.Alignment.CoordinateSystemByStationOffset(alignment=alignments, station=code_block_3.out0, offset=code_block_3.out1, lacing=Longest)
origin = CoordinateSystem.Origin(coordinateSystem=coordinateSystemByStationOffset)
ZAxis = CoordinateSystem.ZAxis(coordinateSystem=coordinateSystemByStationOffset)
rotate = CoordinateSystem.Rotate(coordinateSystem=coordinateSystemByStationOffset, origin=origin, axis=ZAxis, degrees=code_block_3.out2)
modelSpace = Autodesk.AutoCAD.DynamoNodes.Document.ModelSpace(document=current)
byCoordinateSystem = Autodesk.AutoCAD.DynamoNodes.BlockReferenceExtensions.ByCoordinateSystem(source=blockByName, location=rotate, block=modelSpace)

# group: PUXADA
XAxis = Vector.XAxis()
ZAxis_2 = Vector.ZAxis()
rotate_2 = Vector.Rotate(vector=XAxis, axis=ZAxis_2, degrees=code_block_3.out4, lacing=Longest)
byStartPointDirectionLength = Line.ByStartPointDirectionLength(startPoint=origin, direction=rotate_2, length=dimensão_puxada)
code_block_4 = CodeBlock { "SV_LIN_CHAM"; }
current_2 = Autodesk.AutoCAD.DynamoNodes.Document.Current()
modelSpace_2 = Autodesk.AutoCAD.DynamoNodes.Document.ModelSpace(document=current_2)
byGeometry = Autodesk.AutoCAD.DynamoNodes.Object.ByGeometry(geometry=byStartPointDirectionLength, layer=code_block_4, block=modelSpace_2)

# group: BLOCO 1
current_3 = Autodesk.AutoCAD.DynamoNodes.Document.Current()
blockByName_2 = Autodesk.AutoCAD.DynamoNodes.Document.BlockByName(document=current_3, name=code_block_3.out5)
endPoint = Curve.EndPoint(curve=byStartPointDirectionLength)
X = Point.X(point=endPoint)
Y = Point.Y(point=endPoint)
byOrigin = CoordinateSystem.ByOrigin(x=X, y=Y)
origin_2 = CoordinateSystem.Origin(coordinateSystem=byOrigin)
ZAxis_3 = CoordinateSystem.ZAxis(coordinateSystem=byOrigin)
rotate_3 = CoordinateSystem.Rotate(coordinateSystem=byOrigin, origin=origin_2, axis=ZAxis_3, degrees=code_block_3.out6)
current_4 = Autodesk.AutoCAD.DynamoNodes.Document.Current()
modelSpace_3 = Autodesk.AutoCAD.DynamoNodes.Document.ModelSpace(document=current_4)
byCoordinateSystem_2 = Autodesk.AutoCAD.DynamoNodes.BlockReferenceExtensions.ByCoordinateSystem(source=blockByName_2, location=rotate_3, block=modelSpace_3)

# group: BLOCO 2
XAxis_2 = Vector.XAxis()
ZAxis_4 = Vector.ZAxis()
code_block_5 = CodeBlock { 90; }
sub = code_block_3.out8 - code_block_5
rotate_4 = Vector.Rotate(vector=XAxis_2, axis=ZAxis_4, degrees=sub)
byStartPointDirectionLength_2 = Line.ByStartPointDirectionLength(startPoint=endPoint, direction=rotate_4, length=code_block_3.out11)
endPoint_2 = Curve.EndPoint(curve=byStartPointDirectionLength_2)
current_5 = Autodesk.AutoCAD.DynamoNodes.Document.Current()
blockByName_3 = Autodesk.AutoCAD.DynamoNodes.Document.BlockByName(document=current_5, name=code_block_3.out7)
X_2 = Point.X(point=endPoint_2)
Y_2 = Point.Y(point=endPoint_2)
byOrigin_2 = CoordinateSystem.ByOrigin(x=X_2, y=Y_2)
origin_3 = CoordinateSystem.Origin(coordinateSystem=byOrigin_2)
ZAxis_5 = CoordinateSystem.ZAxis(coordinateSystem=byOrigin_2)
rotate_5 = CoordinateSystem.Rotate(coordinateSystem=byOrigin_2, origin=origin_3, axis=ZAxis_5, degrees=code_block_3.out8)
origin_4 = CoordinateSystem.Origin(coordinateSystem=rotate_5)
ZAxis_6 = CoordinateSystem.ZAxis(coordinateSystem=rotate_5)
rotate_6 = CoordinateSystem.Rotate(coordinateSystem=rotate_5, origin=origin_4, axis=ZAxis_6, degrees=code_block_3.out13)
current_6 = Autodesk.AutoCAD.DynamoNodes.Document.Current()
modelSpace_4 = Autodesk.AutoCAD.DynamoNodes.Document.ModelSpace(document=current_6)
byCoordinateSystem_3 = Autodesk.AutoCAD.DynamoNodes.BlockReferenceExtensions.ByCoordinateSystem(source=blockByName_3, location=rotate_6, block=modelSpace_4)

# group: BLOCO 3
current_7 = Autodesk.AutoCAD.DynamoNodes.Document.Current()
blockByName_4 = Autodesk.AutoCAD.DynamoNodes.Document.BlockByName(document=current_7, name=code_block_3.out9)
XAxis_3 = Vector.XAxis()
ZAxis_7 = Vector.ZAxis()
code_block_6 = CodeBlock { 90; }
sub_2 = code_block_3.out6 - code_block_6
rotate_7 = Vector.Rotate(vector=XAxis_3, axis=ZAxis_7, degrees=sub_2)
byStartPointDirectionLength_3 = Line.ByStartPointDirectionLength(startPoint=endPoint_2, direction=rotate_7, length=code_block_3.out12)
endPoint_3 = Curve.EndPoint(curve=byStartPointDirectionLength_3)
X_3 = Point.X(point=endPoint_3)
Y_3 = Point.Y(point=endPoint_3)
byOrigin_3 = CoordinateSystem.ByOrigin(x=X_3, y=Y_3)
origin_5 = CoordinateSystem.Origin(coordinateSystem=byOrigin_3)
ZAxis_8 = CoordinateSystem.ZAxis(coordinateSystem=byOrigin_3)
rotate_8 = CoordinateSystem.Rotate(coordinateSystem=byOrigin_3, origin=origin_5, axis=ZAxis_8, degrees=code_block_3.out10)
origin_6 = CoordinateSystem.Origin(coordinateSystem=rotate_8)
ZAxis_9 = CoordinateSystem.ZAxis(coordinateSystem=rotate_8)
rotate_9 = CoordinateSystem.Rotate(coordinateSystem=rotate_8, origin=origin_6, axis=ZAxis_9, degrees=code_block_3.out13)
current_8 = Autodesk.AutoCAD.DynamoNodes.Document.Current()
modelSpace_5 = Autodesk.AutoCAD.DynamoNodes.Document.ModelSpace(document=current_8)
byCoordinateSystem_4 = Autodesk.AutoCAD.DynamoNodes.BlockReferenceExtensions.ByCoordinateSystem(source=blockByName_4, location=rotate_9, block=modelSpace_5)

code_block_7 = CodeBlock { "@AUX"; 1; }
current_9 = Autodesk.AutoCAD.DynamoNodes.Document.Current()
modelSpace_6 = Autodesk.AutoCAD.DynamoNodes.Document.ModelSpace(document=current_9)

# group: BLOCK 2
coordinateSystemByStationOffset_2 = Autodesk.Civil.DynamoNodes.Alignment.CoordinateSystemByStationOffset(alignment=alignments, station=code_block_3.out0, offset=code_block_3.out14, lacing=Longest)
origin_7 = CoordinateSystem.Origin(coordinateSystem=coordinateSystemByStationOffset_2)
ZAxis_10 = CoordinateSystem.ZAxis(coordinateSystem=coordinateSystemByStationOffset_2)
rotate_10 = CoordinateSystem.Rotate(coordinateSystem=coordinateSystemByStationOffset_2, origin=origin_7, axis=ZAxis_10, degrees=code_block_3.out2)
origin_8 = CoordinateSystem.Origin(coordinateSystem=rotate_10)
XAxis_4 = Vector.XAxis()
ZAxis_11 = Vector.ZAxis()
rotate_11 = Vector.Rotate(vector=XAxis_4, axis=ZAxis_11, degrees=code_block_3.out6)
rotate_12 = Vector.Rotate(vector=rotate_11, axis=ZAxis_11, degrees=code_block_3.out13)
create = Autodesk.AutoCAD.DynamoNodes.Text.Create(text=code_block_3.out15, insertionPoint=origin_8, height=code_block_7.out1, rotation=rotate_12, layer=code_block_7.out0, block=modelSpace_6)

# group: KM
string_from_object = FromObject(obj=code_block_3.out0)
code_block_8 = CodeBlock { -1; -7; }
remove = String.Remove(str=string_from_object, startIndex=code_block_8.out0, count=code_block_8.out1)
python_script = Python(IN[0]=remove)
# ---------- python_script.python (27 lines) ----------
__author__ = 'Goncalo Bastos - bastos.g.goncalo@gmail.com'
__copyright__ = '2022'
__version__ = '1.0.0'

##############################################################

strings = IN[0]

out=[]
for string in strings:
	L=len(string)
	if L==1:
		out.append("0+00"+string)
	elif L==2:
		out.append("0+0"+string)
	elif L==3:
		out.append("0+"+string)
	elif L==4:
		out.append(string[0]+"+"+string[-3:])
	elif L==5:
		out.append(string[:2]+"+"+string[-3:])
	else:
		out.append(string[:3]+"+"+string[-3:])

		

OUT = out
# ----------------------------------------
coordinateSystemByStationOffset_3 = Autodesk.Civil.DynamoNodes.Alignment.CoordinateSystemByStationOffset(alignment=alignments, station=code_block_3.out0, offset=code_block_3.out18, lacing=Longest)
origin_9 = CoordinateSystem.Origin(coordinateSystem=coordinateSystemByStationOffset_3)
ZAxis_12 = CoordinateSystem.ZAxis(coordinateSystem=coordinateSystemByStationOffset_3)
rotate_13 = CoordinateSystem.Rotate(coordinateSystem=coordinateSystemByStationOffset_3, origin=origin_9, axis=ZAxis_12, degrees=code_block_3.out2)
origin_10 = CoordinateSystem.Origin(coordinateSystem=rotate_13)
XAxis_5 = Vector.XAxis()
ZAxis_13 = Vector.ZAxis()
rotate_14 = Vector.Rotate(vector=XAxis_5, axis=ZAxis_13, degrees=code_block_3.out6)
rotate_15 = Vector.Rotate(vector=rotate_14, axis=ZAxis_13, degrees=code_block_3.out13)
create_2 = Autodesk.AutoCAD.DynamoNodes.Text.Create(text=python_script, insertionPoint=origin_10, height=code_block_7.out1, rotation=rotate_15, layer=code_block_7.out0, block=modelSpace_6)
code_block_9 = CodeBlock { "@AUX"; 1; }
current_10 = Autodesk.AutoCAD.DynamoNodes.Document.Current()
modelSpace_7 = Autodesk.AutoCAD.DynamoNodes.Document.ModelSpace(document=current_10)

# group: BLOCK 1
coordinateSystemByStationOffset_4 = Autodesk.Civil.DynamoNodes.Alignment.CoordinateSystemByStationOffset(alignment=alignments, station=code_block_3.out0, offset=code_block_3.out16, lacing=Longest)
origin_11 = CoordinateSystem.Origin(coordinateSystem=coordinateSystemByStationOffset_4)
ZAxis_14 = CoordinateSystem.ZAxis(coordinateSystem=coordinateSystemByStationOffset_4)
rotate_16 = CoordinateSystem.Rotate(coordinateSystem=coordinateSystemByStationOffset_4, origin=origin_11, axis=ZAxis_14, degrees=code_block_3.out2)
origin_12 = CoordinateSystem.Origin(coordinateSystem=rotate_16)
XAxis_6 = Vector.XAxis()
ZAxis_15 = Vector.ZAxis()
rotate_17 = Vector.Rotate(vector=XAxis_6, axis=ZAxis_15, degrees=code_block_3.out6)
rotate_18 = Vector.Rotate(vector=rotate_17, axis=ZAxis_15, degrees=code_block_3.out13)
create_3 = Autodesk.AutoCAD.DynamoNodes.Text.Create(text=code_block_3.out17, insertionPoint=origin_12, height=code_block_7.out1, rotation=rotate_18, layer=code_block_7.out0, block=modelSpace_6)
