# Dynamo graph Civil3D_RenameSampleLines.dyn (Dynamo 2.5.2.7915)
# packages: Civil3DToolkit 1.1.30

select_objects = ObjectsSelection()  # 7 picked in the model
number = DoubleInput(1)
count = List.Count(list=select_objects)
code_block = CodeBlock(s=number, n=count) { s; n; [s..s+n..1]; }
flatten = List.Flatten(list=code_block.out2)
sample_line_code = CodeBlock { "B26-1_PERFIL"; }
python_script = Python(IN[0]=flatten, IN[1]=sample_line_code)
# ---------- python_script.python (14 lines) ----------
__author__ = 'Goncalo Bastos - bastos.g.goncalo@gmail.com'
__copyright__ = '2022'
__version__ = '1.0.0'

##############################################################

names = IN[0]
code = IN[1]
out=[]
for name in names:
	out.append(str(code)+str(name))
	
OUT= out
	
# ----------------------------------------
setName = Autodesk.Civil.DynamoNodes.CivilObject.SetName(civilObject=select_objects, name=python_script)
