# Dynamo graph Civil3D_SE_Test.dyn (Dynamo 2.5.2.7915)
# packages: Civil3DToolkit 1.1.30

# group: INPUT
corridor = CorridorNameDropDown("GGB")  # graph input
baselines = Autodesk.Civil.DynamoNodes.Corridor.Baselines(corridor=corridor)
code_block = CodeBlock()
# ---------- code_block.designscript (19 lines) ----------
"Aterro_Dir-1";
"Aterro_Dir-2";
"Aterro_Dir-3";
"Aterro_Dir-4";

"Aterro_Esq-1";
"Aterro_Esq-2";
"Aterro_Esq-3";
"Aterro_Esq-4";

"Esc_Dir-1";
"Esc_Dir-2";
"Esc_Dir-3";
"Esc_Dir-4";

"Esc_Esq-1";
"Esc_Esq-2";
"Esc_Esq-3";
"Esc_Esq-4";
# ----------------------------------------
list_create = List.Create(item0=code_block.out0, item1=code_block.out1, item2=code_block.out2, item3=code_block.out3, item4=code_block.out4, item5=code_block.out5, item6=code_block.out6, item7=code_block.out7, item8=code_block.out8, item9=code_block.out9, item10=code_block.out10, item11=code_block.out11, item12=code_block.out12, item13=code_block.out13, item14=code_block.out14, item15=code_block.out15)
code_block_2 = CodeBlock(base=baselines) { base[0]; }  # frozen

# group: STATIONS
alignment = Autodesk.Civil.DynamoNodes.Baseline.Alignment(baseline=baselines)
startStation = Autodesk.Civil.DynamoNodes.Alignment.StartStation(alignment=alignment)
endStation = Autodesk.Civil.DynamoNodes.Alignment.EndStation(alignment=alignment)
python_script = Python(IN[0]=startStation, IN[1]=endStation)
# ---------- python_script.python (31 lines) ----------
starts = IN[0]
ends = IN[1]

starts_ = [int(item) for item in starts]
ends_ = [int(item) for item in ends] 

if starts_[0]%5!=0:
	starts_[0]= int(5*round(starts_[0]/5))
else:
	pass

if ends_[0]%5!=0:
	ends_[0]= int(5*round(ends_[0]/5))
else:
	pass


def myRange(start,end,step):
    i = start
    while i < end:
        yield i
        i += step
    yield end


final = []

for i in range(0,len(starts_)):
	final.append(list(myRange(starts_[i],ends_[i],25)))
	
OUT = final
# ----------------------------------------
flatten = List.Flatten(list=python_script)
code_block_3 = CodeBlock(a=startStation) { 0; a[0]; }
removeItemAtIndex = List.RemoveItemAtIndex(list=flatten, indices=code_block_3.out0)
insert = List.Insert(list=removeItemAtIndex, element=code_block_3.out1, index=code_block_3.out0)

# group: MEDIÇÃO TALUDES 3D
TALUDES = Python(IN[0]=insert, IN[1]=list_create, IN[2]=code_block_2)
# ---------- TALUDES.python (108 lines) ----------
# Load the Python Standard and DesignScript Libraries
import sys
import clr

# Add Assemblies for AutoCAD and Civil3D
clr.AddReference('AcMgd')
clr.AddReference('AcCoreMgd')
clr.AddReference('AcDbMgd')
clr.AddReference('AecBaseMgd')
clr.AddReference('AecPropDataMgd')
clr.AddReference('AeccDbMgd')
clr.AddReference('ProtoGeometry')


# Import references from AutoCAD
from Autodesk.AutoCAD.Runtime import *
from Autodesk.AutoCAD.ApplicationServices import *
from Autodesk.AutoCAD.EditorInput import *
from Autodesk.AutoCAD.DatabaseServices import *
from Autodesk.AutoCAD.Geometry import *

# Import references from Civil3D
from Autodesk.Civil.ApplicationServices import *
from Autodesk.Civil.DatabaseServices import *
#from Autodesk.Civil.DynamoNodes import *

#pyt_path = r'C:\Users\GGB\AppData\Roaming\Autodesk\C3D 2021\Dynamo\2.5\packages\Civil3DToolkit\bin'
#sys.path.append(pyt_path)




clr.AddReference('AutoCADNodes')
clr.AddReference('Civil3DNodes')   
clr.AddReference('Autodesk.Civil3DToolkit')
import Autodesk.AutoCAD.DynamoNodes as DA
import Autodesk.Civil.DynamoNodes as DC
from Autodesk.AutoCAD.DynamoNodes import *
from Autodesk.Civil.DynamoNodes import *
from Autodesk.DesignScript.Geometry import *



# The inputs to this node will be stored as a list in the IN variables.
stations = IN[0]
codes = IN[1]
baseline = IN[2]

p = "Points"
us = "UsedStation"

final = []

for c in codes:
	for s in stations:
		temp = []
		temp_ = []
		code_ = DC.Baseline.PointsByLinkCodeAtNearestStation(baseline,s,c)
		
		#temp_.append(c)		
		temp_.append(s)
		
		temp.append(code_[p])
		taludes = []
		for i in temp:
			for j in i:				
				len = Vector.ByTwoPoints(j[0],j[1]).Length
				taludes.append(len)
			if "Aterro_Dir" in c:
				temp_.append(sum(taludes)) #Aterro Direita
				temp_.append(0) #Aterro Esquerda
				temp_.append(0) #Escv Direita
				temp_.append(0) #Escv Esquerda
			elif "Aterro_Esq" in c:
				temp_.append(0) #Aterro Direita
				temp_.append(sum(taludes)) #Aterro Esquerda
				temp_.append(0) #Escv Direita
				temp_.append(0) #Escv Esquerda
			elif "Esc_Dir" in c:
				temp_.append(0) #Aterro Direita
				temp_.append(0) #Aterro Esquerda
				temp_.append(sum(taludes)) #Escv Direita
				temp_.append(0) #Escv Esquerda
			else:
				temp_.append(0) #Aterro Direita
				temp_.append(0) #Aterro Esquerda
				temp_.append(0) #Escv Direita
				temp_.append(sum(taludes)) #Escv Esquerda
		final.append(temp_)

for i in final:
	i[0] = str(i[0])


d = {}
for row in final:
    # Add name to dict if not exists   

    if row[0] not in d:
        d[row[0]] = []
    # Add all non-Name attributes as a new list
    d[row[0]].append(row[1:])

for key in d:
    d[key] = [sum(x) for x in zip(*d[key])]

# Assign your output to the OUT variable.
OUT = d
# ----------------------------------------
keys = DesignScript.Builtin.Dictionary.Keys(dictionary=TALUDES)
python_script_2 = Python(IN[0]=keys, IN[1]=TALUDES)
# ---------- python_script_2.python (25 lines) ----------
stations = IN[0]
taludes = IN[1]

aterros_dir = []
aterros_esq = []
escavacoes_dir = []
escavacoes_esq = []


for i in stations:
	try:
		aterros_dir.append(taludes[i][0])
		aterros_esq.append(taludes[i][1])
		escavacoes_dir.append(taludes[i][2])
		escavacoes_esq.append(taludes[i][3])
	except:
		aterros_dir.append(0)
		aterros_esq.append(0)
		escavacoes_dir.append(0)
		escavacoes_esq.append(0)

#stations_ = [float(x) for x in stations]


OUT = stations,aterros_dir,aterros_esq,escavacoes_dir,escavacoes_esq
# ----------------------------------------
transpose = List.Transpose(lists=python_script_2)

# group: EXPORT EXCEL
directory_path = Directory("No file selected.")  # graph input
file_name = StringInput("")  # graph input
python_script_3 = Python(IN[0]=directory_path, IN[1]=file_name)
# ---------- python_script_3.python (3 lines) ----------
path = IN[0];
name = IN[1];
OUT = str(path) + '\\' + str(name) + ".xls";
# ----------------------------------------
code_block_4 = CodeBlock()
# ---------- code_block_4.designscript (9 lines) ----------
["KM",
"Talude Aterro Direita",
"Talude Aterro Esquerda",
"Talude Escavação Direita",
"Talude Escavação Esquerda"];

"Taludes";
0;
true;
# ----------------------------------------
insert_2 = List.Insert(list=transpose, element=code_block_4.out0, index=code_block_4.out2)
exportExcel = Data.ExportExcel(filePath=python_script_3, sheetName=code_block_4.out1, startRow=code_block_4.out2, startCol=code_block_4.out2, data=insert_2, overWrite=code_block_4.out3)

pointsByLinkCodeAtNearestStation = Autodesk.Civil.DynamoNodes.Baseline.PointsByLinkCodeAtNearestStation(baseline=baselines, station=startStation, code=code_block.out0)
codes = Autodesk.Civil.DynamoNodes.Baseline.Codes(baseline=baselines)
watch = Watch(codes.Link_Codes)
