# Dynamo graph Civil3D_SampleLines.dyn (Dynamo 2.5.2.7915)
# packages: Civil3DToolkit 1.1.30

# group: INPUT
alinhamento = AlignmentNamesDropDown("Ecopista")  # graph input
nome_sampleline = StringInput("PT")  # graph input
offset = DoubleInput(25)  # graph input
width = DoubleInput(10)  # graph input

# group: SAMPLE LINES
startStation = Autodesk.Civil.DynamoNodes.Alignment.StartStation(alignment=alinhamento)
endStation = Autodesk.Civil.DynamoNodes.Alignment.EndStation(alignment=alinhamento)
code_block = CodeBlock(a=startStation, b=endStation, N=offset) { x=[a..b..N]; x[0]; }
join = List.Join(list0=code_block.out1, list1=endStation)
sampleLineByStation = Autodesk.Civil.DynamoNodes.AlignmentExtensions.SampleLineByStation(alignment=alinhamento, group=nome_sampleline, station=join, rightWidth=width, leftWidth=width)
