# Dynamo graph Civil3D_SampleLines_PTs.dyn (Dynamo 2.5.2.7915)
# packages: Civil3DToolkit 1.1.30

corridors = CorridorNameDropDown("PE_IP3_T1_Plena Via")  # graph input
baselines = Autodesk.Civil.DynamoNodes.Corridor.Baselines(corridor=corridors)
stations = Autodesk.Civil.DynamoNodes.Baseline.Stations(baseline=baselines)
flatten = List.Flatten(list=stations)
lastItem = List.LastItem(list=flatten)
firstItem = List.FirstItem(list=flatten)
km_final = DoubleInput(0)  # graph input
km_inicial = DoubleInput(0)  # graph input
intervalo_sample_lines_m = DoubleInput(25)  # graph input
code_block = CodeBlock(s=km_inicial, e=km_final, i=intervalo_sample_lines_m) { [s..e..i]; }
addItemToEnd = List.AddItemToEnd(item=km_final, list=code_block)
flatten_2 = List.Flatten(list=addItemToEnd)
code_block_2 = CodeBlock()
# ---------- code_block_2.designscript (4 lines) ----------
["ATERRO_ESQ",
"ESCAVACAO_ESQ",
"ATERRO_DIR",
"ESCAVACAO_DIR"];
# ----------------------------------------
pointsByPointCodeAtNearestStation = Autodesk.Civil.DynamoNodes.Baseline.PointsByPointCodeAtNearestStation(baseline=baselines, station=flatten_2, code=code_block_2, lacing=CrossProduct)
alignment = Autodesk.Civil.DynamoNodes.Baseline.Alignment(baseline=baselines)
code_block_3 = CodeBlock { 43500; 0; }
coordinateSystemByStationOffset = Autodesk.Civil.DynamoNodes.Alignment.CoordinateSystemByStationOffset(alignment=alignment, station=flatten_2, offset=code_block_3.out1, lacing=Longest)
origin = CoordinateSystem.Origin(coordinateSystem=coordinateSystemByStationOffset)
python_script = Python(IN[0]=pointsByPointCodeAtNearestStation.Points, IN[1]=origin, IN[2]=flatten_2)
# ---------- python_script.python (78 lines) ----------
__author__ = 'Goncalo Bastos - bastos.g.goncalo@gmail.com'
__copyright__ = '2022'
__version__ = '1.0.0'

##############################################################

# Load the Python Standard and DesignScript Libraries
import sys
import clr

# Add Assemblies for AutoCAD and Civil3D
clr.AddReference('AcMgd')
clr.AddReference('AcCoreMgd')
clr.AddReference('AcDbMgd')
clr.AddReference('AecBaseMgd')
clr.AddReference('AecPropDataMgd')
clr.AddReference('AeccDbMgd')
clr.AddReference('ProtoGeometry')
clr.AddReference('AutoCADNodes')
clr.AddReference('Civil3DNodes')   
clr.AddReference('Autodesk.Civil3DToolkit')
clr.AddReference('DSCoreNodes')

# Import references from AutoCAD
from Autodesk.AutoCAD.Runtime import *
from Autodesk.AutoCAD.ApplicationServices import *
from Autodesk.AutoCAD.EditorInput import *
from Autodesk.AutoCAD.DatabaseServices import *
from Autodesk.AutoCAD.Geometry import *

# Import references from Civil3D
from Autodesk.Civil.ApplicationServices import *
from Autodesk.Civil.DatabaseServices import *

# Import references from Dynamo
import Autodesk.AutoCAD.DynamoNodes as DA
import Autodesk.Civil.DynamoNodes as DC
import Autodesk.DesignScript.Geometry as DS
import DSCore
from Autodesk.AutoCAD.DynamoNodes import *
from Autodesk.Civil.DynamoNodes import *
#from Autodesk.DesignScript.Geometry import *
from DSCore import *


##############################################################

pontos = IN[0][0]
eixos_pontos = IN[1]
stations = IN[2]

pontos_out = []

for station in pontos:
	flat_list = []
	for sublist in station:
		if not sublist:
			flat_list.append(0)
		else:
			for item in sublist:
				flat_list.append(item)
	pontos_out.append(flat_list)

out = []
for i,sublist in enumerate(pontos_out):
	temp = []
	temp_ = []
	temp=DSCore.List.AddItemToFront(eixos_pontos[i],sublist)
	temp_=DSCore.List.AddItemToFront(stations[i],temp)
	out.append(temp_)
		


		
		


OUT = out
# ----------------------------------------
tolerência_sample_lines_m = DoubleInput(10)  # graph input
python_script_2 = Python(IN[0]=python_script, IN[1]=tolerência_sample_lines_m)
# ---------- python_script_2.python (96 lines) ----------
__author__ = 'Goncalo Bastos - bastos.g.goncalo@gmail.com'
__copyright__ = '2022'
__version__ = '1.0.0'

##############################################################

# Load the Python Standard and DesignScript Libraries
import sys
import clr

# Add Assemblies for AutoCAD and Civil3D
clr.AddReference('AcMgd')
clr.AddReference('AcCoreMgd')
clr.AddReference('AcDbMgd')
clr.AddReference('AecBaseMgd')
clr.AddReference('AecPropDataMgd')
clr.AddReference('AeccDbMgd')
clr.AddReference('ProtoGeometry')
clr.AddReference('AutoCADNodes')
clr.AddReference('Civil3DNodes')   
clr.AddReference('Autodesk.Civil3DToolkit')
clr.AddReference('DSCoreNodes')

# Import references from AutoCAD
from Autodesk.AutoCAD.Runtime import *
from Autodesk.AutoCAD.ApplicationServices import *
from Autodesk.AutoCAD.EditorInput import *
from Autodesk.AutoCAD.DatabaseServices import *
from Autodesk.AutoCAD.Geometry import *

# Import references from Civil3D
from Autodesk.Civil.ApplicationServices import *
from Autodesk.Civil.DatabaseServices import *

# Import references from Dynamo
import Autodesk.AutoCAD.DynamoNodes as DA
import Autodesk.Civil.DynamoNodes as DC
import Autodesk.DesignScript.Geometry as DS
import DSCore
from Autodesk.AutoCAD.DynamoNodes import *
from Autodesk.Civil.DynamoNodes import *
#from Autodesk.DesignScript.Geometry import *
from DSCore import *


##############################################################


dados = IN[0]
tol = IN[1]

def round_to_next5(n):
    return n + (tol - n) % tol



lengths = []
for station in dados:
	temp=[]
	eixo = station[1]
	try:
		x1 = DS.Vector.ByTwoPoints(eixo,station[2]).X #Aterro Esq
		y1 = DS.Vector.ByTwoPoints(eixo,station[2]).Y
		len1 = DS.Vector.ByCoordinates(x1,y1,0).Length
		len1=round_to_next5(len1)
	except:
		len1=0
	try:
		x2 = DS.Vector.ByTwoPoints(eixo,station[3]).X #Aterro Esq
		y2 = DS.Vector.ByTwoPoints(eixo,station[3]).Y
		len2 = DS.Vector.ByCoordinates(x2,y2,0).Length
		len2=round_to_next5(len2)
	except:
		len2=0
	try:
		x3 = DS.Vector.ByTwoPoints(eixo,station[4]).X #Aterro Esq
		y3 = DS.Vector.ByTwoPoints(eixo,station[4]).Y
		len3 = DS.Vector.ByCoordinates(x3,y3,0).Length
		len3=round_to_next5(len3)
	except:
		len3=0
	try:
		x4 = DS.Vector.ByTwoPoints(eixo,station[5]).X #Aterro Esq
		y4 = DS.Vector.ByTwoPoints(eixo,station[5]).Y
		len4 = DS.Vector.ByCoordinates(x4,y4,0).Length
		len4=round_to_next5(len4)
	except:
		len4=0
	temp.append(len1)
	temp.append(len2)
	temp.append(len3)
	temp.append(len4)
	lengths.append(temp)
	
	
OUT = lengths
# ----------------------------------------
python_script_3 = Python(IN[0]=python_script_2, IN[1]=flatten_2, IN[2]=alignment)
# ---------- python_script_3.python (78 lines) ----------
__author__ = 'Goncalo Bastos - bastos.g.goncalo@gmail.com'
__copyright__ = '2022'
__version__ = '1.0.0'

##############################################################

# Load the Python Standard and DesignScript Libraries
import sys
import clr

# Add Assemblies for AutoCAD and Civil3D
clr.AddReference('AcMgd')
clr.AddReference('AcCoreMgd')
clr.AddReference('AcDbMgd')
clr.AddReference('AecBaseMgd')
clr.AddReference('AecPropDataMgd')
clr.AddReference('AeccDbMgd')
clr.AddReference('ProtoGeometry')
clr.AddReference('AutoCADNodes')
clr.AddReference('Civil3DNodes')   
clr.AddReference('Autodesk.Civil3DToolkit')
clr.AddReference('DSCoreNodes')

# Import references from AutoCAD
from Autodesk.AutoCAD.Runtime import *
from Autodesk.AutoCAD.ApplicationServices import *
from Autodesk.AutoCAD.EditorInput import *
from Autodesk.AutoCAD.DatabaseServices import *
from Autodesk.AutoCAD.Geometry import *

# Import references from Civil3D
from Autodesk.Civil.ApplicationServices import *
from Autodesk.Civil.DatabaseServices import *

# Import references from Dynamo
import Autodesk.AutoCAD.DynamoNodes as DA
import Autodesk.Civil.DynamoNodes as DC
import Autodesk.DesignScript.Geometry as DS
import DSCore
from Autodesk.AutoCAD.DynamoNodes import *
from Autodesk.Civil.DynamoNodes import *
#from Autodesk.DesignScript.Geometry import *
from DSCore import *


##############################################################

distancias = IN[0]
stations = IN[1]
align = IN[2][0]

final = []
for dist in distancias:
	temp = []
	if dist[0]==0 and dist [1]==0:
		temp.append(15)
		temp.append(15)
	if dist[2]==0 and dist [3]==0:
		temp.append(15)
		temp.append(15)
	if dist[0]==0 and dist[1]!=0:
		temp.append(dist[1])
	if dist[0]!=0 and dist[1]==0:
		temp.append(dist[0])
		
	if dist[2]==0 and dist[3]!=0:
		temp.append(dist[3])
	if dist[2]!=0 and dist[3]==0:
		temp.append(dist[2])
	
	final.append(temp)


for i,station in enumerate(stations):
	SL = DC.AlignmentExtensions.SampleLineByStation(align,"PT",station,"SL",final[i][1],final[i][0])	


OUT = final
# ----------------------------------------
