# Dynamo graph Civil3D_ImportLayerNameFromExcel.dyn (Dynamo 2.5.2.7915)

file_path = Filename("C:\Users\GGB\Desktop\LAYERS.xlsx")  # graph input
file_from_path = FileObject(path=file_path)
string = StringInput("Sheet1")
boolean = BoolSelector(false)
importExcel = Data.ImportExcel(file=file_from_path, sheetName=string, readAsStrings=boolean, showExcel=boolean)
flatten = List.Flatten(list=importExcel)
current = Autodesk.AutoCAD.DynamoNodes.Document.Current()
create = Autodesk.AutoCAD.DynamoNodes.Layer.Create(name=flatten, document=current)
