# Dynamo graph Civil3D_MedicaoPTs.dyn (Dynamo 2.5.2.7915)
# packages: Civil3DToolkit 1.1.30

select_objects = ObjectsSelection()  # 2 picked in the model
geometry = Autodesk.AutoCAD.DynamoNodes.Object.Geometry(object=select_objects)
code_block = CodeBlock(a=geometry) { a[0]; a[1]; }
intersect = Geometry.Intersect(geometry=code_block.out0, other=code_block.out1)
splitByPoints = Curve.SplitByPoints(curve=geometry, points=intersect)
restOfItems = List.RestOfItems(list=splitByPoints@L2)
reverse = List.Reverse(list=restOfItems@L2)
restOfItems_2 = List.RestOfItems(list=reverse@L2)
code_block_2 = CodeBlock(a=restOfItems_2) { a[0]; a[1]; }
join = Curve.Join(curve=code_block_2.out0@L1, curves=code_block_2.out1@L1)
byGeometry = Autodesk.AutoCAD.DynamoNodes.Hatch.ByGeometry(boundaries=join)
getVertices = Autodesk.AutoCAD.DynamoNodes.PolylineExtensions.GetVertices(obj=select_objects)  # frozen
code_block_3 = CodeBlock(b=getVertices.Points) { b[0]; b[1]; }
X = Point.X(point=getVertices.Points)
code_block_4 = CodeBlock(b=X) { b[0]; b[1]; }
minimumItem = List.MinimumItem(list=X)
code_block_5 = CodeBlock(a=minimumItem) { a[0]; a[1]; }
indexOf = List.IndexOf(list=code_block_4.out0, element=code_block_5.out0)
getItemAtIndex = List.GetItemAtIndex(list=code_block_3.out0, index=indexOf)
indexOf_2 = List.IndexOf(list=code_block_4.out1, element=code_block_5.out1)
getItemAtIndex_2 = List.GetItemAtIndex(list=code_block_3.out1, index=indexOf_2)
list_create = List.Create(item0=getItemAtIndex, item1=getItemAtIndex_2)
code_block_6 = CodeBlock { "0"; }
current = Autodesk.AutoCAD.DynamoNodes.Document.Current()
modelSpace = Autodesk.AutoCAD.DynamoNodes.Document.ModelSpace(document=current)
byPoints = Autodesk.AutoCAD.DynamoNodes.Polyline.ByPoints(points=list_create, layer=code_block_6, block=modelSpace)
code_block_7 = CodeBlock(b=getVertices.Points) { b[0]; b[1]; }
code_block_8 = CodeBlock(b=X) { b[0]; b[1]; }
maximumItem = List.MaximumItem(list=X)
code_block_9 = CodeBlock(a=maximumItem) { a[0]; a[1]; }
indexOf_3 = List.IndexOf(list=code_block_8.out0, element=code_block_9.out0)
getItemAtIndex_3 = List.GetItemAtIndex(list=code_block_7.out0, index=indexOf_3)
indexOf_4 = List.IndexOf(list=code_block_8.out1, element=code_block_9.out1)
getItemAtIndex_4 = List.GetItemAtIndex(list=code_block_7.out1, index=indexOf_4)
list_create_2 = List.Create(item0=getItemAtIndex_3, item1=getItemAtIndex_4)
byPoints_2 = Autodesk.AutoCAD.DynamoNodes.Polyline.ByPoints(points=list_create_2, layer=code_block_6, block=modelSpace)
list_create_3 = List.Create(item0=byPoints, item1=byPoints_2, item2=select_objects)
flatten = List.Flatten(list=list_create_3)
