# Dynamo graph Civil3D_Medicoes_PipeNetworks.dyn (Dynamo 2.5.2.7915)
# packages: Civil3DToolkit 1.1.30

current = Autodesk.AutoCAD.DynamoNodes.Document.Current()
pipeNetworks = PipeNetworks(document=current)
code_block = CodeBlock(a=pipeNetworks) { a[0]; a[1]; }
getPipesStructures = Autodesk.Civil.DynamoNodes.PipeNetworks.PipeNetwork.GetPipesStructures(pipeNetwork=code_block.out0)
partSize = Autodesk.Civil.DynamoNodes.PipeNetworks.Pipe.PartSize(pipe=getPipesStructures.Pipes)
directory_path = Directory("C:\Users\GGB\Desktop")
string = StringInput("Med")
python_script = Python(IN[0]=directory_path, IN[1]=string)
# ---------- python_script.python (3 lines) ----------
path = IN[0];
name = IN[1];
OUT = str(path) + '\\' + str(name) + ".xls";
# ----------------------------------------
name = Autodesk.Civil.DynamoNodes.PipeNetworks.PipeNetwork.Name(pipeNetwork=pipeNetworks)
code_block_2 = CodeBlock(a=name) { a[0]; a[1]; }
number = DoubleInput(0)
name_2 = Autodesk.Civil.DynamoNodes.PipeNetworks.Pipe.Name(pipe=getPipesStructures.Pipes)
innerHeight = Autodesk.Civil.DynamoNodes.PipeNetworks.Pipe.InnerHeight(pipe=getPipesStructures.Pipes)
partDescription = Autodesk.Civil.DynamoNodes.PipeNetworks.Pipe.PartDescription(pipe=getPipesStructures.Pipes)
length3DCenterToCenter = Autodesk.Civil.DynamoNodes.PipeNetworks.Pipe.Length3DCenterToCenter(pipe=getPipesStructures.Pipes)
startStation = Autodesk.Civil.DynamoNodes.PipeNetworks.Pipe.StartStation(pipe=getPipesStructures.Pipes)
list_create = List.Create(item0=name_2, item1=innerHeight, item2=partDescription, item3=length3DCenterToCenter, item4=startStation)
transpose = List.Transpose(lists=list_create)
boolean = BoolSelector(true)
exportExcel = Data.ExportExcel(filePath=python_script, sheetName=code_block_2.out0, startRow=number, startCol=number, data=transpose, overWrite=boolean)
number_2 = DoubleInput(0)
getPipesStructures_2 = Autodesk.Civil.DynamoNodes.PipeNetworks.PipeNetwork.GetPipesStructures(pipeNetwork=code_block.out1)
name_3 = Autodesk.Civil.DynamoNodes.PipeNetworks.Pipe.Name(pipe=getPipesStructures_2.Pipes)
innerHeight_2 = Autodesk.Civil.DynamoNodes.PipeNetworks.Pipe.InnerHeight(pipe=getPipesStructures_2.Pipes)
partDescription_2 = Autodesk.Civil.DynamoNodes.PipeNetworks.Pipe.PartDescription(pipe=getPipesStructures_2.Pipes)
length3DCenterToCenter_2 = Autodesk.Civil.DynamoNodes.PipeNetworks.Pipe.Length3DCenterToCenter(pipe=getPipesStructures_2.Pipes)
startStation_2 = Autodesk.Civil.DynamoNodes.PipeNetworks.Pipe.StartStation(pipe=getPipesStructures_2.Pipes)
list_create_2 = List.Create(item0=name_3, item1=innerHeight_2, item2=partDescription_2, item3=length3DCenterToCenter_2, item4=startStation_2)
transpose_2 = List.Transpose(lists=list_create_2)
boolean_2 = BoolSelector(true)
exportExcel_2 = Data.ExportExcel(filePath=python_script, sheetName=code_block_2.out1, startRow=number_2, startCol=number_2, data=transpose_2, overWrite=boolean_2)
partSize_2 = Autodesk.Civil.DynamoNodes.PipeNetworks.Pipe.PartSize(pipe=getPipesStructures_2.Pipes)
