# Dynamo graph Civil3D_Objetos_por_Layer_LimitePDES.dyn (Dynamo 2.5.2.7915)
# packages: Civil3DToolkit 1.1.30

# group: SELECT ALL POLYLINES AND BLOCK REFERENCES
objects_types = AcObjectTypes("Polyline")
current = Autodesk.AutoCAD.DynamoNodes.Document.Current()
modelSpace = Autodesk.AutoCAD.DynamoNodes.Document.ModelSpace(document=current)
all_objects_of_type = AcObjectsOfType(type=objects_types, block=modelSpace)
geometry = Autodesk.AutoCAD.DynamoNodes.Object.Geometry(object=all_objects_of_type)
objects_types_2 = AcObjectTypes("Block Reference")
all_objects_of_type_2 = AcObjectsOfType(type=objects_types_2, block=modelSpace)
getInsertionPoint = Autodesk.AutoCAD.DynamoNodes.BlockReferenceExtensions.GetInsertionPoint(blockReference=all_objects_of_type_2)

# group: INPUT: SELECT DRAWING LIMIT
limite_desenho = ObjectSelection()  # 1 picked in the model; graph input

# group: ALL CAD OBJECTS INSIDE DRAWING
geometry_2 = Autodesk.AutoCAD.DynamoNodes.Object.Geometry(object=limite_desenho)
byPatch = Surface.ByPatch(closedCurve=geometry_2)
doesIntersect = Geometry.DoesIntersect(geometry=byPatch, other=geometry)
polylines = List.FilterByBoolMask(list=all_objects_of_type, mask=doesIntersect)
doesIntersect_2 = Geometry.DoesIntersect(geometry=byPatch, other=getInsertionPoint)
blocks = List.FilterByBoolMask(list=all_objects_of_type_2, mask=doesIntersect_2)
list_create = List.Create(item0=polylines.in, item1=blocks.in)
flatten = List.Flatten(list=list_create)

# group: INPUT: DRAWING NUMBER
desenho = StringInput("")  # graph input

# group: SET LAYER FOR OBJECTS IN DRAWING
current_2 = Autodesk.AutoCAD.DynamoNodes.Document.Current()
layer = Autodesk.AutoCAD.DynamoNodes.Object.Layer(object=flatten)
uniqueItems = List.UniqueItems(list=layer)
layerByName = Autodesk.AutoCAD.DynamoNodes.Document.LayerByName(document=current_2, name=uniqueItems)
name = Autodesk.AutoCAD.DynamoNodes.Layer.Name(layer=layerByName)
python_script = Python(IN[0]=uniqueItems, IN[1]=desenho)
# ---------- python_script.python (11 lines) ----------
layers = IN[0]

Drawing = IN[1]

#ls =  [layer for layer in layers for i in range(N)]
for i in range(0,len(layers)):
	layers[i] = str(Drawing)+"_"+layers[i]
	


OUT = layers
# ----------------------------------------
create = Autodesk.AutoCAD.DynamoNodes.Layer.Create(name=python_script, document=current_2)
name_2 = Autodesk.AutoCAD.DynamoNodes.Layer.Name(layer=create)
byKeysValues = DesignScript.Builtin.Dictionary.ByKeysValues(keys=name, values=name_2)
valueAtKey = DesignScript.Builtin.Dictionary.ValueAtKey(dictionary=byKeysValues, key=layer)
setLayer = Autodesk.AutoCAD.DynamoNodes.Object.SetLayer(object=flatten, layer=valueAtKey)
