# Dynamo graph Civil3D_Objetos_por_Layer_SelectObjects.dyn (Dynamo 2.5.2.7915)
# packages: Civil3DToolkit 1.1.30

# group: Input
select_objects = ObjectsSelection()  # 11 picked in the model; graph input
ID = StringInput("600")  # graph input

# group: Set Layer
current = Autodesk.AutoCAD.DynamoNodes.Document.Current()
layer = Autodesk.AutoCAD.DynamoNodes.Object.Layer(object=select_objects)
uniqueItems = List.UniqueItems(list=layer)
layerByName = Autodesk.AutoCAD.DynamoNodes.Document.LayerByName(document=current, name=uniqueItems)
name = Autodesk.AutoCAD.DynamoNodes.Layer.Name(layer=layerByName)
python_script = Python(IN[0]=uniqueItems, IN[1]=ID)
# ---------- python_script.python (11 lines) ----------
layers = IN[0]

Drawing = IN[1]

#ls =  [layer for layer in layers for i in range(N)]
for i in range(0,len(layers)):
	layers[i] = str(Drawing)+"_"+layers[i]
	


OUT = layers
# ----------------------------------------
create = Autodesk.AutoCAD.DynamoNodes.Layer.Create(name=python_script, document=current)
name_2 = Autodesk.AutoCAD.DynamoNodes.Layer.Name(layer=create)
byKeysValues = DesignScript.Builtin.Dictionary.ByKeysValues(keys=name, values=name_2)
valueAtKey = DesignScript.Builtin.Dictionary.ValueAtKey(dictionary=byKeysValues, key=layer)
setLayer = Autodesk.AutoCAD.DynamoNodes.Object.SetLayer(object=select_objects, layer=valueAtKey)
