# Dynamo graph Civil3D_CreatePipeByProfileView.dyn (Dynamo 2.5.2.7915)
# packages: Civil3DToolkit 1.1.30

current = Autodesk.AutoCAD.DynamoNodes.Document.Current()

# group: Create Pipe Network (If Not Exists)
insert_pipe_network_name = StringInput("@PH")  # graph input
byName = Autodesk.Civil.DynamoNodes.PipeNetworks.PipeNetwork.ByName(document=current, name=insert_pipe_network_name)

pipeNetworks = PipeNetworks(document=current)
code_block = CodeBlock(a=pipeNetworks) { a[0]; }

# group: INPUTS
part_catalog = StringInput("Manilha Betão: 800 R IV")  # graph input
alinhamento_ph = AlignmentNamesDropDown("Col E")  # graph input
ponto_entrada_profile_view = PickPoint()  # 1 picked in the model; graph input
pipe_size = DoubleInput(800)
ponto_saída_profile_view = PickPoint()  # 1 picked in the model; graph input
pipe_name = StringInput("E5")  # graph input

# group: Part Family/Size
pipe_network_parts_lists = PartsLists(document=current)
string_from_object = FromObject(obj=pipe_network_parts_lists)
string = StringInput("COBA - PH")
contains = String.Contains(str=string_from_object, searchFor=string)
filterByBoolMask = List.FilterByBoolMask(list=pipe_network_parts_lists, mask=contains)
string_2 = StringInput("Tubagens")
partFamilyByName = Autodesk.Civil.DynamoNodes.PipeNetworks.Selection.PartFamilyByName(partsList=filterByBoolMask.in, name=string_2)
partSizeByName = Autodesk.Civil.DynamoNodes.PipeNetworks.Selection.PartSizeByName(partFamily=partFamilyByName, name=part_catalog)

# group: Get Profile View (assume-se que só existe um PV por cada alinhamento)
current_2 = Autodesk.AutoCAD.DynamoNodes.Document.Current()
modelSpace = Autodesk.AutoCAD.DynamoNodes.Document.ModelSpace(document=current_2)
getProfileViews = Autodesk.Civil.DynamoNodes.ProfileView.GetProfileViews(Block=modelSpace)
name = Autodesk.Civil.DynamoNodes.CivilObject.Name(civilObject=alinhamento_ph)
alignment = Autodesk.Civil.DynamoNodes.ProfileView.Alignment(profileView=getProfileViews)
name_2 = Autodesk.Civil.DynamoNodes.CivilObject.Name(civilObject=alignment)
eq = name == name_2  # lacing=Longest
filterByBoolMask_2 = List.FilterByBoolMask(list=getProfileViews, mask=eq)

# group: M,P,Z PH
alignment_2 = Autodesk.Civil.DynamoNodes.ProfileView.Alignment(profileView=filterByBoolMask_2.in)
X = Point.X(point=ponto_entrada_profile_view)
Y = Point.Y(point=ponto_entrada_profile_view)
findStationAndElevationAtXY = Autodesk.Civil.DynamoNodes.ProfileView.FindStationAndElevationAtXY(profileView=filterByBoolMask_2.in, X=X, Y=Y)
coordinateSystemByStationOffset = Autodesk.Civil.DynamoNodes.Alignment.CoordinateSystemByStationOffset(alignment=alignment_2, station=findStationAndElevationAtXY.Station)
byCartesianCoordinates = Point.ByCartesianCoordinates(cs=coordinateSystemByStationOffset)
X_2 = Point.X(point=byCartesianCoordinates)
Y_2 = Point.Y(point=byCartesianCoordinates)
alignment_3 = Autodesk.Civil.DynamoNodes.ProfileView.Alignment(profileView=filterByBoolMask_2.in)
X_3 = Point.X(point=ponto_saída_profile_view)
Y_3 = Point.Y(point=ponto_saída_profile_view)
findStationAndElevationAtXY_2 = Autodesk.Civil.DynamoNodes.ProfileView.FindStationAndElevationAtXY(profileView=filterByBoolMask_2.in, X=X_3, Y=Y_3)
coordinateSystemByStationOffset_2 = Autodesk.Civil.DynamoNodes.Alignment.CoordinateSystemByStationOffset(alignment=alignment_3, station=findStationAndElevationAtXY_2.Station)
byCartesianCoordinates_2 = Point.ByCartesianCoordinates(cs=coordinateSystemByStationOffset_2)
X_4 = Point.X(point=byCartesianCoordinates_2)
Y_4 = Point.Y(point=byCartesianCoordinates_2)

code_block_2 = CodeBlock(a=pipe_size) { a/1000/2; }
add = findStationAndElevationAtXY.Elevation + code_block_2

# group (continued): M,P,Z PH
byCoordinates = Point.ByCoordinates(x=X_2, y=Y_2, z=add)

add_2 = findStationAndElevationAtXY_2.Elevation + code_block_2

# group (continued): M,P,Z PH
byCoordinates_2 = Point.ByCoordinates(x=X_4, y=Y_4, z=add_2)
list_create = List.Create(item0=byCoordinates, item1=byCoordinates_2)
flatten = List.Flatten(list=list_create)

# group: Create Layer if not exists
code_block_3 = CodeBlock { "@_PH"; }
current_3 = Autodesk.AutoCAD.DynamoNodes.Document.Current()
python_script = Python(IN[0]=code_block_3, IN[1]=current_3)
# ---------- python_script.python (54 lines) ----------
__author__ = 'Goncalo Bastos - bastos.g.goncalo@gmail.com'
__copyright__ = '2022'
__version__ = '1.0.0'

##############################################################

# Load the Python Standard and DesignScript Libraries
import sys
import clr

# Add Assemblies for AutoCAD and Civil3D
clr.AddReference('AcMgd')
clr.AddReference('AcCoreMgd')
clr.AddReference('AcDbMgd')
clr.AddReference('AecBaseMgd')
clr.AddReference('AecPropDataMgd')
clr.AddReference('AeccDbMgd')
clr.AddReference('ProtoGeometry')
clr.AddReference('AutoCADNodes')
clr.AddReference('Civil3DNodes')   
clr.AddReference('Autodesk.Civil3DToolkit')
clr.AddReference('DSCoreNodes')

# Import references from AutoCAD
from Autodesk.AutoCAD.Runtime import *
from Autodesk.AutoCAD.ApplicationServices import *
from Autodesk.AutoCAD.EditorInput import *
from Autodesk.AutoCAD.DatabaseServices import *
from Autodesk.AutoCAD.Geometry import *

# Import references from Civil3D
from Autodesk.Civil.ApplicationServices import *
from Autodesk.Civil.DatabaseServices import *

# Import references from Dynamo
import Autodesk.AutoCAD.DynamoNodes as DA
import Autodesk.Civil.DynamoNodes as DC
import Autodesk.DesignScript.Geometry as DS
import DSCore
from Autodesk.AutoCAD.DynamoNodes import *
from Autodesk.Civil.DynamoNodes import *
#from Autodesk.DesignScript.Geometry import *
from DSCore import *


##############################################################
layer_name = IN[0]
document = IN[1]

try:
	layer=DA.Layer.Create(layer_name,document,DSCore.Color.ByARGB(255,255,255,255),"Continuous", "ByLineWeightDefault")
	OUT=layer,DA.Layer.Name(layer)
except:
	OUT=layer_name
# ----------------------------------------
modelSpace_2 = Autodesk.AutoCAD.DynamoNodes.Document.ModelSpace(document=current_3)

# group: Alinhamento PH
byPoints = Autodesk.AutoCAD.DynamoNodes.Polyline3D.ByPoints(points=flatten, layer=python_script, block=modelSpace_2)
explode = Autodesk.AutoCAD.DynamoNodes.Object.Explode(object=byPoints)
geometry = Autodesk.AutoCAD.DynamoNodes.Object.Geometry(object=explode)

# group: Create Pipe
boolean = BoolSelector(true)
addPipeByCurve = Autodesk.Civil.DynamoNodes.PipeNetworks.PipeNetwork.AddPipeByCurve(pipeNetwork=code_block, partSize=partSizeByName, curve=geometry, applyRules=boolean)
setName = Autodesk.Civil.DynamoNodes.CivilObject.SetName(civilObject=addPipeByCurve, name=pipe_name)
code_block_4 = CodeBlock { true; }
setSizeByInnerDimension = Autodesk.Civil.DynamoNodes.PipeNetworks.Pipe.SetSizeByInnerDimension(pipe=setName, innerDimension=pipe_size, useClosestSize=code_block_4)
innerDiameterOrWidth = Autodesk.Civil.DynamoNodes.PipeNetworks.Pipe.InnerDiameterOrWidth(pipe=setSizeByInnerDimension)

# group: Generate separate lists of Pipes and Pressure Pipes from the selection
type = Object.Type(obj=setSizeByInnerDimension)  # frozen
string_3 = StringInput("PipeNetworks.Pipe")
contains_2 = String.Contains(str=type, searchFor=string_3)
filterByBoolMask_3 = List.FilterByBoolMask(list=setSizeByInnerDimension, mask=contains_2)
watch = Watch(filterByBoolMask_3.in)
watch_2 = Watch(filterByBoolMask_3.out)

# group: Python script adds selected Pipes and Pressure Pipes to selected Profile View
python_script_2 = Python(IN[0]=watch, IN[1]=watch_2, IN[2]=filterByBoolMask_2.in)
# ---------- python_script_2.python (84 lines) ----------
import sys
import clr

# Add Assemblies for AutoCAD and Civil 3D APIs
clr.AddReference('acmgd')
clr.AddReference('acdbmgd')
clr.AddReference('accoremgd')
clr.AddReference('AecBaseMgd')
clr.AddReference('AecPropDataMgd')
clr.AddReference('AeccDbMgd')
clr.AddReference('AeccPressurePipesMgd')
clr.AddReference('acdbmgdbrep')
clr.AddReference('System.Windows.Forms')
clr.AddReference('Civil3DNodes')

# Create an alias to the Autodesk.AutoCAD.ApplicationServices.Application class
import Autodesk.AutoCAD.ApplicationServices.Application as acapp

# Import references from AutoCAD
from Autodesk.AutoCAD.Runtime import *
from Autodesk.AutoCAD.ApplicationServices import *
from Autodesk.AutoCAD.EditorInput import *
from Autodesk.AutoCAD.DatabaseServices import *
from Autodesk.AutoCAD.Geometry import *

# Import references for Civil 3D
from Autodesk.Civil.ApplicationServices import *
from Autodesk.Civil.DatabaseServices import *

adoc = acapp.DocumentManager.MdiActiveDocument
ed = adoc.Editor
civdoc = CivilApplication.ActiveDocument



Pipe = IN[0]

sPipe = IN[1]

PROFILE_VIEW = IN[2]





def move_labels(ids,PROFILE_VIEW):
	if not hasattr(PROFILE_VIEW, "__iter__"):
		PROFILE_VIEW = [PROFILE_VIEW]

	if not hasattr(ids, "__iter__"):
		ids = [ids]
	error_report = None
	res = []
	try:
		with adoc.LockDocument():		
		    with adoc.Database as db:		
		        with db.TransactionManager.StartTransaction() as t:		    
		            sampleLineId = PROFILE_VIEW[0].InternalObjectId
		            objVIEW = t.GetObject(sampleLineId, OpenMode.ForWrite)
		            for i in  ids:
						sampleLineIdp = i.InternalObjectId
						objp = t.GetObject(sampleLineIdp, OpenMode.ForWrite)
						objp.AddToProfileView(objVIEW.Id)										
						res.append('Success')
		            t.Commit()
	except:
		import traceback
		error_report = traceback.format_exc()
	if error_report is None:
		return res
	else:
		return error_report



OUTq =[]

if PROFILE_VIEW != None:
  for iPROFILE in PROFILE_VIEW:
     OUTq.append(move_labels(Pipe,iPROFILE))
     OUTq.append(move_labels(sPipe,iPROFILE))
     OUT = OUTq
else:
    OUTq.append("NO DATA")
# ----------------------------------------
watch_3 = Watch(python_script_2)
