# Dynamo graph Civil3D_CreateStructures.dyn "PIPES-CreateStructures" (Dynamo 2.5.2.7915)
# packages: Civil3DToolkit 1.1.30

current = Autodesk.AutoCAD.DynamoNodes.Document.Current()

# group: PipeNetwork, PartList, PartFamily & PartSize
insert_pipe_network_name = StringInput("<PipeNetwork name>")  # graph input
byName = Autodesk.Civil.DynamoNodes.PipeNetworks.PipeNetwork.ByName(document=current, name=insert_pipe_network_name)
pipe_network_parts_lists = PartsLists(document=current)
string_from_object = FromObject(obj=pipe_network_parts_lists)
string = StringInput("COBA - PH")
contains = String.Contains(str=string_from_object, searchFor=string)
filterByBoolMask = List.FilterByBoolMask(list=pipe_network_parts_lists, mask=contains)
string_2 = StringInput("Boca Aterro T I")
partFamilyByName = Autodesk.Civil.DynamoNodes.PipeNetworks.Selection.PartFamilyByName(partsList=filterByBoolMask.in, name=string_2)

# group: Import Data from Excel File
file_path = Filename(".\PIPES.xlsx")  # graph input
code_block = CodeBlock(parsepath=file_path) { String.Replace(parsepath,"%20"," "); }
file_from_path = FileObject(path=code_block)
code_block_2 = CodeBlock { "DYNAMO"; false; 1; }
importExcel = Data.ImportExcel(file=file_from_path, sheetName=code_block_2.out0, readAsStrings=code_block_2.out1)
dropItems = List.DropItems(list=importExcel, amount=code_block_2.out2)
flatten = List.Flatten(list=dropItems)

# group: Joining structures data
code_block_3 = CodeBlock { 0; 1; 2; 3; 4; 5; 6; 7; 8; 9; 10; 11; 12; 13; 14; 15; 16; 17; 18; }
rows = List.Count(list=flatten)
cols = Python(IN[0]=dropItems)
# ---------- cols.python (5 lines) ----------
dados = IN[0][0]

rows = len(dados)

OUT = rows
# ----------------------------------------
M1 = List.Slice(list=flatten, start=code_block_3.out1, end=rows, step=cols)
P1 = List.Slice(list=flatten, start=code_block_3.out2, end=rows, step=cols)
z_1 = List.Slice(list=flatten, start=code_block_3.out12, end=rows, step=cols)
inlet_coordinates = Point.ByCoordinates(x=M1, y=P1, z=z_1)
inlet_structure_rotations = List.Slice(list=flatten, start=code_block_3.out11, end=rows, step=cols)
inlet_structure_description = List.Slice(list=flatten, start=code_block_3.out10, end=rows, step=cols)
inlet_description_to_partsize = Python(IN[0]=inlet_structure_description, IN[1]=partFamilyByName)
# ---------- inlet_description_to_partsize.python (49 lines) ----------
# Load the Python Standard and DesignScript Libraries
import sys
import clr

# Add Assemblies for AutoCAD and Civil3D
clr.AddReference('AcMgd')
clr.AddReference('AcCoreMgd')
clr.AddReference('AcDbMgd')
clr.AddReference('AecBaseMgd')
clr.AddReference('AecPropDataMgd')
clr.AddReference('AeccDbMgd')
clr.AddReference('ProtoGeometry')


# Import references from AutoCAD
from Autodesk.AutoCAD.Runtime import *
from Autodesk.AutoCAD.ApplicationServices import *
from Autodesk.AutoCAD.EditorInput import *
from Autodesk.AutoCAD.DatabaseServices import *
from Autodesk.AutoCAD.Geometry import *

# Import references from Civil3D
from Autodesk.Civil.ApplicationServices import *
from Autodesk.Civil.DatabaseServices import *
#from Autodesk.Civil.DynamoNodes import *

#pyt_path = r'C:\Users\GGB\AppData\Roaming\Autodesk\C3D 2021\Dynamo\2.5\packages\Civil3DToolkit\bin'
#sys.path.append(pyt_path)

clr.AddReference('AutoCADNodes')
clr.AddReference('Civil3DNodes')   
clr.AddReference('Autodesk.Civil3DToolkit')
import Autodesk.AutoCAD.DynamoNodes as DA
import Autodesk.Civil.DynamoNodes as DC
from Autodesk.AutoCAD.DynamoNodes import *
from Autodesk.Civil.DynamoNodes import *


# The inputs to this node will be stored as a list in the IN variables.
partsizes = IN[0]
pf = IN[1][0]


partsizes_ = []
for j in partsizes:
	ps_ = DC.PipeNetworks.Selection.PartSizeByName(pf,j)
	partsizes_.append(ps_)

OUT = partsizes_
# ----------------------------------------
inlet_structure_name = List.Slice(list=flatten, start=code_block_3.out9, end=rows, step=cols)
M2 = List.Slice(list=flatten, start=code_block_3.out4, end=rows, step=cols)
P2 = List.Slice(list=flatten, start=code_block_3.out5, end=rows, step=cols)
z_2 = List.Slice(list=flatten, start=code_block_3.out16, end=rows, step=cols)
outlet_coordinates = Point.ByCoordinates(x=M2, y=P2, z=z_2)
outlet_structure_rotations = List.Slice(list=flatten, start=code_block_3.out15, end=rows, step=cols)
outlet_structure_description = List.Slice(list=flatten, start=code_block_3.out14, end=rows, step=cols)
outlet_description_to_partsize = Python(IN[0]=outlet_structure_description, IN[1]=partFamilyByName)  # same code as inlet_description_to_partsize
outlet_structure_name = List.Slice(list=flatten, start=code_block_3.out13, end=rows, step=cols)
join_all_structures_data = Python(IN[0]=inlet_coordinates, IN[1]=inlet_structure_rotations, IN[2]=inlet_description_to_partsize, IN[3]=inlet_structure_name, IN[4]=outlet_coordinates, IN[5]=outlet_structure_rotations, IN[6]=outlet_description_to_partsize, IN[7]=outlet_structure_name, IN[8]=inlet_structure_description, IN[9]=outlet_structure_description)
# ---------- join_all_structures_data.python (14 lines) ----------
ziped_list_inlet = zip(IN[0],IN[1],IN[2],IN[3],IN[8])
ziped_list_outlet = zip(IN[4],IN[5],IN[6],IN[7],IN[9])

#final_in = list(ziped_list_inlet)
#final_out = list(ziped_list_outlet)

final = []

final.append(ziped_list_inlet)
final.append(ziped_list_outlet)

flat_list = [item for sublist in final for item in sublist]

OUT = flat_list
# ----------------------------------------

# group: Add Strutures
add_structures = Python(IN[0]=byName, IN[1]=join_all_structures_data)
# ---------- add_structures.python (52 lines) ----------
# Load the Python Standard and DesignScript Libraries
import sys
import clr

# Add Assemblies for AutoCAD and Civil3D
clr.AddReference('AcMgd')
clr.AddReference('AcCoreMgd')
clr.AddReference('AcDbMgd')
clr.AddReference('AecBaseMgd')
clr.AddReference('AecPropDataMgd')
clr.AddReference('AeccDbMgd')
clr.AddReference('ProtoGeometry')


# Import references from AutoCAD
from Autodesk.AutoCAD.Runtime import *
from Autodesk.AutoCAD.ApplicationServices import *
from Autodesk.AutoCAD.EditorInput import *
from Autodesk.AutoCAD.DatabaseServices import *
from Autodesk.AutoCAD.Geometry import *

# Import references from Civil3D
from Autodesk.Civil.ApplicationServices import *
from Autodesk.Civil.DatabaseServices import *
#from Autodesk.Civil.DynamoNodes import *

#pyt_path = r'C:\Users\GGB\AppData\Roaming\Autodesk\C3D 2021\Dynamo\2.5\packages\Civil3DToolkit\bin'
#sys.path.append(pyt_path)

clr.AddReference('AutoCADNodes')
clr.AddReference('Civil3DNodes')   
clr.AddReference('Autodesk.Civil3DToolkit')
import Autodesk.AutoCAD.DynamoNodes as DA
import Autodesk.Civil.DynamoNodes as DC
from Autodesk.AutoCAD.DynamoNodes import *
from Autodesk.Civil.DynamoNodes import *


# The inputs to this node will be stored as a list in the IN variables.
pipenet = IN[0]
data = IN[1]

bocas = []
for d in data:
	b = DC.PipeNetworks.PipeNetwork.AddStructureByPoint(pipenet,d[2],d[0],float(d[1]),False)
	b_ = DC.CivilObject.SetName(b,d[3])	
	b__ = DC.CivilObject.SetDescription(b,d[4])
	bocas.append(b__)


# Assign your output to the OUT variable.
OUT = bocas
# ----------------------------------------
