# Dynamo graph Civil3D_DeleteAllPipes.dyn "PIPES-DeleteAllPipes" (Dynamo 2.5.2.7915)
# packages: Civil3DToolkit 1.1.27

boolean = BoolSelector(false)

# group: Import Data from Excel
file_path = Filename(".\PIPES_Data_.xlsx")  # graph input
code_block = CodeBlock(parsepath=file_path) { String.Replace(parsepath,"%20"," "); }
file_from_path = FileObject(path=code_block)
code_block_2 = CodeBlock { "DYNAMO"; false; 1; }
importExcel = Data.ImportExcel(file=file_from_path, sheetName=code_block_2.out0, readAsStrings=code_block_2.out1, showExcel=boolean)
dropItems = List.DropItems(list=importExcel, amount=code_block_2.out2)
flatten = List.Flatten(list=dropItems)

python_script = Python(IN[0]=dropItems)
# ---------- python_script.python (5 lines) ----------
dados = IN[0][0]

cols = len(dados)

OUT = cols
# ----------------------------------------
python_script_2 = Python(IN[0]=flatten, IN[1]=python_script)
# ---------- python_script_2.python (6 lines) ----------
lista = IN[0]
step = IN[1]

new = lista[0:100000:step]

OUT = new
# ----------------------------------------

# group: Delete Pipes by Name
current = Autodesk.AutoCAD.DynamoNodes.Document.Current()
getPipeByName = PipeByName(document=current, name=python_script_2)
delete = Autodesk.AutoCAD.DynamoNodes.Object.Delete(object=getPipeByName)
