# Dynamo graph Civil3D_DrawPartsProfile.dyn "JJH_DrawPipesInProfileView" (Dynamo 2.5.2.7915)
# packages: Civil3DToolkit 1.1.28

addNewTypes = Autodesk.AutoCAD.DynamoNodes.DocumentExtensions.AddNewTypes()

# group: INPUT - SELECT PIPES & PRESSURE PIPES
select_pipes_pressure_pipes = ObjectsSelection()  # 60 picked in the model; graph input

# group: Generate separate lists of Pipes and Pressure Pipes from the selection
type = Object.Type(obj=select_pipes_pressure_pipes)
string = StringInput("PipeNetworks.Pipe")
contains = String.Contains(str=type, searchFor=string)
filterByBoolMask = List.FilterByBoolMask(list=select_pipes_pressure_pipes, mask=contains)
watch = Watch(filterByBoolMask.in)
watch_2 = Watch(filterByBoolMask.out)

# group: INPUT - SELECT PROFILE VIEW
select_profile_view = ObjectsSelection()  # 262 picked in the model; graph input

# group: Python script adds selected Pipes and Pressure Pipes to selected Profile View
python_script = Python(IN[0]=watch, IN[1]=watch_2, IN[2]=select_profile_view)
# ---------- python_script.python (84 lines) ----------
import sys
import clr

# Add Assemblies for AutoCAD and Civil 3D APIs
clr.AddReference('acmgd')
clr.AddReference('acdbmgd')
clr.AddReference('accoremgd')
clr.AddReference('AecBaseMgd')
clr.AddReference('AecPropDataMgd')
clr.AddReference('AeccDbMgd')
clr.AddReference('AeccPressurePipesMgd')
clr.AddReference('acdbmgdbrep')
clr.AddReference('System.Windows.Forms')
clr.AddReference('Civil3DNodes')

# Create an alias to the Autodesk.AutoCAD.ApplicationServices.Application class
import Autodesk.AutoCAD.ApplicationServices.Application as acapp

# Import references from AutoCAD
from Autodesk.AutoCAD.Runtime import *
from Autodesk.AutoCAD.ApplicationServices import *
from Autodesk.AutoCAD.EditorInput import *
from Autodesk.AutoCAD.DatabaseServices import *
from Autodesk.AutoCAD.Geometry import *

# Import references for Civil 3D
from Autodesk.Civil.ApplicationServices import *
from Autodesk.Civil.DatabaseServices import *

adoc = acapp.DocumentManager.MdiActiveDocument
ed = adoc.Editor
civdoc = CivilApplication.ActiveDocument



Pipe = IN[0]

sPipe = IN[1]

PROFILE_VIEW = IN[2]





def move_labels(ids,PROFILE_VIEW):
	if not hasattr(PROFILE_VIEW, "__iter__"):
		PROFILE_VIEW = [PROFILE_VIEW]

	if not hasattr(ids, "__iter__"):
		ids = [ids]
	error_report = None
	res = []
	try:
		with adoc.LockDocument():		
		    with adoc.Database as db:		
		        with db.TransactionManager.StartTransaction() as t:		    
		            sampleLineId = PROFILE_VIEW[0].InternalObjectId
		            objVIEW = t.GetObject(sampleLineId, OpenMode.ForWrite)
		            for i in  ids:
						sampleLineIdp = i.InternalObjectId
						objp = t.GetObject(sampleLineIdp, OpenMode.ForWrite)
						objp.AddToProfileView(objVIEW.Id)										
						res.append('Success')
		            t.Commit()
	except:
		import traceback
		error_report = traceback.format_exc()
	if error_report is None:
		return res
	else:
		return error_report



OUTq =[]

if PROFILE_VIEW != None:
  for iPROFILE in PROFILE_VIEW:
     OUTq.append(move_labels(Pipe,iPROFILE))
     OUTq.append(move_labels(sPipe,iPROFILE))
     OUT = OUTq
else:
    OUTq.append("NO DATA")
# ----------------------------------------
watch_3 = Watch(python_script)
