# Dynamo graph Civil3D_SetPipesRefAlignment.dyn "Civil3D_Pipes_Set_Ref_Alignment" (Dynamo 2.5.2.7915)
# packages: Civil3DToolkit 1.1.30

current = Autodesk.AutoCAD.DynamoNodes.Document.Current()
pipeNetworks = PipeNetworks(document=current)
code_block = CodeBlock(a=pipeNetworks) { a[0]; a[1]; }
getPipesStructures = Autodesk.Civil.DynamoNodes.PipeNetworks.PipeNetwork.GetPipesStructures(pipeNetwork=code_block.out0)
getPipesStructures_2 = Autodesk.Civil.DynamoNodes.PipeNetworks.PipeNetwork.GetPipesStructures(pipeNetwork=code_block.out1)
list_create = List.Create(item0=getPipesStructures.Pipes, item1=getPipesStructures_2.Pipes)
flatten = List.Flatten(list=list_create@L1)
alignments = AlignmentNamesDropDown()  # nothing selected; graph input
name = Autodesk.Civil.DynamoNodes.CivilObject.Name(civilObject=alignments)
setRefAlignment = Autodesk.Civil.DynamoNodes.PipeNetworks.Pipe.SetRefAlignment(pipe=flatten@L1, alignment=name)
