# Dynamo graph Civil3D_Listagem_PontosDirRas.dyn "Civil3D_ListagemPontosDirRas" (Dynamo 2.5.2.7915)
# packages: Civil3DToolkit 1.1.30

# group: INPUT
alignments = AlignmentNamesDropDown()  # nothing selected; graph input
intervalo = DoubleInput(25)  # graph input

# group: STATIONS & ELEVATIONS
profiles = Autodesk.Civil.DynamoNodes.Alignment.Profiles(alignment=alignments)
boolean = BoolSelector(false)
stations = Autodesk.Civil.DynamoNodes.Alignment.Stations(alignment=alignments, interval=intervalo, includeGeometryStations=boolean)
elevationAtStation = Python(IN[0]=profiles, IN[1]=stations)
# ---------- elevationAtStation.python (55 lines) ----------
# Load the Python Standard and DesignScript Libraries
import sys
import clr

# Add Assemblies for AutoCAD and Civil3D
clr.AddReference('AcMgd')
clr.AddReference('AcCoreMgd')
clr.AddReference('AcDbMgd')
clr.AddReference('AecBaseMgd')
clr.AddReference('AecPropDataMgd')
clr.AddReference('AeccDbMgd')
clr.AddReference('ProtoGeometry')


# Import references from AutoCAD
from Autodesk.AutoCAD.Runtime import *
from Autodesk.AutoCAD.ApplicationServices import *
from Autodesk.AutoCAD.EditorInput import *
from Autodesk.AutoCAD.DatabaseServices import *
from Autodesk.AutoCAD.Geometry import *

# Import references from Civil3D
from Autodesk.Civil.ApplicationServices import *
from Autodesk.Civil.DatabaseServices import *
#from Autodesk.Civil.DynamoNodes import *

#pyt_path = r'C:\Users\GGB\AppData\Roaming\Autodesk\C3D 2021\Dynamo\2.5\packages\Civil3DToolkit\bin'
#sys.path.append(pyt_path)

clr.AddReference('AutoCADNodes')
clr.AddReference('Civil3DNodes')   
clr.AddReference('Autodesk.Civil3DToolkit')
import Autodesk.AutoCAD.DynamoNodes as DA
import Autodesk.Civil.DynamoNodes as DC
from Autodesk.AutoCAD.DynamoNodes import *
from Autodesk.Civil.DynamoNodes import *


# The inputs to this node will be stored as a list in the IN variables.
profile = IN[0][0]
stations = IN[1]
elevations = []
stations_ = []

for s in stations:
	try:
		elevations.append(Profile.ElevationByStation(profile,s))
		stations_.append(s)
	except:
		pass
	
	

# Assign your output to the OUT variable.
OUT = stations_,elevations
# ----------------------------------------
transpose = List.Transpose(lists=elevationAtStation)

# group: EXPORT TO EXCEL
file_path = Directory("C:\Users\GGB\Desktop")  # graph input
file_name = StringInput("")  # graph input
python_script = Python(IN[0]=file_path, IN[1]=file_name)
# ---------- python_script.python (3 lines) ----------
path = IN[0];
name = IN[1];
OUT = str(path) + '\\' + str(name) + ".xls";
# ----------------------------------------
string = StringInput("Sheet1")
number = DoubleInput(0)
boolean_2 = BoolSelector(true)
exportExcel = Data.ExportExcel(filePath=python_script, sheetName=string, startRow=number, startCol=number, data=transpose, overWrite=boolean_2)
