# Dynamo graph Civil3D_Listagem_SE-25em25m.dyn (Dynamo 2.5.2.7915)
# packages: Civil3DToolkit 1.1.30

directory_path = Directory("No file selected.")  # graph input
km_inicial = DoubleInput(0)  # graph input
km_final = DoubleInput(0)  # graph input
intervalo = DoubleInput(25)  # graph input

# group: STATIONS
alignments = AlignmentNamesDropDown("PE_IP3_T1_Plena Via")  # graph input
startStation = Autodesk.Civil.DynamoNodes.Alignment.StartStation(alignment=alignments)
code_block = CodeBlock(s=km_inicial, e=km_final, N=intervalo) { s; e; N; [s..e..N]; }
flatten = List.Flatten(list=code_block.out3)
endStation = Autodesk.Civil.DynamoNodes.Alignment.EndStation(alignment=alignments)
count = List.Count(list=flatten)
STATIONS = List.Insert(list=flatten, element=endStation, index=count)

# group: GET CROSS SLOPE
getSlopeAtStation = Autodesk.Civil.DynamoNodes.AlignmentExtensions.GetSlopeAtStation(alignment=alignments, station=STATIONS)
list_create = List.Create(item0=STATIONS, item1=getSlopeAtStation.LeftOutLaneCrossSlope, item2=getSlopeAtStation.RightOutLaneCrossSlope)
transpose = List.Transpose(lists=list_create)
code_block_2 = CodeBlock { ["KM","SE_Esq","SE_Dir"]; 0; }
insert = List.Insert(list=transpose, element=code_block_2.out0, index=code_block_2.out1)

# group: EXPORT EXCEL
file_name = StringInput("")  # graph input
python_script = Python(IN[0]=directory_path, IN[1]=file_name)
# ---------- python_script.python (3 lines) ----------
path = IN[0];
name = IN[1];
OUT = str(path) + '\\' + str(name) + ".xls";
# ----------------------------------------
code_block_3 = CodeBlock { "SE"; 0; true; }
exportExcel = Data.ExportExcel(filePath=python_script, sheetName=code_block_3.out0, startRow=code_block_3.out1, startCol=code_block_3.out1, data=insert, overWrite=code_block_3.out2)
