# Dynamo graph Home.dyn (Dynamo 2.5.2.7915)
# packages: Civil3DToolkit 1.1.30

current = Autodesk.AutoCAD.DynamoNodes.Document.Current()
modelSpace = Autodesk.AutoCAD.DynamoNodes.Document.ModelSpace(document=current)
getSectionViews = Autodesk.Civil.DynamoNodes.SectionView.GetSectionViews(block=modelSpace)
toModel = Autodesk.Civil.DynamoNodes.SectionView.ToModel(sectionView=getSectionViews)
code_block = CodeBlock(a=getSectionViews) { a[0]; }
code_block_2 = CodeBlock { -15408.5956; 70708.4665; }
findOffsetAndElevationAtXY = Autodesk.Civil.DynamoNodes.SectionView.FindOffsetAndElevationAtXY(sectionView=code_block, X=code_block_2.out0, Y=code_block_2.out1)
getSections = Autodesk.Civil.DynamoNodes.Section.GetSections(sectionView=getSectionViews)
getGeometry = Autodesk.Civil.DynamoNodes.Section.GetGeometry(section=getSections)
geometry = Autodesk.AutoCAD.DynamoNodes.Object.Geometry(object=getSections)
geometry_2 = Autodesk.AutoCAD.DynamoNodes.Object.Geometry()  # unwired: object
python_script = Python()
# ---------- python_script.python (83 lines) ----------
__author__ = 'Goncalo Bastos - bastos.g.goncalo@gmail.com'
__copyright__ = '2022'
__version__ = '1.0.0'

##############################################################

# Load the Python Standard and DesignScript Libraries
import sys
import clr

# Add Assemblies for AutoCAD and Civil3D
clr.AddReference('AcMgd')
clr.AddReference('AcCoreMgd')
clr.AddReference('AcDbMgd')
clr.AddReference('AecBaseMgd')
clr.AddReference('AecPropDataMgd')
clr.AddReference('AeccDbMgd')
clr.AddReference('ProtoGeometry')
clr.AddReference('AutoCADNodes')
clr.AddReference('Civil3DNodes')   
clr.AddReference('Autodesk.Civil3DToolkit')
clr.AddReference('DSCoreNodes')

# Import references from AutoCAD
from Autodesk.AutoCAD.Runtime import *
from Autodesk.AutoCAD.ApplicationServices import *
from Autodesk.AutoCAD.EditorInput import *
from Autodesk.AutoCAD.DatabaseServices import *
from Autodesk.AutoCAD.Geometry import *

# Import references from Civil3D
from Autodesk.Civil.ApplicationServices import *
from Autodesk.Civil.DatabaseServices import *

# Import references from Dynamo
import Autodesk.AutoCAD.DynamoNodes as DA
import Autodesk.Civil.DynamoNodes as DC
import Autodesk.DesignScript.Geometry as DS
import DSCore
from Autodesk.AutoCAD.DynamoNodes import *
from Autodesk.Civil.DynamoNodes import *
#from Autodesk.DesignScript.Geometry import *
from DSCore import *


##############################################################


adoc = Application.DocumentManager.MdiActiveDocument

def get_sections_geometries():
	global adoc
	output = []
	with adoc.LockDocument():
		with adoc.Database as db:
			with db.TransactionManager.StartTransaction() as t:
				bt = t.GetObject(db.BlockTableId, OpenMode.ForWrite)
				btr = t.GetObject(bt[BlockTableRecord.ModelSpace], OpenMode.ForWrite)
				
				for oid in btr:
					obj = t.GetObject(oid, OpenMode.ForRead)
					if isinstance(obj,Section):
						temp = []
						for sp in obj.SectionPoints:
							loc=sp.Location
							p = DS.Point.ByCoordinates(loc.X,loc.Y,loc.Z)
							temp.append(p)
						
						
						pc=None
						if len(temp)>0:
							pc=DS.PolyCurve.ByPoints(temp)
						if pc:
							output['{} {}'.format(round(obj.Station,5),obj.SourceName)]=pc
						
				t.Commit()
	return output





OUT = get_sections_geometries()
# ----------------------------------------
