# Dynamo graph AutoCAD_GetPointsCoordinates.dyn "BestFit" (Dynamo 2.5.2.7915)
# packages: Civil3DToolkit 1.1.30

file_path = Filename(".\POINTS.xlsx")
directory_from_path = DirectoryObject(path=file_path)
code_block = CodeBlock { true; 0; "Sheet1"; }
select_objects = ObjectsSelection()  # 1 picked in the model
geometry = Autodesk.AutoCAD.DynamoNodes.Object.Geometry(object=select_objects)
curves = PolyCurve.Curves(polyCurve=geometry)
startPoint = Curve.StartPoint(curve=curves)
flatten = List.Flatten(list=startPoint)
endPoint = Curve.EndPoint(curve=curves)
flatten_2 = List.Flatten(list=endPoint)
addItemToFront = List.AddItemToFront(item=flatten, list=flatten_2)
flatten_3 = List.Flatten(list=addItemToFront)
uniqueItems = List.UniqueItems(list=flatten_3)
X = Point.X(point=uniqueItems)
Y = Point.Y(point=uniqueItems)
list_create = List.Create(item0=X, item1=Y)
transpose = List.Transpose(lists=list_create)
exportExcel = Data.ExportExcel(filePath=directory_from_path, sheetName=code_block.out2, startRow=code_block.out1, startCol=code_block.out1, data=transpose, overWrite=code_block.out0)
