# Dynamo graph AutoCAD_PicagemCoordenadasMPZ.dyn "Civil3D_ListagemCoordenadasMPZ - Copy" (Dynamo 2.5.2.7915)

code_block = CodeBlock { "\n"; }
python_script = Python()
# ---------- python_script.python (58 lines) ----------
"""
Copyright 2019 Autodesk, Inc. All rights reserved.

This file is part of the Civil 3D Python Module.

"""
__author__ = 'Paolo Emilio Serra - paolo.serra@autodesk.com'
__copyright__ = '2019'
__version__ = '1.0.0'

import clr

# Add Assemblies for AutoCAD and Civil 3D APIs
clr.AddReference('acmgd')
clr.AddReference('acdbmgd')
clr.AddReference('accoremgd')
clr.AddReference('ProtoGeometry')

# Add standard Python references
import sys
sys.path.append('C:\Program Files (x86)\IronPython 2.7\Lib')
import os
import math

# Create an alias to the Autodesk.AutoCAD.ApplicationServices.Application class
import Autodesk.AutoCAD.ApplicationServices.Application as acapp

# Import references from AutoCAD
from Autodesk.AutoCAD.Runtime import *
from Autodesk.AutoCAD.ApplicationServices import *
from Autodesk.AutoCAD.EditorInput import *
from Autodesk.AutoCAD.DatabaseServices import *
from Autodesk.AutoCAD.Geometry import *

from Autodesk.DesignScript.Geometry import Point as DSPoint

adoc = acapp.DocumentManager.MdiActiveDocument
ed = adoc.Editor

# Example function
def click_point():
	"""
	Returns a Dynamo point of the user click
	"""
		
	global adoc
	global ed
	
	points = []
	while True:
		ppo = PromptPointOptions('\nSelect a point: ')
		res = ed.GetPoint(ppo)
		
		points.append(res.Value)
		if res.Status != PromptStatus.OK:
			return points	
	
OUT = click_point()
# ----------------------------------------
count = List.Count(list=python_script)
code_block_2 = CodeBlock(a=count) { a-1; }
removeItemAtIndex = List.RemoveItemAtIndex(list=python_script, indices=code_block_2)
string_from_object = FromObject(obj=removeItemAtIndex)
code_block_3 = CodeBlock { ["Point","(",")","X","Y","Z","="," "]; ""; }
string_replace_multiple = CodeBlock(str=string_from_object, search=code_block_3.out0, replace=code_block_3.out1)
# ---------- string_replace_multiple.designscript (13 lines) ----------
str;
search;
replace;
n=List.Count(search);
c= [Imperative]{
	i=0;
	result=str;
	while(i<n){
		result=String.Replace(result,search[i],replace[i]);
		i=i+1;
	}
	return=result;
};
# ----------------------------------------
clean = List.Clean(list=string_replace_multiple.out4)
code_block_4 = CodeBlock { ","; 0; 1; 2; }
split = String.Split(str=clean, separator0=code_block_4.out0)
python_script_2 = Python(IN[0]=split)
# ---------- python_script_2.python (61 lines) ----------
__author__ = 'Goncalo Bastos - bastos.g.goncalo@gmail.com'
__copyright__ = '2022'
__version__ = '1.0.0'

##############################################################

# Load the Python Standard and DesignScript Libraries
import sys
import clr

# Add Assemblies for AutoCAD and Civil3D
clr.AddReference('AcMgd')
clr.AddReference('AcCoreMgd')
clr.AddReference('AcDbMgd')
clr.AddReference('AecBaseMgd')
clr.AddReference('AecPropDataMgd')
clr.AddReference('AeccDbMgd')
clr.AddReference('ProtoGeometry')
clr.AddReference('AutoCADNodes')
clr.AddReference('Civil3DNodes')   
clr.AddReference('Autodesk.Civil3DToolkit')
clr.AddReference('DSCoreNodes')

# Import references from AutoCAD
from Autodesk.AutoCAD.Runtime import *
from Autodesk.AutoCAD.ApplicationServices import *
from Autodesk.AutoCAD.EditorInput import *
from Autodesk.AutoCAD.DatabaseServices import *
from Autodesk.AutoCAD.Geometry import *

# Import references from Civil3D
from Autodesk.Civil.ApplicationServices import *
from Autodesk.Civil.DatabaseServices import *

# Import references from Dynamo
import Autodesk.AutoCAD.DynamoNodes as DA
import Autodesk.Civil.DynamoNodes as DC
import Autodesk.DesignScript.Geometry as DS
import DSCore
from Autodesk.AutoCAD.DynamoNodes import *
from Autodesk.Civil.DynamoNodes import *
#from Autodesk.DesignScript.Geometry import *
from DSCore import *


##############################################################

strings = IN[0]
final=[]

for i in strings:
	temp=[]
	for s in i:
		s_double = float(s)
		if s_double==0:
			temp.append("0")
		else:
			temp.append(str(round(float(s_double),4)))
	final.append(temp)
OUT=final
		
# ----------------------------------------
join = String.Join(separator=code_block, string0=python_script_2)
flatten = List.Flatten(list=join)
getItemAtIndex = List.GetItemAtIndex(list=python_script_2@L2, index=code_block_4.out1)
toNumber = String.ToNumber(str=getItemAtIndex)
getItemAtIndex_2 = List.GetItemAtIndex(list=python_script_2@L2, index=code_block_4.out2)
toNumber_2 = String.ToNumber(str=getItemAtIndex_2)
getItemAtIndex_3 = List.GetItemAtIndex(list=python_script_2@L2, index=code_block_4.out3)
toNumber_3 = String.ToNumber(str=getItemAtIndex_3)
byCoordinates = Point.ByCoordinates(x=toNumber, y=toNumber_2, z=toNumber_3)
code_block_5 = CodeBlock { "@AUX"; 2; }
current = Autodesk.AutoCAD.DynamoNodes.Document.Current()
modelSpace = Autodesk.AutoCAD.DynamoNodes.Document.ModelSpace(document=current)
create = Autodesk.AutoCAD.DynamoNodes.MText.Create(text=flatten, insertionPoint=byCoordinates, layer=code_block_5.out0, block=modelSpace)
