# Dynamo graph AutoCAD_PointCoordinatesToPolyline.dyn (Dynamo 2.5.2.7915)

file_path = Filename("No file selected.")  # graph input
file_from_path = FileObject(path=file_path)
sheet_name = StringInput("")  # graph input
boolean = BoolSelector(false)
importExcel = Data.ImportExcel(file=file_from_path, sheetName=sheet_name, readAsStrings=boolean, showExcel=boolean)
transpose = List.Transpose(lists=importExcel)
code_block = CodeBlock(a=transpose) { a[0]; a[1]; }
byCoordinates = Point.ByCoordinates(x=code_block.out0, y=code_block.out1)
code_block_2 = CodeBlock { "@AUX"; }
current = Autodesk.AutoCAD.DynamoNodes.Document.Current()
modelSpace = Autodesk.AutoCAD.DynamoNodes.Document.ModelSpace(document=current)
byPoints = Autodesk.AutoCAD.DynamoNodes.Polyline.ByPoints(points=byCoordinates, layer=code_block_2, block=modelSpace)
