# Dynamo graph AutoCAD_SetLayers.dyn (Dynamo 2.5.2.7915)

python_script = Python()  # unwired: IN[0]
# ---------- python_script.python (58 lines) ----------
"""
Copyright 2019 Autodesk, Inc. All rights reserved.

This file is part of the Civil 3D Python Module.

"""
__author__ = 'Paolo Emilio Serra - paolo.serra@autodesk.com'
__copyright__ = '2019'
__version__ = '1.0.0'

import clr

# Add Assemblies for AutoCAD and Civil 3D APIs
clr.AddReference('acmgd')
clr.AddReference('acdbmgd')
clr.AddReference('accoremgd')

# Add standard Python references
import sys
sys.path.append('C:\Program Files (x86)\IronPython 2.7\Lib')

# Create an alias to the Autodesk.AutoCAD.ApplicationServices.Application class
import Autodesk.AutoCAD.ApplicationServices.Application as acapp

# Import references from AutoCAD
from Autodesk.AutoCAD.Runtime import *
from Autodesk.AutoCAD.ApplicationServices import *
from Autodesk.AutoCAD.DatabaseServices import *
from Autodesk.AutoCAD.GraphicsInterface import TextStyle

adoc = acapp.DocumentManager.MdiActiveDocument
ed = adoc.Editor

# Example function
def set_all_bylayer():
	"""
	Sets the object color to ByLayer
	:returns: The list of objects in the drawing
	"""
	global adoc
	output = []
	with adoc.LockDocument():
		with adoc.Database as db:
			with db.TransactionManager.StartTransaction() as t:
				bt = t.GetObject(db.BlockTableId, OpenMode.ForWrite)
				btr = t.GetObject(bt[BlockTableRecord.ModelSpace], OpenMode.ForWrite)
				for oid in btr:
					obj = t.GetObject(oid, OpenMode.ForWrite)
					obj.ColorIndex = 256
					obj.Linetype = 'ByLayer'
					obj.LineWeight = LineWeight030
					output.append(obj)
				t.Commit()
	return output


	
OUT = set_all_bylayer()
# ----------------------------------------
