# Dynamo graph Civil3D_CorridorFrequency.dyn (Dynamo 2.5.2.7915)
# packages: Civil3DToolkit 1.1.30

corridor = CorridorNameDropDown()  # nothing selected; graph input
baselines = Autodesk.Civil.DynamoNodes.Corridor.Baselines(corridor=corridor)
regions = Autodesk.Civil.DynamoNodes.Baseline.Regions(baseline=baselines)
boolean = BoolSelector(false)
corridor_frequency = DoubleInput(1)  # graph input
number = DoubleInput(0)
boolean_2 = BoolSelector(true)
setFrequency = Autodesk.Civil.DynamoNodes.CorridorExtensions.CorridorExtensions.SetFrequency(region=regions, atOffsetTargetsStartEnds=boolean, atHorizontalGeomPoints=boolean, atTargetGeomPoints=boolean, atProfileGeomPoints=boolean, atHighLowPoints=boolean, atSuperPoints=boolean, curveFreq=corridor_frequency, profileFreq=corridor_frequency, spiralFreq=corridor_frequency, tangentFreq=corridor_frequency, targetFreq=corridor_frequency, midOrdinate=corridor_frequency, midOrdinateTarget=corridor_frequency, curveOption=number, targetOption=corridor_frequency, rebuild=boolean_2)
