# Dynamo graph Civil3D_CorridorPlanoCotas.dyn (Dynamo 2.5.2.7915)
# packages: Civil3DToolkit 1.1.30

# group: INPUTS
guia_direita_esquerda = StringInput("Dir_P3_esq")  # graph input
guia_esquerda_esquerda = StringInput("Dir_P2_esq")  # graph input
guia_esquerda_direita = StringInput("Dir_P2_dir")  # graph input
guia_direita_direita = StringInput("Dir_P3_dir")  # graph input
alignment = AlignmentNamesDropDown()  # nothing selected; graph input
corridor = CorridorNameDropDown()  # nothing selected; graph input

# group: STATIONS
startStation = Autodesk.Civil.DynamoNodes.Alignment.StartStation(alignment=alignment)
endStation = Autodesk.Civil.DynamoNodes.Alignment.EndStation(alignment=alignment)
code_block = CodeBlock(s=startStation, e=endStation) { s; e; n=25/3; [s..e..n]; }
flatten = List.Flatten(list=code_block.out3)
count = List.Count(list=flatten)
STATIONS = List.Insert(list=flatten, element=endStation, index=count)

# group: GET AND CREATE POINTS BY CORRIDOR POINTS
list_create = List.Create(item0=guia_direita_esquerda, item1=guia_esquerda_esquerda, item2=guia_esquerda_direita, item3=guia_direita_direita)
baselines = Autodesk.Civil.DynamoNodes.Corridor.Baselines(corridor=corridor)
python_script = Python(IN[0]=list_create, IN[1]=STATIONS, IN[2]=baselines)
# ---------- python_script.python (79 lines) ----------
__author__ = 'Goncalo Bastos - bastos.g.goncalo@gmail.com'
__copyright__ = '2022'
__version__ = '1.0.0'

##############################################################

# Load the Python Standard and DesignScript Libraries
import sys
import clr

# Add Assemblies for AutoCAD and Civil3D
clr.AddReference('AcMgd')
clr.AddReference('AcCoreMgd')
clr.AddReference('AcDbMgd')
clr.AddReference('AecBaseMgd')
clr.AddReference('AecPropDataMgd')
clr.AddReference('AeccDbMgd')
clr.AddReference('ProtoGeometry')
clr.AddReference('AutoCADNodes')
clr.AddReference('Civil3DNodes')   
clr.AddReference('Autodesk.Civil3DToolkit')
clr.AddReference('DSCoreNodes')
clr.AddReference('DesignScriptBuiltin')

# Import references from AutoCAD
from Autodesk.AutoCAD.Runtime import *
from Autodesk.AutoCAD.ApplicationServices import *
from Autodesk.AutoCAD.EditorInput import *
from Autodesk.AutoCAD.DatabaseServices import *
from Autodesk.AutoCAD.Geometry import *

# Import references from Civil3D
from Autodesk.Civil.ApplicationServices import *
from Autodesk.Civil.DatabaseServices import *

# Import references from Dynamo
import Autodesk.AutoCAD.DynamoNodes as DA
import Autodesk.Civil.DynamoNodes as DC
import Autodesk.DesignScript.Geometry as DS
import DSCore
from Autodesk.AutoCAD.DynamoNodes import *
from Autodesk.Civil.DynamoNodes import *
#from Autodesk.DesignScript.Geometry import *
from DSCore import *
from DesignScript import *



##############################################################

codes = IN[0]
stations = IN[1]
baseline = IN[2][0]
out = []


adoc = Application.DocumentManager.MdiActiveDocument
editor = adoc.Editor
db = adoc.Database

with adoc.LockDocument():
    with db:
        with db.TransactionManager.StartTransaction() as t:
			for s in stations:
				temp=[]
				#temp = []
				for c in codes:
					try:
						point_dict = DC.Baseline.PointsByPointCodeAtNearestStation(baseline,s,c)
						temp.append(point_dict)
					except:
						pass
				#DSCore.List.Insert(temp,s,0)
				out.append(temp)
			
			t.Commit()
            #pass

OUT = out
# ----------------------------------------
code_block_2 = CodeBlock(data=python_script)
# ---------- code_block_2.designscript (14 lines) ----------
data;

[Imperative]
{
	out = [];
	for (station in data){
		points = [];
		for (dict in station){
			points = DSCore.List.AddItemToEnd(Dictionary.ValueAtKey(dict,"Points"),points);
		};
		out = DSCore.List.AddItemToEnd(points,out);
	};
	return = out;
};
# ----------------------------------------
flatten_2 = List.Flatten(list=code_block_2.out1)
code_block_3 = CodeBlock { "PLANTA-COTA - Plano Cotas"; }
current = Autodesk.AutoCAD.DynamoNodes.Document.Current()
byGeometry = Autodesk.Civil.DynamoNodes.CogoPoint.ByGeometry(geometry=flatten_2, layer=code_block_3, document=current)
code_block_4 = CodeBlock { "COBA_COTA APENAS"; }
setLabelStyle = Autodesk.Civil.DynamoNodes.LandDevelopment.CogoPointExtensions.SetLabelStyle(cogoPoint=byGeometry, labelStyle=code_block_4)
