# Dynamo graph Civil3D_IntersectionPointsToCOGOPoints.dyn (Dynamo 2.5.2.7915)
# packages: Civil3DToolkit 1.1.30

select_objects = ObjectsSelection()  # 4 picked in the model
geometry = Autodesk.AutoCAD.DynamoNodes.Object.Geometry(object=select_objects)
select_objects_2 = ObjectsSelection()  # 513 picked in the model
geometry_2 = Autodesk.AutoCAD.DynamoNodes.Object.Geometry(object=select_objects_2)
intersect = Geometry.Intersect(geometry=geometry, other=geometry_2, lacing=CrossProduct)
code_block = CodeBlock { false; }
clean = List.Clean(list=intersect, preserveIndices=code_block)
flatten = List.Flatten(list=clean)
type = Object.Type(obj=flatten)
code_block_2 = CodeBlock { "Point"; }
contains = String.Contains(str=type, searchFor=code_block_2)
filterByBoolMask = List.FilterByBoolMask(list=flatten, mask=contains)
code_block_3 = CodeBlock { "0"; }
current = Autodesk.AutoCAD.DynamoNodes.Document.Current()
byGeometry = Autodesk.Civil.DynamoNodes.CogoPoint.ByGeometry(geometry=filterByBoolMask.in, layer=code_block_3, document=current, lacing=Longest)
directory_path = Directory("C:\Users\GGB\Desktop")
string = StringInput("\")
string_2 = StringInput("DIRS_PONTOS")
concat = String.Concat(string0=directory_path, string1=string, string2=string_2)
code_block_4 = CodeBlock { "Sheet6"; 0; true; }
X = Point.X(point=filterByBoolMask.in)
Y = Point.Y(point=filterByBoolMask.in)
list_create = List.Create(item0=X, item1=Y)
transpose = List.Transpose(lists=list_create)  # frozen
exportExcel = Data.ExportExcel(filePath=concat, sheetName=code_block_4.out0, startRow=code_block_4.out1, startCol=code_block_4.out1, data=transpose, overWrite=code_block_4.out2)
