# Dynamo graph Civil3D_ProfileViewSE.dyn (Dynamo 2.5.2.7915)
# packages: Civil3DToolkit 1.1.30

alignments = AlignmentNamesDropDown("Caminho Paralelo 106-1")  # graph input
startStation = Autodesk.Civil.DynamoNodes.Alignment.StartStation(alignment=alignments)
number = DoubleInput(0)
coordinateSystemByStationOffset = Autodesk.Civil.DynamoNodes.Alignment.CoordinateSystemByStationOffset(alignment=alignments, station=startStation, offset=number)
origin = CoordinateSystem.Origin(coordinateSystem=coordinateSystemByStationOffset)
X = Point.X(point=origin)
Y = Point.Y(point=origin)
Z = Point.Z(point=origin)
code_block = CodeBlock(x=X, y=Y, z=Z) { x_=x+1000; y; z; }
byCoordinates = Point.ByCoordinates(x=code_block.x_, y=code_block.y, z=code_block.z)
name = Autodesk.Civil.DynamoNodes.CivilObject.Name(civilObject=alignments)
code_block_2 = CodeBlock(align=name) { align; "COBA_Grelha  [1_1000]Km. 25m - 100m"; "COBA_PENTE_PExec_100_50"; }
byAlignmentPointName = Autodesk.Civil.DynamoNodes.ProfileView.ByAlignmentPointName(alignment=alignments, insertPoint=byCoordinates, profileViewName=code_block_2.align, bandSet=code_block_2.out2, style=code_block_2.out1)
