# Dynamo graph Civil3D_RenameAssemblies.dyn (Dynamo 2.5.2.7915)
# packages: Civil3DToolkit 1.1.30

select_objects = ObjectsSelection()  # 52 picked in the model; frozen
number = DoubleInput(1)
count = List.Count(list=select_objects)
code_block = CodeBlock(s=number, n=count) { s; n; [s..s+n..1]; }
flatten = List.Flatten(list=code_block.out2)
sample_line_code = CodeBlock { "PTT-"; }
python_script = Python(IN[0]=flatten, IN[1]=sample_line_code)
# ---------- python_script.python (14 lines) ----------
__author__ = 'Goncalo Bastos - bastos.g.goncalo@gmail.com'
__copyright__ = '2022'
__version__ = '1.0.0'

##############################################################

names = IN[0]
code = IN[1]
out=[]
for name in names:
	out.append(str(code)+str(name))
	
OUT= out
	
# ----------------------------------------
setName = Autodesk.Civil.DynamoNodes.CivilObject.SetName(civilObject=select_objects, name=python_script)  # frozen
code_block_2 = CodeBlock { "Location"; }
getParameterByName = Autodesk.AutoCAD.DynamoNodes.ObjectExtensions.GetParameterByName(obj=select_objects, name=code_block_2)
string_from_object = FromObject(obj=getParameterByName)
python_script_2 = Python(IN[0]=string_from_object)
# ---------- python_script_2.python (16 lines) ----------
__author__ = 'Goncalo Bastos - bastos.g.goncalo@gmail.com'
__copyright__ = '2022'
__version__ = '1.0.0'

##############################################################

points_strings = IN[0]
x = []
y = []
for point in points_strings:
	point_ = point.replace("(","")
	x.append(float(point_.split(",")[0]))
	y.append(float(point_.split(",")[1]))

OUT=x,y
	
# ----------------------------------------
code_block_3 = CodeBlock(a=python_script_2) { a[0]; a[1]; }
byOrigin = CoordinateSystem.ByOrigin(x=code_block_3.out0, y=code_block_3.out1)
origin = CoordinateSystem.Origin(coordinateSystem=byOrigin)
code_block_4 = CodeBlock { 1; 500; }
byCoordinates = Vector.ByCoordinates(x=code_block_4.out0)
byStartPointDirectionLength = Line.ByStartPointDirectionLength(startPoint=origin, direction=byCoordinates, length=code_block_4.out1)
code_block_5 = CodeBlock { "@AUX"; }
current = Autodesk.AutoCAD.DynamoNodes.Document.Current()
modelSpace = Autodesk.AutoCAD.DynamoNodes.Document.ModelSpace(document=current)
byGeometry = Autodesk.AutoCAD.DynamoNodes.Object.ByGeometry(geometry=byStartPointDirectionLength, layer=code_block_5, block=modelSpace)
select_objects_2 = ObjectsSelection()  # 52 picked in the model
code_block_6 = CodeBlock { "Location"; }
getParameterByName_2 = Autodesk.AutoCAD.DynamoNodes.ObjectExtensions.GetParameterByName(obj=select_objects_2, name=code_block_6)
string_from_object_2 = FromObject(obj=getParameterByName_2)
python_script_3 = Python(IN[0]=string_from_object_2)  # same code as python_script_2
code_block_7 = CodeBlock(a=python_script_3) { a[0]; a[1]; }
byOrigin_2 = CoordinateSystem.ByOrigin(x=code_block_7.out0, y=code_block_7.out1)
origin_2 = CoordinateSystem.Origin(coordinateSystem=byOrigin_2)
endPoint = Curve.EndPoint(curve=byStartPointDirectionLength)
code_block_8 = CodeBlock(a=select_objects_2) { a[0]; }
code_block_9 = CodeBlock { 0; }
byCoordinates_2 = Point.ByCoordinates(x=code_block_9, y=code_block_9, z=code_block_9)
setParameterValueByName = Autodesk.AutoCAD.DynamoNodes.ObjectExtensions.SetParameterValueByName(obj=code_block_8, parameter=code_block_6, value=byCoordinates_2)
getParameterByName_3 = Autodesk.AutoCAD.DynamoNodes.ObjectExtensions.GetParameterByName(obj=setParameterValueByName, name=code_block_6)
getParameters = Autodesk.AutoCAD.DynamoNodes.ObjectExtensions.GetParameters(obj=code_block_8)
