# Dynamo graph Civil3D_RenameCorridorRegions.dyn (Dynamo 2.5.2.7915)
# packages: Civil3DToolkit 1.1.30

corridors = CorridorNameDropDown("PE_IP3_T1_Plena Via")
baselines = Autodesk.Civil.DynamoNodes.Corridor.Baselines(corridor=corridors)
regions = Autodesk.Civil.DynamoNodes.Baseline.Regions(baseline=baselines)
flatten = List.Flatten(list=regions)
number = DoubleInput(1)
count = List.Count(list=flatten)
code_block = CodeBlock(s=number, n=count) { s; n; [s..n..1]; }
flatten_2 = List.Flatten(list=code_block.out2)
sample_line_code = CodeBlock { "RG-"; }
python_script = Python(IN[0]=flatten_2, IN[1]=sample_line_code)
# ---------- python_script.python (14 lines) ----------
__author__ = 'Goncalo Bastos - bastos.g.goncalo@gmail.com'
__copyright__ = '2022'
__version__ = '1.0.0'

##############################################################

names = IN[0]
code = IN[1]
out=[]
for name in names:
	out.append(str(code)+str(name))
	
OUT= out
	
# ----------------------------------------
setName = Autodesk.Civil.DynamoNodes.BaselineRegion.SetName(baselineRegion=flatten, name=python_script)
