# Dynamo graph Civil3D_SampleLines_AddSources.dyn (Dynamo 2.5.2.7915)

# group: Select sample line from the group that you want to add the source to
select_object = ObjectSelection()  # 1 picked in the model; graph input

python_script = Python(IN[0]=select_object)
# ---------- python_script.python (61 lines) ----------
# Load the Python Standard and DesignScript Libraries
import sys
import clr

# Add Assemblies for AutoCAD and Civil3D
clr.AddReference('AcMgd')
clr.AddReference('AcCoreMgd')
clr.AddReference('AcDbMgd')
clr.AddReference('AecBaseMgd')
clr.AddReference('AecPropDataMgd')
clr.AddReference('AeccDbMgd')

# Import references from AutoCAD
from Autodesk.AutoCAD.Runtime import *
from Autodesk.AutoCAD.ApplicationServices import *
from Autodesk.AutoCAD.EditorInput import *
from Autodesk.AutoCAD.DatabaseServices import *
from Autodesk.AutoCAD.Geometry import *

# Import references from Civil3D
from Autodesk.Civil.ApplicationServices import *
from Autodesk.Civil.DatabaseServices import *

# The inputs to this node will be stored as a list in the IN variables.
dataEnteringNode = IN

adoc = Application.DocumentManager.MdiActiveDocument
editor = adoc.Editor

sampleline = IN[0]

def addsource(sampleline):

	with adoc.LockDocument():
	    with adoc.Database as db:
			with db.TransactionManager.StartTransaction() as t:
	        	#Get sample line ID
				slId = sampleline.InternalObjectId
				#Get sample line group ID
				slgroupId = slId.GroupId
				#Open SLGroup
				slg = t.GetObject(slgroupId, OpenMode.ForWrite)
				#Get sources
				slgs = slg.GetSectionSources()
				#Get source item
				source = slgs.Item[0]
				#Add the source item above
				#source.IsSampled = True
				#Add all sources
				for source in slgs:
					st = source.SourceType
					if str(st) == "TinSurface":
						source.IsSampled = True
					else:
						pass
				# Commit before end transaction
				t.Commit()

	return st
# Assign your output to the OUT variable.
OUT = addsource(sampleline)
# ----------------------------------------
