# Dynamo graph Civil3D_SurfaceProfile.dyn (Dynamo 2.5.2.7915)
# packages: Civil3DToolkit 1.1.30

# group: INPUT
alignments = AlignmentNamesDropDown()  # nothing selected; graph input
surfaces = SurfaceNamesDropDown()  # nothing selected; graph input

# group: SURFACE PROFILE
code_block = CodeBlock { "COBA_TERRENO NATURAL"; "_Aucun affichage"; "Terrreno Natural"; 0; }
name = Autodesk.Civil.DynamoNodes.CivilObject.Name(civilObject=surfaces)
startStation = Autodesk.Civil.DynamoNodes.Alignment.StartStation(alignment=alignments)
endStation = Autodesk.Civil.DynamoNodes.Alignment.EndStation(alignment=alignments)
addProfileBySurface = Autodesk.Civil.DynamoNodes.AlignmentExtensions.AddProfileBySurface(alignment=alignments, profileName=code_block.out2, surface=name, style=code_block.out0, labelSet=code_block.out1, offset=code_block.out3, sampleStart=startStation, sampleEnd=endStation)
