# Dynamo graph Civil3D_SurfaceSpotElevation.dyn (Dynamo 2.5.2.7915)
# packages: Camber 1.0.1, Civil3DToolkit 1.1.30

surfaces = SurfaceNamesDropDown()  # nothing selected; graph input
layer = StringInput("")  # graph input
layer_2 = StringInput("")  # graph input
code_block = CodeBlock(a=layer, b=layer_2) { [a,b]; }
current = Autodesk.AutoCAD.DynamoNodes.Document.Current()
modelSpace = Autodesk.AutoCAD.DynamoNodes.Document.ModelSpace(document=current)
all_objects_on_layer = AcObjectsOnLayer(layer=code_block, block=modelSpace)
getGeometry = Autodesk.AutoCAD.DynamoNodes.PolylineExtensions.GetGeometry(polyline=all_objects_on_layer)
code_block_2 = CodeBlock(a=getGeometry) { a[0]; a[1]; }
flatten = List.Flatten(list=code_block_2.out0)
flatten_2 = List.Flatten(list=code_block_2.out1)
intersection_points = Python(IN[0]=flatten, IN[1]=flatten_2)
# ---------- intersection_points.python (82 lines) ----------
# Load the Python Standard and DesignScript Libraries
import sys
import clr

# Add Assemblies for AutoCAD and Civil3D
clr.AddReference('AcMgd')
clr.AddReference('AcCoreMgd')
clr.AddReference('AcDbMgd')
clr.AddReference('AecBaseMgd')
clr.AddReference('AecPropDataMgd')
clr.AddReference('AeccDbMgd')
clr.AddReference('ProtoGeometry')
clr.AddReference('AutoCADNodes')
clr.AddReference('Civil3DNodes')   
clr.AddReference('Autodesk.Civil3DToolkit')
clr.AddReference('DSCoreNodes')


# Import references from AutoCAD
from Autodesk.AutoCAD.Runtime import *
from Autodesk.AutoCAD.ApplicationServices import *
from Autodesk.AutoCAD.EditorInput import *
from Autodesk.AutoCAD.DatabaseServices import *
from Autodesk.AutoCAD.Geometry import *

# Import references from Civil3D
from Autodesk.Civil.ApplicationServices import *
from Autodesk.Civil.DatabaseServices import *

import Autodesk.AutoCAD.DynamoNodes as DA
import Autodesk.Civil.DynamoNodes as DC
from Autodesk.AutoCAD.DynamoNodes import *
from Autodesk.Civil.DynamoNodes import *
#from Autodesk.DesignScript.Geometry import *
import Autodesk.DesignScript.Geometry as DS
import DSCore
from DSCore import *



polylines = IN[0]
others = IN[1]
output = []

for tick in polylines:
	temp = []
	for other in others:
		try:
			inter = DS.Geometry.Intersect(tick,other)
			temp.append(inter)
		except:
			continue
	#if temp:
	output.append(temp)




"""

for i,layer in enumerate(polylines):
    temp = []
    for j,poly in enumerate(layer):
        count=0
        for k,other in enumerate(others[i]):
        	try:
            	inter = DS.Geometry.Intersect(poly,other)
            	temp.append(inter)
        	except:
        		continue
            
            count=count+1
    output.append(temp)


out_ = []
for o in output:
    a = [item for sublist in o for item in sublist]   
    out_.append(a)
    
"""
OUT = output
# ----------------------------------------
flatten_3 = List.Flatten(list=intersection_points)
surface_elevation_label_styles = SurfaceElevationLabelStylesDropDown("COTA")
marker_styles = MarkerStyleDropDown("COTA")
byPoint = Camber.Civil.Labels.SurfaceElevationLabel.ByPoint(surface=surfaces, point=flatten_3, labelStyle=surface_elevation_label_styles, markerStyle=marker_styles)
