# Dynamo graph Civil3D_SurfaceStyle_TriangulosPontos.dyn "Civil3D_SurfaceStyle" (Dynamo 2.5.2.7915)
# packages: Civil3DToolkit 1.1.30

surfaces = SurfaceNamesDropDown()  # nothing selected; graph input
string = StringInput("TRIÂNGULOS E PONTOS")
setStyle = Autodesk.AutoCAD.DynamoNodes.DocumentExtensions.SetStyle(obj=surfaces, styleName=string)
