# Dynamo graph Civil3D_CheckBlocksByLayer.dyn (Dynamo 2.5.2.7915)
# packages: Civil3DToolkit 1.1.30

directory_path = Directory("No file selected.")  # graph input
file_name = StringInput("")  # graph input
python_script = Python(IN[0]=directory_path, IN[1]=file_name)
# ---------- python_script.python (3 lines) ----------
path = IN[0];
name = IN[1];
OUT = str(path) + '\\' + str(name) + ".xls";
# ----------------------------------------
code_block = CodeBlock { "Sheet1"; 0; true; ["Nome Bloco","Layer","Coordenadas"]; "Name"; }
objects_types = AcObjectTypes("Block Reference")
current = Autodesk.AutoCAD.DynamoNodes.Document.Current()
modelSpace = Autodesk.AutoCAD.DynamoNodes.Document.ModelSpace(document=current)
all_objects_of_type = AcObjectsOfType(type=objects_types, block=modelSpace)
getParameterByName = Autodesk.AutoCAD.DynamoNodes.ObjectExtensions.GetParameterByName(obj=all_objects_of_type, name=code_block.out4)
layer = Autodesk.AutoCAD.DynamoNodes.Object.Layer(object=all_objects_of_type)
getInsertionPoint = Autodesk.AutoCAD.DynamoNodes.BlockReferenceExtensions.GetInsertionPoint(blockReference=all_objects_of_type)
list_create = List.Create(item0=getParameterByName, item1=layer, item2=getInsertionPoint)
transpose = List.Transpose(lists=list_create)
insert = List.Insert(list=transpose, element=code_block.out3, index=code_block.out1)
exportExcel = Data.ExportExcel(filePath=python_script, sheetName=code_block.out0, startRow=code_block.out1, startCol=code_block.out1, data=insert, overWrite=code_block.out2)
