# Dynamo graph Civil3D_MedicoesPavimentacao.dyn "Civil3D_CorridorShapes" (Dynamo 2.5.2.7915)
# packages: Civil3DToolkit 1.1.30

# group: INPUT
corridors = CorridorNameDropDown()  # nothing selected; graph input
start_station = DoubleInput(0)  # graph input
end_station = DoubleInput(0)  # graph input

# group: Data Preparation
baselines = Autodesk.Civil.DynamoNodes.Corridor.Baselines(corridor=corridors)
codes = Autodesk.Civil.DynamoNodes.Baseline.Codes(baseline=baselines)
code_block = CodeBlock(a=baselines, b=codes.Shape_Codes) { "km"; a[0]; b[0]; }
code_block_2 = CodeBlock(s=start_station, e=end_station) { s; e; [s..e..25]; }
flatten = List.Flatten(list=code_block_2.out2)

# group: Calculate Areas
python_script = Python(IN[0]=code_block.out1, IN[1]=flatten, IN[2]=code_block.out2)
# ---------- python_script.python (67 lines) ----------
__author__ = 'Goncalo Bastos - bastos.g.goncalo@gmail.com'
__copyright__ = '2022'
__version__ = '1.0.0'

##############################################################

# Load the Python Standard and DesignScript Libraries
import sys
import clr

# Add Assemblies for AutoCAD and Civil3D
clr.AddReference('AcMgd')
clr.AddReference('AcCoreMgd')
clr.AddReference('AcDbMgd')
clr.AddReference('AecBaseMgd')
clr.AddReference('AecPropDataMgd')
clr.AddReference('AeccDbMgd')
clr.AddReference('ProtoGeometry')
clr.AddReference('AutoCADNodes')
clr.AddReference('Civil3DNodes')   
clr.AddReference('Autodesk.Civil3DToolkit')
clr.AddReference('DSCoreNodes')

# Import references from AutoCAD
from Autodesk.AutoCAD.Runtime import *
from Autodesk.AutoCAD.ApplicationServices import *
from Autodesk.AutoCAD.EditorInput import *
from Autodesk.AutoCAD.DatabaseServices import *
from Autodesk.AutoCAD.Geometry import *

# Import references from Civil3D
from Autodesk.Civil.ApplicationServices import *
from Autodesk.Civil.DatabaseServices import *

# Import references from Dynamo
import Autodesk.AutoCAD.DynamoNodes as DA
import Autodesk.Civil.DynamoNodes as DC
import Autodesk.DesignScript.Geometry as DS
import DSCore
from Autodesk.AutoCAD.DynamoNodes import *
from Autodesk.Civil.DynamoNodes import *
#from Autodesk.DesignScript.Geometry import *
from DSCore import *


##############################################################
baseline = IN[0]
stations = IN[1]
codes = IN[2]


def ShapePoints(baseline,station,code):
	return DC.Baseline.PointsByShapeCodeAtNearestStation(baseline,station,code)

out = []
for station in stations:
	temp = []
	for code in codes:
		try:
			temp.append(ShapePoints(baseline,station,code))
		except:
			pass
	out.append(temp)



OUT = out
# ----------------------------------------
code_block_3 = CodeBlock { "Points"; }
valueAtKey = DesignScript.Builtin.Dictionary.ValueAtKey(dictionary=python_script, key=code_block_3)
python_script_2 = Python(IN[0]=valueAtKey)
# ---------- python_script_2.python (78 lines) ----------
__author__ = 'Goncalo Bastos - bastos.g.goncalo@gmail.com'
__copyright__ = '2022'
__version__ = '1.0.0'

##############################################################

# Load the Python Standard and DesignScript Libraries
import sys
import clr

# Add Assemblies for AutoCAD and Civil3D
clr.AddReference('AcMgd')
clr.AddReference('AcCoreMgd')
clr.AddReference('AcDbMgd')
clr.AddReference('AecBaseMgd')
clr.AddReference('AecPropDataMgd')
clr.AddReference('AeccDbMgd')
clr.AddReference('ProtoGeometry')
clr.AddReference('AutoCADNodes')
clr.AddReference('Civil3DNodes')   
clr.AddReference('Autodesk.Civil3DToolkit')
clr.AddReference('DSCoreNodes')

# Import references from AutoCAD
from Autodesk.AutoCAD.Runtime import *
from Autodesk.AutoCAD.ApplicationServices import *
from Autodesk.AutoCAD.EditorInput import *
from Autodesk.AutoCAD.DatabaseServices import *
from Autodesk.AutoCAD.Geometry import *

# Import references from Civil3D
from Autodesk.Civil.ApplicationServices import *
from Autodesk.Civil.DatabaseServices import *

# Import references from Dynamo
import Autodesk.AutoCAD.DynamoNodes as DA
import Autodesk.Civil.DynamoNodes as DC
import Autodesk.DesignScript.Geometry as DS
import DSCore
from Autodesk.AutoCAD.DynamoNodes import *
from Autodesk.Civil.DynamoNodes import *
#from Autodesk.DesignScript.Geometry import *
from DSCore import *


##############################################################


def UniqueValues(element):
	unique_list = []
	for x in element:
		if x not in unique_list:
			unique_list.append(x)
	return unique_list

def SurfaceByPoints(points):
	out=[]
	for km in points:
		temp = []
		if km is None:
			pass
		else:
			for shapes in km:
				temp_=[]
				for points in shapes:
					points = UniqueValues(points)
					try:
						surface = DS.Surface.ByPerimeterPoints(points)
						temp_.append(surface)
					except:
						pass
				temp.append(temp_)
		out.append(temp)
	return out



OUT = SurfaceByPoints(IN[0])
# ----------------------------------------
area = Surface.Area(surface=python_script_2)
python_script_3 = Python(IN[0]=area, IN[1]=flatten)
# ---------- python_script_3.python (64 lines) ----------
__author__ = 'Goncalo Bastos - bastos.g.goncalo@gmail.com'
__copyright__ = '2022'
__version__ = '1.0.0'

##############################################################

# Load the Python Standard and DesignScript Libraries
import sys
import clr

# Add Assemblies for AutoCAD and Civil3D
clr.AddReference('AcMgd')
clr.AddReference('AcCoreMgd')
clr.AddReference('AcDbMgd')
clr.AddReference('AecBaseMgd')
clr.AddReference('AecPropDataMgd')
clr.AddReference('AeccDbMgd')
clr.AddReference('ProtoGeometry')
clr.AddReference('AutoCADNodes')
clr.AddReference('Civil3DNodes')   
clr.AddReference('Autodesk.Civil3DToolkit')
clr.AddReference('DSCoreNodes')

# Import references from AutoCAD
from Autodesk.AutoCAD.Runtime import *
from Autodesk.AutoCAD.ApplicationServices import *
from Autodesk.AutoCAD.EditorInput import *
from Autodesk.AutoCAD.DatabaseServices import *
from Autodesk.AutoCAD.Geometry import *

# Import references from Civil3D
from Autodesk.Civil.ApplicationServices import *
from Autodesk.Civil.DatabaseServices import *

# Import references from Dynamo
import Autodesk.AutoCAD.DynamoNodes as DA
import Autodesk.Civil.DynamoNodes as DC
import Autodesk.DesignScript.Geometry as DS
import DSCore
from Autodesk.AutoCAD.DynamoNodes import *
from Autodesk.Civil.DynamoNodes import *
#from Autodesk.DesignScript.Geometry import *
from DSCore import *


##############################################################

kms = IN[0]
stations = IN[1]
areas_=[]


for i,shapes in enumerate(kms):
	temp=[]
	if shapes is None:
		pass
	else:
		temp.append(stations[i])
		for areas in shapes:
			temp.append(sum(areas))
	areas_.append(temp)
	

OUT = areas_
# ----------------------------------------
addItemToFront = List.AddItemToFront(item=code_block.out0, list=code_block.out2)

# group: Export Excel
directory_path = Directory("No file selected.")  # graph input
file_name = StringInput("")  # graph input
python_script_4 = Python(IN[0]=directory_path, IN[1]=file_name)
# ---------- python_script_4.python (3 lines) ----------
path = IN[0];
name = IN[1];
OUT = str(path) + '\\' + str(name) + ".xls";
# ----------------------------------------
code_block_4 = CodeBlock { "Sheet1"; 0; true; }
insert = List.Insert(list=python_script_3, element=addItemToFront, index=code_block_4.out1)
exportExcel = Data.ExportExcel(filePath=python_script_4, sheetName=code_block_4.out0, startRow=code_block_4.out1, startCol=code_block_4.out1, data=insert, overWrite=code_block_4.out2)
