# Dynamo graph Civil3D_Medicoes_por_Layer.dyn "MED-Layers" (Dynamo 2.5.2.7915)

# group: Polylines by Layer
objects_types = AcObjectTypes("Polyline")
current = Autodesk.AutoCAD.DynamoNodes.Document.Current()
modelSpace = Autodesk.AutoCAD.DynamoNodes.Document.ModelSpace(document=current)
all_objects_of_type = AcObjectsOfType(type=objects_types, block=modelSpace)
layer = Autodesk.AutoCAD.DynamoNodes.Object.Layer(object=all_objects_of_type)
groupByKey = List.GroupByKey(list=all_objects_of_type, keys=layer)

# group: Total Length per Layer
geometry = Autodesk.AutoCAD.DynamoNodes.Object.Geometry(object=groupByKey.groups)
length = Curve.Length(curve=geometry)
sum = Math.Sum(values=length)
integer_slider = IntegerSlider(3, range=0..3 step 1)
round = Math.Round(number=sum, digits=integer_slider)

# group: Blocks by Layer
objects_types_2 = AcObjectTypes("Block Reference")
current_2 = Autodesk.AutoCAD.DynamoNodes.Document.Current()
modelSpace_2 = Autodesk.AutoCAD.DynamoNodes.Document.ModelSpace(document=current_2)
all_objects_of_type_2 = AcObjectsOfType(type=objects_types_2, block=modelSpace_2)
block = Autodesk.AutoCAD.DynamoNodes.BlockReference.Block(blockReference=all_objects_of_type_2)
name = Autodesk.AutoCAD.DynamoNodes.Block.Name(block=block)
layer_2 = Autodesk.AutoCAD.DynamoNodes.Object.Layer(object=all_objects_of_type_2)
groupByKey_2 = List.GroupByKey(list=name, keys=layer_2)

# group: Count blocks per Layer
list_create = List.Create(item0=groupByKey_2.groups, item1=groupByKey_2.unique_keys)
python_script = Python(IN[0]=list_create)
# ---------- python_script.python (40 lines) ----------
# Load the Python Standard and DesignScript Libraries
import sys
import clr

# Add Assemblies for AutoCAD and Civil3D
clr.AddReference('AcMgd')
clr.AddReference('AcCoreMgd')
clr.AddReference('AcDbMgd')
clr.AddReference('AecBaseMgd')
clr.AddReference('AecPropDataMgd')
clr.AddReference('AeccDbMgd')

# Import references from AutoCAD
from Autodesk.AutoCAD.Runtime import *
from Autodesk.AutoCAD.ApplicationServices import *
from Autodesk.AutoCAD.EditorInput import *
from Autodesk.AutoCAD.DatabaseServices import *
from Autodesk.AutoCAD.Geometry import *

# Import references from Civil3D
from Autodesk.Civil.ApplicationServices import *
from Autodesk.Civil.DatabaseServices import *

# The inputs to this node will be stored as a list in the IN variables.
dataEnteringNode = IN

adoc = Application.DocumentManager.MdiActiveDocument
editor = adoc.Editor

blocks = dataEnteringNode[0][0]
Layers = dataEnteringNode[0][1]
number_blocks = []

for i in blocks:
	values = len(i)
	number_blocks.append(values)

my_dict = dict(zip(Layers,number_blocks))
# Assign your output to the OUT variable.
OUT = my_dict
# ----------------------------------------
python_script_2 = Python(IN[0]=python_script)
# ---------- python_script_2.python (40 lines) ----------
# Load the Python Standard and DesignScript Libraries
import sys
import clr

# Add Assemblies for AutoCAD and Civil3D
clr.AddReference('AcMgd')
clr.AddReference('AcCoreMgd')
clr.AddReference('AcDbMgd')
clr.AddReference('AecBaseMgd')
clr.AddReference('AecPropDataMgd')
clr.AddReference('AeccDbMgd')

# Import references from AutoCAD
from Autodesk.AutoCAD.Runtime import *
from Autodesk.AutoCAD.ApplicationServices import *
from Autodesk.AutoCAD.EditorInput import *
from Autodesk.AutoCAD.DatabaseServices import *
from Autodesk.AutoCAD.Geometry import *

# Import references from Civil3D
from Autodesk.Civil.ApplicationServices import *
from Autodesk.Civil.DatabaseServices import *

# The inputs to this node will be stored as a list in the IN variables.
dataEnteringNode = IN

adoc = Application.DocumentManager.MdiActiveDocument
editor = adoc.Editor

my_dict = dataEnteringNode[0]

layers = []

for key in my_dict.keys():
	layers.append(key)
	


# Assign your output to the OUT variable.
OUT = layers
# ----------------------------------------
python_script_3 = Python(IN[0]=python_script)
# ---------- python_script_3.python (40 lines) ----------
# Load the Python Standard and DesignScript Libraries
import sys
import clr

# Add Assemblies for AutoCAD and Civil3D
clr.AddReference('AcMgd')
clr.AddReference('AcCoreMgd')
clr.AddReference('AcDbMgd')
clr.AddReference('AecBaseMgd')
clr.AddReference('AecPropDataMgd')
clr.AddReference('AeccDbMgd')

# Import references from AutoCAD
from Autodesk.AutoCAD.Runtime import *
from Autodesk.AutoCAD.ApplicationServices import *
from Autodesk.AutoCAD.EditorInput import *
from Autodesk.AutoCAD.DatabaseServices import *
from Autodesk.AutoCAD.Geometry import *

# Import references from Civil3D
from Autodesk.Civil.ApplicationServices import *
from Autodesk.Civil.DatabaseServices import *

# The inputs to this node will be stored as a list in the IN variables.
dataEnteringNode = IN

adoc = Application.DocumentManager.MdiActiveDocument
editor = adoc.Editor

my_dict = dataEnteringNode[0]

blocks_counts = []

for value in my_dict.values():
	blocks_counts.append(value)
	


# Assign your output to the OUT variable.
OUT = blocks_counts
# ----------------------------------------

# group: Data Export to Excel
file_path = Directory("C:\Users\GGB\Desktop")  # graph input
file_name = StringInput("teste")  # graph input
python_script_4 = Python(IN[0]=file_path, IN[1]=file_name)
# ---------- python_script_4.python (3 lines) ----------
path = IN[0];
name = IN[1];
OUT = str(path) + '\\' + str(name) + ".xls";
# ----------------------------------------
string = StringInput("Polylines")
number = DoubleInput(0)
list_create_2 = List.Create(item0=groupByKey.unique_keys, item1=round)
transpose = List.Transpose(lists=list_create_2)
boolean = BoolSelector(false)
exportExcel = Data.ExportExcel(filePath=python_script_4, sheetName=string, startRow=number, startCol=number, data=transpose, overWrite=boolean)
watch = Watch()  # unwired: arg0
watch_2 = Watch(python_script_4)
string_2 = StringInput("Blocks")
number_2 = DoubleInput(0)
list_create_3 = List.Create(item0=python_script_2, item1=python_script_3)
transpose_2 = List.Transpose(lists=list_create_3)
boolean_2 = BoolSelector(true)
exportExcel_2 = Data.ExportExcel(filePath=python_script_4, sheetName=string_2, startRow=number_2, startCol=number_2, data=transpose_2, overWrite=boolean_2)
watch_3 = Watch(transpose_2)
