# Dynamo graph Civil3D_Create3DLinesByCoordinates.dyn "PIPES-CreateAlignmentsByCoordinates" (Dynamo 2.5.2.7915)

# group: Import Existing Culvert Coordinates from Excel File
file_path = Filename(".\PIPES.xlsx")  # graph input
code_block = CodeBlock(parsepath=file_path) { String.Replace(parsepath,"%20"," "); }
file_from_path = FileObject(path=code_block)
code_block_2 = CodeBlock { "DYNAMO"; false; 1; }
importExcel = Data.ImportExcel(file=file_from_path, sheetName=code_block_2.out0, readAsStrings=code_block_2.out1)
dropItems = List.DropItems(list=importExcel, amount=code_block_2.out2)
flatten = List.Flatten(list=dropItems)

# group: Getting Inlet and Outlet Coordinates into Points
code_block_3 = CodeBlock { 0; 1; 2; 3; 4; 5; 6; 8; }
count = List.Count(list=flatten)
python_script = Python(IN[0]=dropItems)
# ---------- python_script.python (5 lines) ----------
dados = IN[0][0]

rows = len(dados)

OUT = rows
# ----------------------------------------
slice = List.Slice(list=flatten, start=code_block_3.out1, end=count, step=python_script)
slice_2 = List.Slice(list=flatten, start=code_block_3.out2, end=count, step=python_script)
slice_3 = List.Slice(list=flatten, start=code_block_3.out3, end=count, step=python_script)
byCoordinates = Point.ByCoordinates(x=slice, y=slice_2, z=slice_3)
slice_4 = List.Slice(list=flatten, start=code_block_3.out4, end=count, step=python_script)
slice_5 = List.Slice(list=flatten, start=code_block_3.out5, end=count, step=python_script)
slice_6 = List.Slice(list=flatten, start=code_block_3.out6, end=count, step=python_script)
byCoordinates_2 = Point.ByCoordinates(x=slice_4, y=slice_5, z=slice_6)

insert_layer_name = StringInput("@PH")  # graph input

# group: Creating Culvert 3D Alignment
code_block_4 = CodeBlock { "@PH"; }
list_create = List.Create(item0=byCoordinates, item1=byCoordinates_2)
python_script_2 = Python(IN[0]=list_create)
# ---------- python_script_2.python (6 lines) ----------
pontos_entrada = IN[0][0]
pontos_saida = IN[0][1]
final = []
for i in range(0,len(pontos_entrada)):
	final.append(list([pontos_entrada[i],pontos_saida[i]]))
OUT = final
# ----------------------------------------
current = Autodesk.AutoCAD.DynamoNodes.Document.Current()
modelSpace = Autodesk.AutoCAD.DynamoNodes.Document.ModelSpace(document=current)
byPoints = Autodesk.AutoCAD.DynamoNodes.Polyline3D.ByPoints(points=python_script_2, layer=insert_layer_name, block=modelSpace)

# group: Converting to Lines to Create Pipes
explode = Autodesk.AutoCAD.DynamoNodes.Object.Explode(object=byPoints)

boolean = BoolSelector(false)
code_block_5 = CodeBlock {  }
