# Dynamo graph Civil3D_CreatePipesBy3DLines.dyn "PIPES-CreatePipes" (Dynamo 2.5.2.7915)
# packages: Civil3DToolkit 1.1.27

current = Autodesk.AutoCAD.DynamoNodes.Document.Current()

# group: Create Pipe Network (If Not Exists)
insert_pipe_network_name = StringInput("@PH")  # graph input
byName = Autodesk.Civil.DynamoNodes.PipeNetworks.PipeNetwork.ByName(document=current, name=insert_pipe_network_name)

# group: Select Pipe Network Existing Library (Parts Lists)
pipe_network_parts_lists = PartsLists(document=current)
string_from_object = FromObject(obj=pipe_network_parts_lists)
string = StringInput("COBA - PH")
contains = String.Contains(str=string_from_object, searchFor=string)
filterByBoolMask = List.FilterByBoolMask(list=pipe_network_parts_lists, mask=contains)

# group: Select Culvert Type (Family Name and Part Size)
string_2 = StringInput("Tubagens")
partFamilyByName = Autodesk.Civil.DynamoNodes.PipeNetworks.Selection.PartFamilyByName(partsList=filterByBoolMask.in, name=string_2)
string_3 = StringInput("Manilha Betão: 300 R IV")
partSizeByName = Autodesk.Civil.DynamoNodes.PipeNetworks.Selection.PartSizeByName(partFamily=partFamilyByName, name=string_3)

# group: Select Existing Lines (Culvert Alignments)
objects_types = AcObjectTypes("Line")
modelSpace = Autodesk.AutoCAD.DynamoNodes.Document.ModelSpace(document=current)
all_objects_of_type = AcObjectsOfType(type=objects_types, block=modelSpace)
layer = Autodesk.AutoCAD.DynamoNodes.Object.Layer(object=all_objects_of_type)
groupByKey = List.GroupByKey(list=all_objects_of_type, keys=layer)
geometry = Autodesk.AutoCAD.DynamoNodes.Object.Geometry(object=groupByKey.groups)

# group: Create Pipes
boolean = BoolSelector(false)
addPipeByCurve = Autodesk.Civil.DynamoNodes.PipeNetworks.PipeNetwork.AddPipeByCurve(pipeNetwork=byName, partSize=partSizeByName, curve=geometry, applyRules=boolean)

# group: Import Data from Excel
file_path = Filename(".\PIPES.xlsx")  # graph input
code_block = CodeBlock(parsepath=file_path) { String.Replace(parsepath,"%20"," "); }
file_from_path = FileObject(path=code_block)
code_block_2 = CodeBlock { "DYNAMO"; false; 1; }
importExcel = Data.ImportExcel(file=file_from_path, sheetName=code_block_2.out0, readAsStrings=code_block_2.out1)
dropItems = List.DropItems(list=importExcel, amount=code_block_2.out2)
flatten = List.Flatten(list=dropItems)

python_script = Python(IN[0]=dropItems)
# ---------- python_script.python (5 lines) ----------
dados = IN[0][0]

cols = len(dados)

OUT = cols
# ----------------------------------------

# group: Rename Pipes
code_block_3 = CodeBlock(pipes=addPipeByCurve) { pipes[0]; }
python_script_2 = Python(IN[0]=flatten, IN[1]=python_script)
# ---------- python_script_2.python (6 lines) ----------
lista = IN[0]
step = IN[1]

new = lista[0:100000:step]

OUT = new
# ----------------------------------------
setName = Autodesk.Civil.DynamoNodes.CivilObject.SetName(civilObject=code_block_3, name=python_script_2)

# group: Set Pipe Size
python_script_3 = Python(IN[0]=flatten, IN[1]=python_script)
# ---------- python_script_3.python (8 lines) ----------
lista = IN[0]
step = IN[1]

new = lista[7:100000:step]

	

OUT = new
# ----------------------------------------
boolean_2 = BoolSelector(true)
setSizeByInnerDimension = Autodesk.Civil.DynamoNodes.PipeNetworks.Pipe.SetSizeByInnerDimension(pipe=setName, innerDimension=python_script_3, useClosestSize=boolean_2)

# group: Set Pipe Inverts
python_script_4 = Python(IN[0]=flatten, IN[1]=python_script)
# ---------- python_script_4.python (6 lines) ----------
lista = IN[0]
step = IN[1]

entradas = lista[3:100000:step]

OUT = entradas
# ----------------------------------------
python_script_5 = Python(IN[0]=flatten, IN[1]=python_script)
# ---------- python_script_5.python (6 lines) ----------
lista = IN[0]
step = IN[1]

saidas = lista[6:100000:step]

OUT = saidas
# ----------------------------------------
setInverts = Autodesk.Civil.DynamoNodes.PipeNetworks.Pipe.SetInverts(pipe=setSizeByInnerDimension, startInvert=python_script_4, endInvert=python_script_5)

boolean_3 = BoolSelector(false)

# group: Set Pipe Class
python_script_6 = Python(IN[0]=flatten, IN[1]=python_script)
# ---------- python_script_6.python (6 lines) ----------
lista = IN[0]
step = IN[1]

new = lista[8:100000:step]

OUT = new
# ----------------------------------------
setDescription = Autodesk.Civil.DynamoNodes.CivilObject.SetDescription(civilObject=code_block_3, description=python_script_6)
