# Dynamo graph Civil3D_DeleteAll3DLines.dyn "PIPES-DeleteAllAlignments" (Dynamo 2.5.2.7915)

objects_types = AcObjectTypes("Line")
current = Autodesk.AutoCAD.DynamoNodes.Document.Current()
modelSpace = Autodesk.AutoCAD.DynamoNodes.Document.ModelSpace(document=current)
all_objects_of_type = AcObjectsOfType(type=objects_types, block=modelSpace)
delete = Autodesk.AutoCAD.DynamoNodes.Object.Delete(object=all_objects_of_type)
