# Dynamo graph Civil3D_Dynamo_Google_Maps.dyn "Dynamo_Google_Maps" (Dynamo 2.5.2.7915)
# packages: Civil3DToolkit 1.1.27, GIS2BIM 0.10.0

current = Autodesk.AutoCAD.DynamoNodes.Document.Current()
string = StringInput("GSV")
blockByName = Autodesk.AutoCAD.DynamoNodes.Document.BlockByName(document=current, name=string)
objects = Autodesk.AutoCAD.DynamoNodes.Block.Objects(block=blockByName)
geometry = Autodesk.AutoCAD.DynamoNodes.Object.Geometry(object=objects)
blockReferences = Autodesk.AutoCAD.DynamoNodes.Block.BlockReferences(block=blockByName)
coordinateSystem = Autodesk.AutoCAD.DynamoNodes.BlockReference.CoordinateSystem(blockReference=blockReferences)
transform = Geometry.Transform(geometry=geometry, cs=coordinateSystem)
centerPoint = Circle.CenterPoint(circle=transform)
X = Point.X(point=centerPoint)
Y = Point.Y(point=centerPoint)
XYToLatLong = Autodesk.Civil.DynamoNodes.GIS.Map.XYToLatLong(document=current, x=X, y=Y)
watch = Watch(XYToLatLong.Longitude)
boolean = BoolSelector(true)
python_script = Python(IN[0]=XYToLatLong.Latitude, IN[1]=XYToLatLong.Longitude)
# ---------- python_script.python (10 lines) ----------
lat = round(float(IN[0][0]),4)
long = round(float(IN[1][0]),4)

coord = str(lat) + ',' + str(long)

#location_google = 'www.google.com/maps/@' + str(lat) + ',' + str(long) + ',20z'

location_google = 'http://maps.google.com/maps?q=&layer=c&cbll=' + coord

OUT = location_google
# ----------------------------------------
openBrowser = Custom[GIS2BIM.OpenBrowser](toggle=boolean, url=python_script)  # package GIS2BIM; Opens a new window in your default browser with the given url.
watch_2 = Watch(XYToLatLong.Latitude)
watch_3 = Watch()  # unwired: arg0
