# Dynamo graph Civil3D_CorridorPointsData.dyn (Dynamo 2.5.2.7915)
# packages: Civil3DToolkit 1.1.30

# group: STATIONS
alignments = AlignmentNamesDropDown()  # nothing selected; graph input
startStation = Autodesk.Civil.DynamoNodes.Alignment.StartStation(alignment=alignments)
endStation = Autodesk.Civil.DynamoNodes.Alignment.EndStation(alignment=alignments)
code_block = CodeBlock(s=startStation, e=endStation) { s; e; [s..e..25]; }
flatten = List.Flatten(list=code_block.out2)
count = List.Count(list=flatten)
STATIONS = List.Insert(list=flatten, element=endStation, index=count)

# group: OFFSETS AND ELEVATIONS
corridors = CorridorNameDropDown()  # nothing selected; graph input
baselines = Autodesk.Civil.DynamoNodes.Corridor.Baselines(corridor=corridors)
corridor_codes = CodeBlock { "Dir_P4_esq"; "Dir_P3_esq"; "Dir_P2_esq"; "Dir_P1_esq"; "Dir_P1_dir"; "Dir_P2_dir"; "Dir_P3_dir"; "Dir_P4_dir"; }
list_create = List.Create(item0=corridor_codes.out0, item1=corridor_codes.out1, item2=corridor_codes.out2, item3=corridor_codes.out3, item4=corridor_codes.out4, item5=corridor_codes.out5, item6=corridor_codes.out6, item7=corridor_codes.out7)
corridorFeatureLinesByCode = Autodesk.Civil.DynamoNodes.Baseline.CorridorFeatureLinesByCode(baseline=baselines, code=list_create, lacing=Longest)
flatten_2 = List.Flatten(list=corridorFeatureLinesByCode)
python_script = Python(IN[0]=flatten_2, IN[1]=STATIONS)
# ---------- python_script.python (75 lines) ----------
__author__ = 'Goncalo Bastos - bastos.g.goncalo@gmail.com'
__copyright__ = '2022'
__version__ = '1.0.0'

##############################################################

# Load the Python Standard and DesignScript Libraries
import sys
import clr

# Add Assemblies for AutoCAD and Civil3D
clr.AddReference('AcMgd')
clr.AddReference('AcCoreMgd')
clr.AddReference('AcDbMgd')
clr.AddReference('AecBaseMgd')
clr.AddReference('AecPropDataMgd')
clr.AddReference('AeccDbMgd')
clr.AddReference('ProtoGeometry')
clr.AddReference('AutoCADNodes')
clr.AddReference('Civil3DNodes')   
clr.AddReference('Autodesk.Civil3DToolkit')
clr.AddReference('DSCoreNodes')
clr.AddReference('DesignScriptBuiltin')

# Import references from AutoCAD
from Autodesk.AutoCAD.Runtime import *
from Autodesk.AutoCAD.ApplicationServices import *
from Autodesk.AutoCAD.EditorInput import *
from Autodesk.AutoCAD.DatabaseServices import *
from Autodesk.AutoCAD.Geometry import *

# Import references from Civil3D
from Autodesk.Civil.ApplicationServices import *
from Autodesk.Civil.DatabaseServices import *

# Import references from Dynamo
import Autodesk.AutoCAD.DynamoNodes as DA
import Autodesk.Civil.DynamoNodes as DC
import Autodesk.DesignScript.Geometry as DS
import DSCore
from Autodesk.AutoCAD.DynamoNodes import *
from Autodesk.Civil.DynamoNodes import *
#from Autodesk.DesignScript.Geometry import *
from DSCore import *
from DesignScript import *



##############################################################

features = IN[0]
stations = IN[1]
out = []


adoc = Application.DocumentManager.MdiActiveDocument
editor = adoc.Editor
db = adoc.Database

with adoc.LockDocument():
    with db:
        with db.TransactionManager.StartTransaction() as t:
			for s in stations:
				temp=[]
				#temp = []
				for f in features:
					off_ele_dic = DC.CorridorFeatureLine.OffsetElevationByStation(f,s)
					temp.append(off_ele_dic)
				#DSCore.List.Insert(temp,s,0)
				out.append(temp)
			
			t.Commit()
            #pass

OUT = out
# ----------------------------------------
code_block_2 = CodeBlock(data=python_script)
# ---------- code_block_2.designscript (16 lines) ----------
data;

[Imperative]
{
	out = [];
	for (station in data){
		offsets = [];
		elevations = [];
		for (dict in station){
			offsets = DSCore.List.AddItemToEnd(Dictionary.ValueAtKey(dict,"Offset"),offsets);
			elevations = DSCore.List.AddItemToEnd(Dictionary.ValueAtKey(dict,"Elevation"),elevations);
		};
		out = DSCore.List.AddItemToEnd([offsets,elevations],out);
	};
	return = out;
};
# ----------------------------------------

# group: DATA PREPARATION FOR EXCEL
code_block_3 = CodeBlock { "km"; "Offset"; "Cota"; }
list_create_2 = List.Create(item0=code_block_3.out0, item1=code_block_3.out1, item2=code_block_3.out2, item3=code_block_3.out1, item4=code_block_3.out2, item5=code_block_3.out1, item6=code_block_3.out2, item7=code_block_3.out1, item8=code_block_3.out2, item9=code_block_3.out1, item10=code_block_3.out2, item11=code_block_3.out1, item12=code_block_3.out2, item13=code_block_3.out1, item14=code_block_3.out2, item15=code_block_3.out1, item16=code_block_3.out2)
code_block_4 = CodeBlock(kms=STATIONS, data=code_block_2.out1, headers=list_create_2) { kms; data; headers; 0; }
python_script_2 = Python(IN[0]=code_block_4.kms, IN[1]=code_block_4.data)
# ---------- python_script_2.python (109 lines) ----------
__author__ = 'Goncalo Bastos - bastos.g.goncalo@gmail.com'
__copyright__ = '2022'
__version__ = '1.0.0'

##############################################################

# Load the Python Standard and DesignScript Libraries
import sys
import clr

# Add Assemblies for AutoCAD and Civil3D
clr.AddReference('AcMgd')
clr.AddReference('AcCoreMgd')
clr.AddReference('AcDbMgd')
clr.AddReference('AecBaseMgd')
clr.AddReference('AecPropDataMgd')
clr.AddReference('AeccDbMgd')
clr.AddReference('ProtoGeometry')
clr.AddReference('AutoCADNodes')
clr.AddReference('Civil3DNodes')   
clr.AddReference('Autodesk.Civil3DToolkit')
clr.AddReference('DSCoreNodes')

# Import references from AutoCAD
from Autodesk.AutoCAD.Runtime import *
from Autodesk.AutoCAD.ApplicationServices import *
from Autodesk.AutoCAD.EditorInput import *
from Autodesk.AutoCAD.DatabaseServices import *
from Autodesk.AutoCAD.Geometry import *

# Import references from Civil3D
from Autodesk.Civil.ApplicationServices import *
from Autodesk.Civil.DatabaseServices import *

# Import references from Dynamo
import Autodesk.AutoCAD.DynamoNodes as DA
import Autodesk.Civil.DynamoNodes as DC
import Autodesk.DesignScript.Geometry as DS
import DSCore
from Autodesk.AutoCAD.DynamoNodes import *
from Autodesk.Civil.DynamoNodes import *
#from Autodesk.DesignScript.Geometry import *
from DSCore import *


##############################################################

kms = IN[0]
data = IN[1]



adoc = Application.DocumentManager.MdiActiveDocument
editor = adoc.Editor
db = adoc.Database

with adoc.LockDocument():
	with db:
		with db.TransactionManager.StartTransaction() as t:
			out = []
			for i,km in enumerate(kms):
				temp = []
				o_1 = data[i][0][0]
				e_1 = data[i][1][0]
				
				o_2 = data[i][0][1]
				e_2 = data[i][1][1]
				
				o_3 = data[i][0][2]
				e_3 = data[i][1][2]
				
				o_4 = data[i][0][3]
				e_4 = data[i][1][3]
				
				o_5 = data[i][0][4]
				e_5 = data[i][1][4]
				
				o_6 = data[i][0][5]
				e_6 = data[i][1][5]	
				
				o_7 = data[i][0][6]
				e_7 = data[i][1][6]
				
				o_8 = data[i][0][7]
				e_8 = data[i][1][7]
				
				temp.append(km)
				temp.append(o_1)
				temp.append(e_1)
				temp.append(o_2)
				temp.append(e_2)
				temp.append(o_3)
				temp.append(e_3)
				temp.append(o_4)
				temp.append(e_4)
				temp.append(o_5)
				temp.append(e_5)
				temp.append(o_6)
				temp.append(e_6)
				temp.append(o_7)
				temp.append(e_7)
				temp.append(o_8)
				temp.append(e_8)				
				
				out.append(temp)
			t.Commit()
            #pass

OUT = out
# ----------------------------------------
insert = List.Insert(list=python_script_2, element=code_block_4.headers, index=code_block_4.out3)
code_block_5 = CodeBlock()
# ---------- code_block_5.designscript (18 lines) ----------
"";

"Berma Direita Esquerda";
"";
"Guia Direita Esquerda";
"";
"Guia Esquerda Esquerda";
"";
"Berma Esquerda Esquerda";
"";
"Berma Esquerda Direita";
"";
"Guia Esquerda Direita";
"";
"Guia Direita Direita";
"";
"Berma Direita Direita";
"";
# ----------------------------------------
list_create_3 = List.Create(item0=code_block_5.out0, item1=code_block_5.out1, item2=code_block_5.out2, item3=code_block_5.out3, item4=code_block_5.out4, item5=code_block_5.out5, item6=code_block_5.out6, item7=code_block_5.out7, item8=code_block_5.out8, item9=code_block_5.out9, item10=code_block_5.out10, item11=code_block_5.out11, item12=code_block_5.out12, item13=code_block_5.out13, item14=code_block_5.out14, item15=code_block_5.out15, item16=code_block_5.out16)
insert_2 = List.Insert(list=insert, element=list_create_3, index=code_block_4.out3)

# group: EXPORT EXCEL
directory_path = Directory("No file selected.")  # graph input
file_name = StringInput("")  # graph input
python_script_3 = Python(IN[0]=directory_path, IN[1]=file_name)
# ---------- python_script_3.python (3 lines) ----------
path = IN[0];
name = IN[1];
OUT = str(path) + '\\' + str(name) + ".xls";
# ----------------------------------------
code_block_6 = CodeBlock { "Sheet1"; 0; true; }
exportExcel = Data.ExportExcel(filePath=python_script_3, sheetName=code_block_6.out0, startRow=code_block_6.out1, startCol=code_block_6.out1, data=insert_2, overWrite=code_block_6.out2)
