# Dynamo graph Civil3D_ListagemCoordenadasMPZ.dyn "Select a Point" (Dynamo 2.5.2.7915)

# group: Pick Points in Modelspace
python_script = Python()
# ---------- python_script.python (57 lines) ----------
"""
Copyright 2019 Autodesk, Inc. All rights reserved.

This file is part of the Civil 3D Python Module.

"""
__author__ = 'Paolo Emilio Serra - paolo.serra@autodesk.com'
__copyright__ = '2019'
__version__ = '1.0.0'

import clr

# Add Assemblies for AutoCAD and Civil 3D APIs
clr.AddReference('acmgd')
clr.AddReference('acdbmgd')
clr.AddReference('accoremgd')
clr.AddReference('ProtoGeometry')

# Add standard Python references
import sys
sys.path.append('C:\Program Files (x86)\IronPython 2.7\Lib')
import os
import math

# Create an alias to the Autodesk.AutoCAD.ApplicationServices.Application class
import Autodesk.AutoCAD.ApplicationServices.Application as acapp

# Import references from AutoCAD
from Autodesk.AutoCAD.Runtime import *
from Autodesk.AutoCAD.ApplicationServices import *
from Autodesk.AutoCAD.EditorInput import *
from Autodesk.AutoCAD.DatabaseServices import *
from Autodesk.AutoCAD.Geometry import *

from Autodesk.DesignScript.Geometry import Point as DSPoint

adoc = acapp.DocumentManager.MdiActiveDocument
ed = adoc.Editor

# Example function
def click_point():
	"""
	Returns a Dynamo point of the user click
	"""
		
	global adoc
	global ed
	
	points = []
	while True:
		ppo = PromptPointOptions('\nSelect a point: ')
		res = ed.GetPoint(ppo)
		points.append(res.Value)
		if res.Status != PromptStatus.OK:
			return points	
	
OUT = click_point()
# ----------------------------------------
count = List.Count(list=python_script)
code_block = CodeBlock(a=count) { a-1; }
removeItemAtIndex = List.RemoveItemAtIndex(list=python_script, indices=code_block)
string_from_object = FromObject(obj=removeItemAtIndex)

# group: CONVERT STRINGS TO DYNAMO POINTS
code_block_2 = CodeBlock { ["Point","(",")","X","Y","Z","="," "]; ""; }
string_replace_multiple = CodeBlock(str=string_from_object, search=code_block_2.out0, replace=code_block_2.out1)
# ---------- string_replace_multiple.designscript (13 lines) ----------
str;
search;
replace;
n=List.Count(search);
c= [Imperative]{
	i=0;
	result=str;
	while(i<n){
		result=String.Replace(result,search[i],replace[i]);
		i=i+1;
	}
	return=result;
};
# ----------------------------------------
clean = List.Clean(list=string_replace_multiple.out4)
code_block_3 = CodeBlock { ","; 0; 1; 2; }
split = String.Split(str=clean, separator0=code_block_3.out0)
getItemAtIndex = List.GetItemAtIndex(list=split@L2, index=code_block_3.out1)
toNumber = String.ToNumber(str=getItemAtIndex)
getItemAtIndex_2 = List.GetItemAtIndex(list=split@L2, index=code_block_3.out2)
toNumber_2 = String.ToNumber(str=getItemAtIndex_2)
getItemAtIndex_3 = List.GetItemAtIndex(list=split@L2, index=code_block_3.out3)
toNumber_3 = String.ToNumber(str=getItemAtIndex_3)
byCoordinates = Point.ByCoordinates(x=toNumber, y=toNumber_2, z=toNumber_3)

list_create = List.Create(item0=toNumber, item1=toNumber_2, item2=toNumber_3)
transpose = List.Transpose(lists=list_create)

# group: EXPORT EXCEL
directory_path = Directory("No file selected.")  # graph input
file_name = StringInput("")  # graph input
python_script_2 = Python(IN[0]=directory_path, IN[1]=file_name)
# ---------- python_script_2.python (3 lines) ----------
path = IN[0];
name = IN[1];
OUT = str(path) + '\\' + str(name) + ".xls";
# ----------------------------------------
code_block_4 = CodeBlock { ["M","P","Z"]; "Taludes"; 0; true; }
insert = List.Insert(list=transpose, element=code_block_4.out0, index=code_block_4.out2)
exportExcel = Data.ExportExcel(filePath=python_script_2, sheetName=code_block_4.out1, startRow=code_block_4.out2, startCol=code_block_4.out2, data=insert, overWrite=code_block_4.out3)
