# Dynamo graph 04-Intersections_Part1.dyn (Dynamo 2.13.1.3887)
# packages: Civil3DToolkit 1.1.30

# group: INTERSECTION TYPE
code_block = CodeBlock { ["_ROW 15M","_ROW 18M","_ROW 25M"]; "Point"; }
current = Autodesk.AutoCAD.DynamoNodes.Document.Current()
modelSpace = Autodesk.AutoCAD.DynamoNodes.Document.ModelSpace(document=current)
all_objects_on_layer = AcObjectsOnLayer(layer=code_block.out0, block=modelSpace)
getGeometry = Autodesk.AutoCAD.DynamoNodes.PolylineExtensions.GetGeometry(polyline=all_objects_on_layer)
flatten = List.Flatten(list=getGeometry)
code_block_2 = CodeBlock(a=flatten) { [a]; }
intersection_points = Python(IN[0]=code_block_2, IN[1]=code_block_2)  # CPython3
# ---------- intersection_points.python (61 lines) ----------
# Load the Python Standard and DesignScript Libraries
import sys
import clr

# Add Assemblies for AutoCAD and Civil3D
clr.AddReference('AcMgd')
clr.AddReference('AcCoreMgd')
clr.AddReference('AcDbMgd')
clr.AddReference('AecBaseMgd')
clr.AddReference('AecPropDataMgd')
clr.AddReference('AeccDbMgd')
clr.AddReference('ProtoGeometry')
clr.AddReference('AutoCADNodes')
clr.AddReference('Civil3DNodes')   
clr.AddReference('Autodesk.Civil3DToolkit')
clr.AddReference('DSCoreNodes')


# Import references from AutoCAD
from Autodesk.AutoCAD.Runtime import *
from Autodesk.AutoCAD.ApplicationServices import *
from Autodesk.AutoCAD.EditorInput import *
from Autodesk.AutoCAD.DatabaseServices import *
from Autodesk.AutoCAD.Geometry import *

# Import references from Civil3D
from Autodesk.Civil.ApplicationServices import *
from Autodesk.Civil.DatabaseServices import *

import Autodesk.AutoCAD.DynamoNodes as DA
import Autodesk.Civil.DynamoNodes as DC
from Autodesk.AutoCAD.DynamoNodes import *
from Autodesk.Civil.DynamoNodes import *
#from Autodesk.DesignScript.Geometry import *
import Autodesk.DesignScript.Geometry as DS
import DSCore
from DSCore import *



polylines = IN[0]
others = IN[1]
output = []


for i,layer in enumerate(polylines):
    temp = []
    for j,poly in enumerate(layer):
        count=0
        for k,other in enumerate(others[i]):
            inter = DS.Geometry.Intersect(poly,other)
            temp.append(inter)
            count=count+1
    output.append(temp)

out_ = []
for o in output:
    a = [item for sublist in o for item in sublist]   
    out_.append(a)

OUT = out_
# ----------------------------------------
removeIfNot = List.RemoveIfNot(type=code_block.out1)  # unwired: list
map = List.Map(list=intersection_points, function=removeIfNot)
unique_points = Python(IN[0]=map)  # CPython3
# ---------- unique_points.python (48 lines) ----------
# Load the Python Standard and DesignScript Libraries
import sys
import clr

# Add Assemblies for AutoCAD and Civil3D
clr.AddReference('AcMgd')
clr.AddReference('AcCoreMgd')
clr.AddReference('AcDbMgd')
clr.AddReference('AecBaseMgd')
clr.AddReference('AecPropDataMgd')
clr.AddReference('AeccDbMgd')
clr.AddReference('ProtoGeometry')
clr.AddReference('AutoCADNodes')
clr.AddReference('Civil3DNodes')   
clr.AddReference('Autodesk.Civil3DToolkit')
clr.AddReference('DSCoreNodes')


# Import references from AutoCAD
from Autodesk.AutoCAD.Runtime import *
from Autodesk.AutoCAD.ApplicationServices import *
from Autodesk.AutoCAD.EditorInput import *
from Autodesk.AutoCAD.DatabaseServices import *
from Autodesk.AutoCAD.Geometry import *

# Import references from Civil3D
from Autodesk.Civil.ApplicationServices import *
from Autodesk.Civil.DatabaseServices import *

import Autodesk.AutoCAD.DynamoNodes as DA
import Autodesk.Civil.DynamoNodes as DC
from Autodesk.AutoCAD.DynamoNodes import *
from Autodesk.Civil.DynamoNodes import *
#from Autodesk.DesignScript.Geometry import *
import Autodesk.DesignScript.Geometry as DS
import DSCore
from DSCore import *


POINTS = IN[0]
out_ = []
for i in POINTS:
    p = DSCore.List.UniqueItems(i)
    out_.append(p)
    


OUT = out_
# ----------------------------------------
code_block_3 = CodeBlock { 10; }
byCenterPointRadius = Circle.ByCenterPointRadius(centerPoint=unique_points, radius=code_block_3)
flatten_2 = List.Flatten(list=byCenterPointRadius)
code_block_4 = CodeBlock { 16; }
regularPolygon = Polygon.RegularPolygon(circle=flatten_2, numberSides=code_block_4)
code_block_5 = CodeBlock(a=regularPolygon) { [a]; }
intersection_points_2 = Python(IN[0]=code_block_5, IN[1]=code_block_2)  # CPython3
# ---------- intersection_points_2.python (52 lines) ----------
# Load the Python Standard and DesignScript Libraries
import sys
import clr

# Add Assemblies for AutoCAD and Civil3D
clr.AddReference('AcMgd')
clr.AddReference('AcCoreMgd')
clr.AddReference('AcDbMgd')
clr.AddReference('AecBaseMgd')
clr.AddReference('AecPropDataMgd')
clr.AddReference('AeccDbMgd')
clr.AddReference('ProtoGeometry')
clr.AddReference('AutoCADNodes')
clr.AddReference('Civil3DNodes')   
clr.AddReference('Autodesk.Civil3DToolkit')
clr.AddReference('DSCoreNodes')


# Import references from AutoCAD
from Autodesk.AutoCAD.Runtime import *
from Autodesk.AutoCAD.ApplicationServices import *
from Autodesk.AutoCAD.EditorInput import *
from Autodesk.AutoCAD.DatabaseServices import *
from Autodesk.AutoCAD.Geometry import *

# Import references from Civil3D
from Autodesk.Civil.ApplicationServices import *
from Autodesk.Civil.DatabaseServices import *

import Autodesk.AutoCAD.DynamoNodes as DA
import Autodesk.Civil.DynamoNodes as DC
from Autodesk.AutoCAD.DynamoNodes import *
from Autodesk.Civil.DynamoNodes import *
#from Autodesk.DesignScript.Geometry import *
import Autodesk.DesignScript.Geometry as DS
import DSCore
from DSCore import *


circles = IN[0][0]
others = IN[1][0]
output = []
out_ = []

for i in circles:
    temp=[]
    for j in others:
        inter = DS.Geometry.Intersect(i,j)
        temp.append(inter)          
    output.append(temp)

OUT = output
# ----------------------------------------
intersection_points_flatten = Python(IN[0]=intersection_points_2)  # CPython3
# ---------- intersection_points_flatten.python (46 lines) ----------
# Load the Python Standard and DesignScript Libraries
import sys
import clr

# Add Assemblies for AutoCAD and Civil3D
clr.AddReference('AcMgd')
clr.AddReference('AcCoreMgd')
clr.AddReference('AcDbMgd')
clr.AddReference('AecBaseMgd')
clr.AddReference('AecPropDataMgd')
clr.AddReference('AeccDbMgd')
clr.AddReference('ProtoGeometry')
clr.AddReference('AutoCADNodes')
clr.AddReference('Civil3DNodes')   
clr.AddReference('Autodesk.Civil3DToolkit')
clr.AddReference('DSCoreNodes')


# Import references from AutoCAD
from Autodesk.AutoCAD.Runtime import *
from Autodesk.AutoCAD.ApplicationServices import *
from Autodesk.AutoCAD.EditorInput import *
from Autodesk.AutoCAD.DatabaseServices import *
from Autodesk.AutoCAD.Geometry import *

# Import references from Civil3D
from Autodesk.Civil.ApplicationServices import *
from Autodesk.Civil.DatabaseServices import *

import Autodesk.AutoCAD.DynamoNodes as DA
import Autodesk.Civil.DynamoNodes as DC
from Autodesk.AutoCAD.DynamoNodes import *
from Autodesk.Civil.DynamoNodes import *
#from Autodesk.DesignScript.Geometry import *
import Autodesk.DesignScript.Geometry as DS
import DSCore
from DSCore import *

lists = IN[0]
out = []

for i in lists:
    f = DSCore.List.Flatten(i)
    out.append(f)

OUT = out
# ----------------------------------------

# group: GET LAYER NAMES
file_path = Filename(".\DADOS.xlsx")
file_from_path = FileObject(path=file_path)
sheet_name = StringInput("_ROW 15M")
code_block_6 = CodeBlock { false; 0; }
importExcel = Data.ImportExcel(file=file_from_path, sheetName=sheet_name, readAsStrings=code_block_6.out0, showExcel=code_block_6.out0)
removeItemAtIndex = List.RemoveItemAtIndex(list=importExcel, indices=code_block_6.out1)
transpose = List.Transpose(lists=removeItemAtIndex)
code_block_7 = CodeBlock(a=transpose) { a[3]; "Point"; }
uniqueItems = List.UniqueItems(list=code_block_7.out0)

# group: GET INTERSECTION POINTS
current_2 = Autodesk.AutoCAD.DynamoNodes.Document.Current()
modelSpace_2 = Autodesk.AutoCAD.DynamoNodes.Document.ModelSpace(document=current_2)
all_objects_on_layer_2 = AcObjectsOnLayer(layer=uniqueItems, block=modelSpace_2)
getGeometry_2 = Autodesk.AutoCAD.DynamoNodes.PolylineExtensions.GetGeometry(polyline=all_objects_on_layer_2)
intersection_points_3 = Python(IN[0]=getGeometry_2, IN[1]=getGeometry_2)  # CPython3; same code as intersection_points
removeIfNot_2 = List.RemoveIfNot(type=code_block_7.out1)  # unwired: list
map_2 = List.Map(list=intersection_points_3, function=removeIfNot_2)
unique_points_2 = Python(IN[0]=map_2)  # CPython3; same code as unique_points

# group: EXPORT DATA TO EXCEL
file_path_2 = Filename(".\INTERSECTIONS.xlsx")
code_block_8 = CodeBlock { "PointsID"; "Utilities_Intersections"; 0; true; }
code_block_9 = CodeBlock(a=unique_points) { a[0]; 0; ["PointID","Intersect. Type","Coordinates"]; }
points_id = Python(IN[0]=intersection_points_flatten, IN[1]=code_block_9.out0)  # CPython3
# ---------- points_id.python (18 lines) ----------
intersections = IN[0]
points = IN[1]

code_ = []
type_=[]
coord_ = []

for i in intersections:
    length = len(i)
    type_.append(length)

for i,p in enumerate(points):
    code = "P"+str(i)
    code_.append(code)
    coord_.append(p)

OUT = code_,type_,coord_
    
# ----------------------------------------
transpose_2 = List.Transpose(lists=points_id)
insert = List.Insert(list=transpose_2, element=code_block_9.out2, index=code_block_9.out1)
exportToExcel = Data.ExportToExcel(filePath=file_path_2, sheetName=code_block_8.out0, startRow=code_block_8.out2, startColumn=code_block_8.out2, data=insert, overWrite=code_block_8.out3)
transpose_3 = List.Transpose(lists=unique_points_2)
insert_2 = List.Insert(list=transpose_3, element=uniqueItems, index=code_block_9.out1)
exportToExcel_2 = Data.ExportToExcel(filePath=file_path_2, sheetName=code_block_8.out1, startRow=code_block_8.out2, startColumn=code_block_8.out2, data=insert_2, overWrite=code_block_8.out3)
