# Dynamo graph 05-Intersections_Part2.dyn (Dynamo 2.13.1.3887)
# packages: Civil3DToolkit 1.1.30

# group: GET UTILITIES INTERSECTION POINTS
file_path = Filename(".\INTERSECTIONS.xlsx")
file_from_path = FileObject(path=file_path)
sheet_name = StringInput("Utilities_Intersections")
code_block = CodeBlock { false; 0; }
importExcel = Data.ImportExcel(file=file_from_path, sheetName=sheet_name, readAsStrings=code_block.out0, showExcel=code_block.out0)
removeItemAtIndex = List.RemoveItemAtIndex(list=importExcel, indices=code_block.out1)
transpose = List.Transpose(lists=removeItemAtIndex)

# group: DEFINE UTILITY (LAYER)
LAYERS = CodeBlock(a=importExcel) { a[0]; }
utility_layer = StringInput("_U-HC")  # graph input
indexOf = List.IndexOf(list=LAYERS, element=utility_layer)
code_block_2 = CodeBlock(a=transpose, b=indexOf) { a[b]; }

# group: GET POINTS ID
file_path_2 = Filename(".\INTERSECTIONS.xlsx")
file_from_path_2 = FileObject(path=file_path_2)
sheet_name_2 = StringInput("PointsID")
code_block_3 = CodeBlock { false; 0; }
importExcel_2 = Data.ImportExcel(file=file_from_path_2, sheetName=sheet_name_2, readAsStrings=code_block_3.out0, showExcel=code_block_3.out0)
removeItemAtIndex_2 = List.RemoveItemAtIndex(list=importExcel_2, indices=code_block_3.out1)
transpose_2 = List.Transpose(lists=removeItemAtIndex_2)

code_block_4 = CodeBlock(a=transpose_2) { a[1]; a[2]; }

# group: CONVERT STRINGS FROM EXCEL TO DYNAMO POINTS
code_block_5 = CodeBlock { ["Point","(",")","X","Y","Z","="," "]; ""; }
string_replace_multiple = CodeBlock(str=code_block_2, search=code_block_5.out0, replace=code_block_5.out1)
# ---------- string_replace_multiple.designscript (13 lines) ----------
str;
search;
replace;
n=List.Count(search);
c= [Imperative]{
	i=0;
	result=str;
	while(i<n){
		result=String.Replace(result,search[i],replace[i]);
		i=i+1;
	}
	return=result;
};
# ----------------------------------------
clean = List.Clean(list=string_replace_multiple.out4)
code_block_6 = CodeBlock { ","; 0; 1; 2; }
split = String.Split(string=clean, separator0=code_block_6.out0)
getItemAtIndex = List.GetItemAtIndex(list=split@L2, index=code_block_6.out1)
toNumber = String.ToNumber(string=getItemAtIndex)
getItemAtIndex_2 = List.GetItemAtIndex(list=split@L2, index=code_block_6.out2)
toNumber_2 = String.ToNumber(string=getItemAtIndex_2)
getItemAtIndex_3 = List.GetItemAtIndex(list=split@L2, index=code_block_6.out3)
toNumber_3 = String.ToNumber(string=getItemAtIndex_3)
byCoordinates = Point.ByCoordinates(x=toNumber, y=toNumber_2, z=toNumber_3)
string_replace_multiple_2 = CodeBlock(str=code_block_4.out1, search=code_block_5.out0, replace=code_block_5.out1)  # same code as string_replace_multiple
clean_2 = List.Clean(list=string_replace_multiple_2.out4)
split_2 = String.Split(string=clean_2, separator0=code_block_6.out0)
getItemAtIndex_4 = List.GetItemAtIndex(list=split_2@L2, index=code_block_6.out1)
toNumber_4 = String.ToNumber(string=getItemAtIndex_4)
getItemAtIndex_5 = List.GetItemAtIndex(list=split_2@L2, index=code_block_6.out2)
toNumber_5 = String.ToNumber(string=getItemAtIndex_5)
getItemAtIndex_6 = List.GetItemAtIndex(list=split_2@L2, index=code_block_6.out3)
toNumber_6 = String.ToNumber(string=getItemAtIndex_6)
byCoordinates_2 = Point.ByCoordinates(x=toNumber_4, y=toNumber_5, z=toNumber_6)

code_block_7 = CodeBlock(a=code_block_4.out0) { a; }

# group: CALCULATE DISTANCES
distance_to_points = Python(IN[0]=byCoordinates, IN[1]=byCoordinates_2)  # CPython3
# ---------- distance_to_points.python (56 lines) ----------
# Load the Python Standard and DesignScript Libraries
import sys
import clr

# Add Assemblies for AutoCAD and Civil3D
clr.AddReference('AcMgd')
clr.AddReference('AcCoreMgd')
clr.AddReference('AcDbMgd')
clr.AddReference('AecBaseMgd')
clr.AddReference('AecPropDataMgd')
clr.AddReference('AeccDbMgd')
clr.AddReference('ProtoGeometry')
clr.AddReference('AutoCADNodes')
clr.AddReference('Civil3DNodes')   
clr.AddReference('Autodesk.Civil3DToolkit')
clr.AddReference('DSCoreNodes')


# Import references from AutoCAD
from Autodesk.AutoCAD.Runtime import *
from Autodesk.AutoCAD.ApplicationServices import *
from Autodesk.AutoCAD.EditorInput import *
from Autodesk.AutoCAD.DatabaseServices import *
from Autodesk.AutoCAD.Geometry import *

# Import references from Civil3D
from Autodesk.Civil.ApplicationServices import *
from Autodesk.Civil.DatabaseServices import *

import Autodesk.AutoCAD.DynamoNodes as DA
import Autodesk.Civil.DynamoNodes as DC
from Autodesk.AutoCAD.DynamoNodes import *
from Autodesk.Civil.DynamoNodes import *
#from Autodesk.DesignScript.Geometry import *
import Autodesk.DesignScript.Geometry as DS
import DSCore
from DSCore import *

util_points = IN[0]
id_points = IN[1]

out=[]


for i in util_points:
    temp = []
    for j in id_points:        
        temp.append(DS.Geometry.DistanceTo(j,i))
    min_distance = min(temp)
    min_point_id = temp.index(min_distance)
    #a = [min_point_id]
    out.append(min_point_id)



OUT = out
# ----------------------------------------
get_id_coordinates = Python(IN[0]=byCoordinates_2, IN[1]=distance_to_points, IN[2]=code_block_7)  # CPython3
# ---------- get_id_coordinates.python (53 lines) ----------
# Load the Python Standard and DesignScript Libraries
import sys
import clr

# Add Assemblies for AutoCAD and Civil3D
clr.AddReference('AcMgd')
clr.AddReference('AcCoreMgd')
clr.AddReference('AcDbMgd')
clr.AddReference('AecBaseMgd')
clr.AddReference('AecPropDataMgd')
clr.AddReference('AeccDbMgd')
clr.AddReference('ProtoGeometry')
clr.AddReference('AutoCADNodes')
clr.AddReference('Civil3DNodes')   
clr.AddReference('Autodesk.Civil3DToolkit')
clr.AddReference('DSCoreNodes')


# Import references from AutoCAD
from Autodesk.AutoCAD.Runtime import *
from Autodesk.AutoCAD.ApplicationServices import *
from Autodesk.AutoCAD.EditorInput import *
from Autodesk.AutoCAD.DatabaseServices import *
from Autodesk.AutoCAD.Geometry import *

# Import references from Civil3D
from Autodesk.Civil.ApplicationServices import *
from Autodesk.Civil.DatabaseServices import *

import Autodesk.AutoCAD.DynamoNodes as DA
import Autodesk.Civil.DynamoNodes as DC
from Autodesk.AutoCAD.DynamoNodes import *
from Autodesk.Civil.DynamoNodes import *
#from Autodesk.DesignScript.Geometry import *
import Autodesk.DesignScript.Geometry as DS
import DSCore
from DSCore import *

coordinates = IN[0]
distances_index = IN[1]
types = IN[2]
coord=[]
types_=[]

for i in distances_index:
    c = DSCore.List.GetItemAtIndex(coordinates,i)
    t = DSCore.List.GetItemAtIndex(types,i)
    coord.append(c)
    types_.append(t)
    


OUT = coord,types_
# ----------------------------------------

# group: QUADRANTS
code_block_8 = CodeBlock(a=get_id_coordinates) { a[0]; a[1]; }
list_create = List.Create(item0=byCoordinates, item1=code_block_8.out0, item2=code_block_8.out1)
code_block_9 = CodeBlock(a=list_create) { a[0]; a[1]; a[2]; }
X = Point.X(point=code_block_9.out0)
X_2 = Point.X(point=code_block_9.out1)
Y = Point.Y(point=code_block_9.out0)
Y_2 = Point.Y(point=code_block_9.out1)
QUADRANTS = Python(IN[0]=X, IN[1]=X_2, IN[2]=Y, IN[3]=Y_2)  # CPython3
# ---------- QUADRANTS.python (31 lines) ----------
util_x = IN[0]
ID_x = IN[1]
util_y = IN[2]
ID_y = IN[3]

diff_x = []
diff_y = []

zip_object_x = zip(util_x, ID_x)
zip_object_y = zip(util_y, ID_y)

for i,j in zip_object_x:
    diff_x.append(i-j)

for i,j in zip_object_y:
    diff_y.append(i-j)
    
quadrantes=[]

for i in list(range(len(util_x))):
    if (diff_x[i]>0 and diff_y[i]>0):
        q = 1
    elif (diff_x[i]<0 and diff_y[i]>0):
        q = 2
    elif (diff_x[i]<0 and diff_y[i]<0):
        q = 3
    else:
        q = 4
    quadrantes.append(q)
        
OUT = quadrantes
# ----------------------------------------

chamfer_distance = DoubleInput(25)  # graph input

# group: QUADRANT1 - TYPE 2
code_block_10 = CodeBlock(d=chamfer_distance) { d; -d; }
byCoordinates_3 = Vector.ByCoordinates(x=code_block_10.d)
byCoordinates_4 = Vector.ByCoordinates(x=code_block_10.out1, y=code_block_10.d)

v1_2 = List.Create(item0=byCoordinates_3, item1=byCoordinates_4)

# group: QUADRANT2 - TYPE 2
code_block_11 = CodeBlock(d=chamfer_distance) { d; -d; }
byCoordinates_5 = Vector.ByCoordinates(y=code_block_11.d)
byCoordinates_6 = Vector.ByCoordinates(x=code_block_11.out1, y=code_block_11.out1)

v2_2 = List.Create(item0=byCoordinates_5, item1=byCoordinates_6)

# group: QUADRANT3 - TYPE 2
code_block_12 = CodeBlock(d=chamfer_distance) { d; -d; }
byCoordinates_7 = Vector.ByCoordinates(x=code_block_12.out1)
byCoordinates_8 = Vector.ByCoordinates(x=code_block_12.d, y=code_block_12.out1)

v3_2 = List.Create(item0=byCoordinates_7, item1=byCoordinates_8)

# group: QUADRANT4 - TYPE 2
code_block_13 = CodeBlock(d=chamfer_distance) { d; -d; }
byCoordinates_9 = Vector.ByCoordinates(y=code_block_13.out1)
byCoordinates_10 = Vector.ByCoordinates(x=code_block_13.d, y=code_block_13.d)

v4_2 = List.Create(item0=byCoordinates_9, item1=byCoordinates_10)

# group: QUADRANT1 - TYPE 3
code_block_14 = CodeBlock(d=chamfer_distance) { d; -d; }
byCoordinates_11 = Vector.ByCoordinates(x=code_block_14.d)
byCoordinates_12 = Vector.ByCoordinates(x=code_block_14.out1, y=code_block_14.d)

v1_3 = List.Create(item0=byCoordinates_11, item1=byCoordinates_12)

# group: QUADRANT2 - TYPE 3
code_block_15 = CodeBlock(d=chamfer_distance) { d; -d; }
byCoordinates_13 = Vector.ByCoordinates(y=code_block_15.d)
byCoordinates_14 = Vector.ByCoordinates(x=code_block_15.out1, y=code_block_15.out1)

v2_3 = List.Create(item0=byCoordinates_13, item1=byCoordinates_14)

# group: QUADRANT3 - TYPE 3
code_block_16 = CodeBlock(d=chamfer_distance) { d; -d; }
byCoordinates_15 = Vector.ByCoordinates(x=code_block_16.out1)
byCoordinates_16 = Vector.ByCoordinates(x=code_block_16.d, y=code_block_16.out1)

v3_3 = List.Create(item0=byCoordinates_15, item1=byCoordinates_16)

# group: QUADRANT4 - TYPE 3
code_block_17 = CodeBlock(d=chamfer_distance) { d; -d; }
byCoordinates_17 = Vector.ByCoordinates(y=code_block_17.out1)
byCoordinates_18 = Vector.ByCoordinates(x=code_block_17.d, y=code_block_17.d)

v4_3 = List.Create(item0=byCoordinates_17, item1=byCoordinates_18)

# group: QUADRANT1 - TYPE 4
code_block_18 = CodeBlock(d=chamfer_distance) { d; -d; }
byCoordinates_19 = Vector.ByCoordinates(x=code_block_18.d)
byCoordinates_20 = Vector.ByCoordinates(x=code_block_18.out1, y=code_block_18.d)

v1_4 = List.Create(item0=byCoordinates_19, item1=byCoordinates_20)

# group: QUADRANT2 - TYPE 4
code_block_19 = CodeBlock(d=chamfer_distance) { d; -d; }
byCoordinates_21 = Vector.ByCoordinates(y=code_block_19.d)
byCoordinates_22 = Vector.ByCoordinates(x=code_block_19.out1, y=code_block_19.out1)

v2_4 = List.Create(item0=byCoordinates_21, item1=byCoordinates_22)

# group: QUADRANT3 - TYPE 4
code_block_20 = CodeBlock(d=chamfer_distance) { d; -d; }
byCoordinates_23 = Vector.ByCoordinates(x=code_block_20.out1)
byCoordinates_24 = Vector.ByCoordinates(x=code_block_20.d, y=code_block_20.out1)

v3_4 = List.Create(item0=byCoordinates_23, item1=byCoordinates_24)

# group: QUADRANT4 - TYPE 4
code_block_21 = CodeBlock(d=chamfer_distance) { d; -d; }
byCoordinates_25 = Vector.ByCoordinates(y=code_block_21.out1)
byCoordinates_26 = Vector.ByCoordinates(x=code_block_21.d, y=code_block_21.d)

v4_4 = List.Create(item0=byCoordinates_25, item1=byCoordinates_26)

# group: CREATE CHAMFERS
code_block_22 = CodeBlock(points=byCoordinates, quadrants=QUADRANTS, types=code_block_9.out2, v1_2=v1_2, v2_2=v2_2, v3_2=v3_2, v4_2=v4_2, v1_3=v1_3, v2_3=v2_3, v3_3=v3_3, v4_3=v4_3, v1_4=v1_4, v2_4=v2_4, v3_4=v3_4, v4_4=v4_4) { points; quadrants; types; v1_2; v2_2; v3_2; v4_2; v1_3; v2_3; v3_3; v4_3; v1_4; v2_4; v3_4; v4_4; }
python_script = Python(IN[0]=code_block_22.points, IN[1]=code_block_22.quadrants, IN[2]=code_block_22.types, IN[3]=code_block_22.v1_2, IN[4]=code_block_22.v2_2, IN[5]=code_block_22.v3_2, IN[6]=code_block_22.v4_2, IN[7]=code_block_22.v1_3, IN[8]=code_block_22.v2_3, IN[9]=code_block_22.v3_3, IN[10]=code_block_22.v4_3, IN[11]=code_block_22.v1_4, IN[12]=code_block_22.v2_4, IN[13]=code_block_22.v3_4, IN[14]=code_block_22.v4_4)  # CPython3
# ---------- python_script.python (183 lines) ----------
# Load the Python Standard and DesignScript Libraries
import sys
import clr

# Add Assemblies for AutoCAD and Civil3D
clr.AddReference('AcMgd')
clr.AddReference('AcCoreMgd')
clr.AddReference('AcDbMgd')
clr.AddReference('AecBaseMgd')
clr.AddReference('AecPropDataMgd')
clr.AddReference('AeccDbMgd')
clr.AddReference('ProtoGeometry')
clr.AddReference('AutoCADNodes')
clr.AddReference('Civil3DNodes')   
clr.AddReference('Autodesk.Civil3DToolkit')


# Import references from AutoCAD
from Autodesk.AutoCAD.Runtime import *
from Autodesk.AutoCAD.ApplicationServices import *
from Autodesk.AutoCAD.EditorInput import *
from Autodesk.AutoCAD.DatabaseServices import *
from Autodesk.AutoCAD.Geometry import *

# Import references from Civil3D
from Autodesk.Civil.ApplicationServices import *
from Autodesk.Civil.DatabaseServices import *

import Autodesk.AutoCAD.DynamoNodes as DA
import Autodesk.Civil.DynamoNodes as DC
from Autodesk.AutoCAD.DynamoNodes import *
from Autodesk.Civil.DynamoNodes import *
#from Autodesk.DesignScript.Geometry import *
import Autodesk.DesignScript.Geometry as DS



points = IN[0]
quadrants = IN[1]
types = IN[2]

v1_2 = IN[3]
v2_2 = IN[4]
v3_2 = IN[5]
v4_2 = IN[6]

v1_3 = IN[7]
v2_3 = IN[8]
v3_3 = IN[9]
v4_3 = IN[10]

v1_4 = IN[11]
v2_4 = IN[12]
v3_4 = IN[13]
v4_4 = IN[14]




output = []



for i,p in enumerate(points):
    points_ = []
    lines_ = []   
    # Quadrante 1; Type 2
    if (quadrants[i]==1 and types[i]==2):
        p1 = DS.Point.Add(p,v1_2[0])
        points_.append(p1)
        p2 = DS.Point.Add(p1,v1_2[1])
        points_.append(p2)
        lines_.append(DS.PolyCurve.ByPoints(points_,False))
        
    # Quadrante 2; Type 2
    elif (quadrants[i]==2 and types[i]==2):
        p1 = DS.Point.Add(p,v2_2[0])
        points_.append(p1)
        p2 = DS.Point.Add(p1,v2_2[1])
        points_.append(p2)
        lines_.append(DS.PolyCurve.ByPoints(points_,False))
        
    # Quadrante 3; Type 2
    elif (quadrants[i]==3 and types[i]==2):
        p1 = DS.Point.Add(p,v3_2[0])
        points_.append(p1)
        p2 = DS.Point.Add(p1,v3_2[1])
        points_.append(p2)
        lines_.append(DS.PolyCurve.ByPoints(points_,False))


    # Quadrante 4; Type 2
    elif (quadrants[i]==4 and types[i]==2):
        p1 = DS.Point.Add(p,v4_2[0])
        points_.append(p1)
        p2 = DS.Point.Add(p1,v4_2[1])
        points_.append(p2)
        lines_.append(DS.PolyCurve.ByPoints(points_,False))


    # Quadrante 1; Type 3
    elif (quadrants[i]==1 and types[i]==3):
        p1 = DS.Point.Add(p,v1_3[0])
        points_.append(p1)
        p2 = DS.Point.Add(p1,v1_3[1])
        points_.append(p2)
        lines_.append(DS.PolyCurve.ByPoints(points_,False))


    # Quadrante 2; Type 3
    elif (quadrants[i]==2 and types[i]==3):
        p1 = DS.Point.Add(p,v2_3[0])
        points_.append(p1)
        p2 = DS.Point.Add(p1,v2_3[1])
        points_.append(p2)
        lines_.append(DS.PolyCurve.ByPoints(points_,False))


    # Quadrante 3; Type 3
    elif (quadrants[i]==3 and types[i]==3):
        p1 = DS.Point.Add(p,v3_3[0])
        points_.append(p1)
        p2 = DS.Point.Add(p1,v3_3[1])
        points_.append(p2)
        lines_.append(DS.PolyCurve.ByPoints(points_,False))



    # Quadrante 4; Type 3
    elif (quadrants[i]==4 and types[i]==3):
        p1 = DS.Point.Add(p,v4_3[0])
        points_.append(p1)
        p2 = DS.Point.Add(p1,v4_3[1])
        points_.append(p2)
        lines_.append(DS.PolyCurve.ByPoints(points_,False))
 


    # Quadrante 1; Type 4
    elif (quadrants[i]==1 and types[i]==4):
        p1 = DS.Point.Add(p,v1_4[0])
        points_.append(p1)
        p2 = DS.Point.Add(p1,v1_4[1])
        points_.append(p2)
        lines_.append(DS.PolyCurve.ByPoints(points_,False))



    # Quadrante 2; Type 4
    elif (quadrants[i]==2 and types[i]==4):
        p1 = DS.Point.Add(p,v2_4[0])
        points_.append(p1)
        p2 = DS.Point.Add(p1,v2_4[1])
        points_.append(p2)
        lines_.append(DS.PolyCurve.ByPoints(points_,False))



    # Quadrante 3; Type 4
    elif (quadrants[i]==3 and types[i]==4):
        p1 = DS.Point.Add(p,v3_4[0])
        points_.append(p1)
        p2 = DS.Point.Add(p1,v3_4[1])
        points_.append(p2) 
        lines_.append(DS.PolyCurve.ByPoints(points_,False))


    # Quadrante 4; Type 4
    elif (quadrants[i]==4 and types[i]==4):
        p1 = DS.Point.Add(p,v4_4[0])
        points_.append(p1)
        p2 = DS.Point.Add(p1,v4_4[1])
        points_.append(p2)
        lines_.append(DS.PolyCurve.ByPoints(points_,False))


    else:
        lines_.append("ERROR")
        
    output.append(lines_)


OUT = output
# ----------------------------------------
current = Autodesk.AutoCAD.DynamoNodes.Document.Current()
modelSpace = Autodesk.AutoCAD.DynamoNodes.Document.ModelSpace(document=current)
objectByTessellatedGeometry = Autodesk.AutoCAD.DynamoNodes.PolylineExtensions.ObjectByTessellatedGeometry(curve=python_script, layer=utility_layer, block=modelSpace)

flatten = List.Flatten(list=objectByTessellatedGeometry)

# group: SET CHAMFER GLOBAL WIDTH (POLYLINE)
file_path_3 = Filename(".\DADOS.xlsx")
file_from_path_3 = FileObject(path=file_path_3)
code_block_23 = CodeBlock { "SPACES"; false; 0; }
importExcel_3 = Data.ImportExcel(file=file_from_path_3, sheetName=code_block_23.out0, readAsStrings=code_block_23.out1, showExcel=code_block_23.out1)
removeItemAtIndex_3 = List.RemoveItemAtIndex(list=importExcel_3, indices=code_block_23.out2)
transpose_3 = List.Transpose(lists=removeItemAtIndex_3)
code_block_24 = CodeBlock(a=transpose_3) { a[0]; a[1]; }
byKeysValues = DesignScript.Builtin.Dictionary.ByKeysValues(keys=code_block_24.out0, values=code_block_24.out1)
SPACE = DesignScript.Builtin.Dictionary.ValueAtKey(dictionary=byKeysValues, key=utility_layer)
python_script_2 = Python(IN[0]=flatten, IN[1]=SPACE)  # CPython3
# ---------- python_script_2.python (44 lines) ----------
# Load the Python Standard and DesignScript Libraries
import sys
import clr

# Add Assemblies for AutoCAD and Civil3D
clr.AddReference('AcMgd')
clr.AddReference('AcCoreMgd')
clr.AddReference('AcDbMgd')
clr.AddReference('AecBaseMgd')
clr.AddReference('AecPropDataMgd')
clr.AddReference('AeccDbMgd')
clr.AddReference('ProtoGeometry')
clr.AddReference('AutoCADNodes')
clr.AddReference('Civil3DNodes')   
clr.AddReference('Autodesk.Civil3DToolkit')

# Import references from AutoCAD
from Autodesk.AutoCAD.Runtime import *
from Autodesk.AutoCAD.ApplicationServices import *
from Autodesk.AutoCAD.EditorInput import *
from Autodesk.AutoCAD.DatabaseServices import *
from Autodesk.AutoCAD.Geometry import *

# Import references from Civil3D
from Autodesk.Civil.ApplicationServices import *
from Autodesk.Civil.DatabaseServices import *


import Autodesk.AutoCAD.DynamoNodes as DA
import Autodesk.Civil.DynamoNodes as DC
from Autodesk.AutoCAD.DynamoNodes import *
from Autodesk.Civil.DynamoNodes import *


polylines = IN[0]
space = IN[1]
out_ = []

for poly in polylines:
    p = DA.ObjectExtensions.SetParameterValueByName(poly,"ConstantWidth",space)
    out_.append(p)

# Assign your output to the OUT variable.
OUT = out_
# ----------------------------------------
