# Dynamo graph TD_4D_Codes.dyn (Dynamo 2.19.3.6394)
# author: Goncalo Bastos
# Preenche o parâmetro 4D-Code de todos os elementos selecionados pelo utlizador

# group: Description
# note: Nome da rotina: TD-4D-Codes.dyn
# Versão: 1.0
# Data: 04/09/2024
# Elaborou: GGB
# Descrição:
# Preenche o parâmetro 4D-Code de todos os elementos selecionados pelo utlizador
# Packages usados:
# •   Esta rotina não usa packages externos.

# group: Input
# Selecionar os elementos no modelo para colocar o código 4D
select_model_elements = DSModelElementsSelection()  # 3 picked in the model; graph input

# group: Obter os valores dos parâmetros e constuir o parâmetro 4D_Code
setParameterByName = Element.SetParameterByName()  # unwired: element, parameterName, value
code_block = CodeBlock { "4D_Code"; }
code_block_2 = CodeBlock { ""; }
code_block_3 = CodeBlock()
# ---------- code_block_3.designscript (6 lines) ----------
["4D_5D_Projeto",
"4D_5D_Especialidade",
"4D_5D_Elemento",
"4D_5D_Piso",
"4D_5D_Atividade",
"4D_5D_Zona"];
# ----------------------------------------
getParameterValueByName = Element.GetParameterValueByName(element=select_model_elements, parameterName=code_block_3, lacing=CrossProduct)
join = String.Join(separator=code_block_2, string0=getParameterValueByName)
flatten = List.Flatten(list=join)
function_apply = ApplyFunction(function=setParameterByName, argument0=select_model_elements, argument1=code_block, argument2=flatten)

# group: Output
# Elementos com parâmetro 4D_Code preenchidos
elementos_com_parâmetro_4d_code = Watch(function_apply)  # "Elementos com parâmetro 4D_Code preenchido"; graph output
