# Dynamo graph TD_Clash_Coordinates.dyn (Dynamo 2.19.3.6394)
# author: Goncalo Bastos
# Insere os clashes exportados do Navisworks no Revit nas coordenadas corretas.

# group: # IMPORT DATA
file_path = Filename("No file selected.")  # graph input
file_from_path = FileObject(path=file_path)
code_block = CodeBlock { "Sheet1"; false; }
importExcel = Data.ImportExcel(file=file_from_path, sheetName=code_block.out0, showExcel=code_block.out1)
transpose = List.Transpose(lists=importExcel)

code_block_2 = CodeBlock(a=transpose) { a[0]; a[1]; a[2]; a[3]; a[4]; a[5]; a[6]; }

# group: # GET COORDINATES
code_block_3 = CodeBlock { 0; }
removeItemAtIndex = List.RemoveItemAtIndex(list=code_block_2.out3, indices=code_block_3)
toNumber = String.ToNumber(string=removeItemAtIndex)
removeItemAtIndex_2 = List.RemoveItemAtIndex(list=code_block_2.out4, indices=code_block_3)
toNumber_2 = String.ToNumber(string=removeItemAtIndex_2)
removeItemAtIndex_3 = List.RemoveItemAtIndex(list=code_block_2.out5, indices=code_block_3)
toNumber_3 = String.ToNumber(string=removeItemAtIndex_3)
byCoordinates = Point.ByCoordinates(x=toNumber, y=toNumber_2, z=toNumber_3)

# group: # TRANSFORM COORDINATES FROM REVIT TO DYNAMO
categories = Categories("OST_ProjectBasePoint")
all_elements_of_category = ElementsOfCategory(Category=categories)
parameters = Element.Parameters(element=all_elements_of_category)
projectRotation = Coordinates.ProjectRotation()
code_block_4 = CodeBlock { -1; }
mul = projectRotation * code_block_4
code_block_5 = CodeBlock { ["E/W","N/S","Elev"]; }
getParameterValueByName = Element.GetParameterValueByName(element=all_elements_of_category, parameterName=code_block_5, lacing=Longest)
code_block_6 = CodeBlock(a=getParameterValueByName) { x=a[0]; y=a[1]; z=a[2]; }
byOrigin = CoordinateSystem.ByOrigin(x=code_block_6.x, y=code_block_6.y, z=code_block_6.z)
basePoint = Coordinates.BasePoint()
code_block_7 = CodeBlock(a=basePoint) { a.X; a.Y; a.Z; }
byOrigin_2 = CoordinateSystem.ByOrigin(x=code_block_7.out0, y=code_block_7.out1, z=code_block_7.out2)
XY = Plane.XY()
rotate = CoordinateSystem.Rotate(coordinateSystem=byOrigin_2, plane=XY, degrees=projectRotation)
transform = Geometry.Transform(geometry=byCoordinates, fromCoordinateSystem=byOrigin, contextCoordinateSystem=rotate)

# group: # GET DATA
code_block_8 = CodeBlock { 0; }
removeItemAtIndex_4 = List.RemoveItemAtIndex(list=code_block_2.out2, indices=code_block_8)
removeItemAtIndex_5 = List.RemoveItemAtIndex(list=code_block_2.out1, indices=code_block_8)
removeItemAtIndex_6 = List.RemoveItemAtIndex(list=code_block_2.out6, indices=code_block_8)
removeItemAtIndex_7 = List.RemoveItemAtIndex(list=code_block_2.out0, indices=code_block_8)

# group: # PLACE CLASHES ON REVIT
família_clash_td_clash = FamilyTypes()  # nothing selected; graph input
byPoint = FamilyInstance.ByPoint(familyType=família_clash_td_clash, point=transform)
code_block_9 = CodeBlock { "Estado Clash"; }
setParameterByName = Element.SetParameterByName(element=byPoint, parameterName=code_block_9, value=removeItemAtIndex_4)
code_block_10 = CodeBlock { "Nome Clash"; }
clashes = Element.SetParameterByName(element=setParameterByName, parameterName=code_block_10, value=removeItemAtIndex_5)  # graph output
code_block_11 = CodeBlock { "Data Clash"; }
setParameterByName_2 = Element.SetParameterByName(element=clashes, parameterName=code_block_11, value=removeItemAtIndex_6)
code_block_12 = CodeBlock { "Raio"; 0.1; }
setParameterByName_3 = Element.SetParameterByName(element=setParameterByName_2, parameterName=code_block_12.out0, value=code_block_12.out1)
code_block_13 = CodeBlock { "Nome Teste"; }
setParameterByName_4 = Element.SetParameterByName(element=setParameterByName_3, parameterName=code_block_13, value=removeItemAtIndex_7)
code_block_14 = CodeBlock { ["new","active","reviewed","approved","resolved"]; }
code_block_15 = CodeBlock()
# ---------- code_block_15.designscript (5 lines) ----------
[DSCore.Color.ByARGB(0,255,0,0),
DSCore.Color.ByARGB(0,255,153,51),
DSCore.Color.ByARGB(0,51,255,255),
DSCore.Color.ByARGB(0,0,255,0),
DSCore.Color.ByARGB(0,255,255,51)];
# ----------------------------------------
byKeysValues = DesignScript.Builtin.Dictionary.ByKeysValues(keys=code_block_14, values=code_block_15)
valueAtKey = DesignScript.Builtin.Dictionary.ValueAtKey(dictionary=byKeysValues, key=removeItemAtIndex_4)
overrideColorInView = Element.OverrideColorInView(element=setParameterByName_4, color=valueAtKey)
