# Dynamo graph TD_Clean_Imported_DWGs.dyn (Dynamo 2.19.3.6394)
# author: Goncalo Bastos
# Identifica todos os CAD's importados no modelo. O utilizador tem a opção de os apagar caso o indique nos INPUT's.

# group: Description
# note: Nome da rotina: TD-Clean-Imported-DWGs
# Versão: 1.0
# Data: 02/09/2024
# Elaborou: GGB
# Descrição:
# Identifica todos os CAD's importados no modelo. O utilizador tem a opção de os apagar caso o indique nos INPUT's.
# Packages usados:
# •   Esta rotina não usa packages externos.

# group: Input
# Opção de apagar os DWG's importados.
# True: Apaga
# False: Não apaga
apagar_dwg_s_importados = BoolSelector(false)  # graph input

# group: DWG's importados
# Nó desenvolvido em Python para obter todos os DWG's importados.
imported_dwg_s = Python()  # CPython3
# ---------- imported_dwg_s.python (56 lines) ----------
import sys
import clr
import Autodesk

clr.AddReference('ProtoGeometry')
from Autodesk.DesignScript.Geometry import *

clr.AddReference('RevitAPI')
from Autodesk.Revit.DB import *
from Autodesk.Revit.DB.Structure import *

clr.AddReference('RevitAPIUI')
from Autodesk.Revit.UI import *

clr.AddReference('System')
from System.Collections.Generic import List

clr.AddReference('RevitNodes')
import Revit
clr.ImportExtensions(Revit.GeometryConversion)
clr.ImportExtensions(Revit.Elements)

clr.AddReference('RevitServices')
import RevitServices
from RevitServices.Persistence import DocumentManager
from RevitServices.Transactions import TransactionManager

doc = DocumentManager.Instance.CurrentDBDocument
uidoc = DocumentManager.Instance.CurrentUIApplication.ActiveUIDocument


collector = FilteredElementCollector(doc).OfClass(ImportInstance).ToElements()


views = []
importedDWG = []
CADS = []

for element in collector:
    if not element.IsLinked:
        CADS.append(element)
        if doc.GetElement(element.OwnerViewId):
            views.append(doc.GetElement(element.OwnerViewId))
        else:
            views.append(doc.GetElement(element.LevelId))
        
        typeId = element.GetTypeId()
        famSym = doc.GetElement(typeId)
        
        for param in famSym.Parameters:
            if param.Definition.Name == "Type Name":
                importedDWG.append(param.AsValueString())     
        


OUT = importedDWG,views,CADS
# ----------------------------------------
code_block = CodeBlock(a=imported_dwg_s) { [a[0],a[1]]; [a[0],a[2]]; ["",""]; }

# group: Identifica/apaga as instâncias importadas
# Caso o utilizador decida apagar, os CAD's serão removidos; caso contrário, o programa indica quais os CAD's importados.
if_ = RefactoredIf(test=apagar_dwg_s_importados, true=code_block.out2, false=code_block.out0)
delete = Element.Delete()  # unwired: element
if_2 = RefactoredIf(test=apagar_dwg_s_importados, true=code_block.out1, false=code_block.out2)
code_block_2 = CodeBlock(a=if_2) { a[0]; a[1]; }
function_apply = ApplyFunction(function=delete, argument0=code_block_2.out1)

# group: Output
# Output do programa
dwg_s_importados = Watch(if_)  # graph output
dwg_s_removidos = Watch(code_block_2.out0)  # graph output
