# Dynamo graph TD_Coordenadas_Elementos.dyn (Dynamo 2.19.3.6394)
# author: Goncalo Bastos
# Insere coordenadas globais (em relação ao survey point) dos elementos da categoria selecionada nos parâmetros X, Y e Z. Estes parâmetros devem ser importados dos shared parameters antes de correr a rotina.
# packages: Genius Loci 2024.5.29

# group: Description
# note: Nome da rotina: TD-Coordenadas-Elementos
# Versão: 2.0
# Data: 25/10/2024
# Elaborou: GGB
# Descrição:
# •  Insere coordenadas globais (em relação ao survey point) dos elementos da categoria selecionada nos parâmetros X, Y e Z. Estes parâmetros devem ser importados dos shared parameters antes de correr a rotina.
# Packages usados:
# •  Genius Loci v2024.5.29
# •  DynamoIronPython2.7 v2.4.0

# group: Input
categories = Categories("OST_StructuralColumns")  # graph input

# group: Get Element
all_elements_in_active_view = ElementsInView()
all_elements_of_category = ElementsOfCategory(Category=categories)
setIntersection = List.SetIntersection(list1=all_elements_in_active_view, list2=all_elements_of_category)

# group: Set Coordinates
code_block = CodeBlock { "Coordenada X"; "Coordenada Y"; "Coordenada Z"; }
getLocation = Element.GetLocation(element=setIntersection)
convert_from_internalorigin = Custom[Convert from InternalOrigin CoordinateSystem](point=getLocation)  # package Genius Loci; Get the location point in the 3 coordinate systems : Shared Coordinates, Project Coordinates, Relative Origin Coordinates.
X = Point.X(point=convert_from_internalorigin.Point_Survey_System)
setParameterByName = Element.SetParameterByName(element=setIntersection, parameterName=code_block.out0, value=X)
Y = Point.Y(point=convert_from_internalorigin.Point_Survey_System)
setParameterByName_2 = Element.SetParameterByName(element=setIntersection, parameterName=code_block.out1, value=Y)
Z = Point.Z(point=convert_from_internalorigin.Point_Survey_System)
setParameterByName_3 = Element.SetParameterByName(element=setIntersection, parameterName=code_block.out2, value=Z)

# group: Output
list_create = List.Create(item0=setIntersection, item1=X, item2=Y, item3=Z)
elements_with_coordinates = List.Transpose(lists=list_create)  # graph output
