# Dynamo graph TD_DeleteViews.dyn "TD_Views" (Dynamo 2.19.3.6394)
# author: Goncalo Bastos
# Obtém e apagar as vistas de um documento, tendo como opção manter a vista Navisworks.

# group: Description
# note: Nome da rotina: TD-DeleteViews.dyn
# Versão: 1.0
# Data: 17/12/2024
# Elaborou: GGB
# Descrição:
# Obtém e apagar as vistas de um documento, tendo como opção manter a vista Navisworks.
# Packages usados:
# •   Esta rotina não usa packages externos.

# group: Input
manter_vista_navisworks = BoolSelector(true)  # graph input

# group: Obter vistas para apagar
get_all_views = Python(IN[0]=manter_vista_navisworks)  # CPython3
# ---------- get_all_views.python (40 lines) ----------
import sys
import clr
import Autodesk
clr.AddReference('ProtoGeometry')
from Autodesk.DesignScript.Geometry import *
clr.AddReference('RevitAPI')
from Autodesk.Revit.DB import *
from Autodesk.Revit.DB.Structure import *
clr.AddReference('RevitAPIUI')
from Autodesk.Revit.UI import *
clr.AddReference('System')
from System.Collections.Generic import List
clr.AddReference('RevitNodes')
import Revit
clr.ImportExtensions(Revit.GeometryConversion)
clr.ImportExtensions(Revit.Elements)
clr.AddReference('RevitServices')
import RevitServices
from RevitServices.Persistence import DocumentManager
from RevitServices.Transactions import TransactionManager
doc = DocumentManager.Instance.CurrentDBDocument
uidoc = DocumentManager.Instance.CurrentUIApplication.ActiveUIDocument


navisworks = IN[0]

allViews = FilteredElementCollector(doc).OfClass(View).ToElements()
filteredViews = []


for view in allViews:
    if navisworks:
        if view.Name != "Navisworks":
            if "Splash" not in view.Name:
                filteredViews.append(view)
    else:
        filteredViews.append(view)
            

OUT = filteredViews
# ----------------------------------------
code_block = CodeBlock { false; }
clean = List.Clean(list=get_all_views, preserveIndices=code_block)
delete_views = Python(IN[0]=clean)  # CPython3
# ---------- delete_views.python (42 lines) ----------
import sys
import clr
import Autodesk
clr.AddReference('ProtoGeometry')
from Autodesk.DesignScript.Geometry import *
clr.AddReference('RevitAPI')
from Autodesk.Revit.DB import *
from Autodesk.Revit.DB.Structure import *
clr.AddReference('RevitAPIUI')
from Autodesk.Revit.UI import *
clr.AddReference('System')
from System.Collections.Generic import List
clr.AddReference('RevitNodes')
import Revit
clr.ImportExtensions(Revit.GeometryConversion)
clr.ImportExtensions(Revit.Elements)
clr.AddReference('RevitServices')
import RevitServices
from RevitServices.Persistence import DocumentManager
from RevitServices.Transactions import TransactionManager
doc = DocumentManager.Instance.CurrentDBDocument
uidoc = DocumentManager.Instance.CurrentUIApplication.ActiveUIDocument


views = IN[0]
deletedViews = []

TransactionManager.Instance.EnsureInTransaction(doc)

for view in views:
    try:
        
        view.Delete()
        deletedViews.append(view)
    except:
        pass

TransactionManager.Instance.TransactionTaskDone()



OUT = deletedViews
# ----------------------------------------

# group: Output
deleted_views = Watch(delete_views)  # graph output
