# Dynamo graph TD_Families_Imported_DWG.dyn (Dynamo 2.19.3.6394)
# author: Goncalo Bastos
# Identifica todos os CAD's importados em cada família do documento. O utilizador tem a opção de exportar os dados para Excel.

# group: Description
# note: Nome da rotina: TD-Familias-Imported-DWG.dyn
# Versão: 1.0
# Data: 03/09/2024
# Elaborou: GGB
# Descrição:
# Identifica todos os CAD's importados em cada família do documento. O utilizador tem a opção de exportar os dados para Excel.
# Packages usados:
# •   Esta rotina não usa packages externos.

# group: Input
# Exportar para excel: True
# Não exportar: False
n1_exportar_para_excel = BoolSelector(false)  # "1. Exportar para excel?"; graph input
n2_diretoria_a_guardar_excel = Directory("No file selected.")  # "2. Diretoria a guardar Excel"; graph input

# group: Obter DWG's importados em famílias
# Nó de Python que obtém todos os CAD's que estão importados diretamente nos ficheiros .rfa
get_imported_dwgs_in_families = Python()  # CPython3
# ---------- get_imported_dwgs_in_families.python (57 lines) ----------
import sys
import clr
import Autodesk

clr.AddReference('ProtoGeometry')
from Autodesk.DesignScript.Geometry import *

clr.AddReference('RevitAPI')
from Autodesk.Revit.DB import *
from Autodesk.Revit.DB.Structure import *

clr.AddReference('RevitAPIUI')
from Autodesk.Revit.UI import *

clr.AddReference('System')
from System.Collections.Generic import List

clr.AddReference('RevitNodes')
import Revit
clr.ImportExtensions(Revit.GeometryConversion)
clr.ImportExtensions(Revit.Elements)

clr.AddReference('RevitServices')
import RevitServices
from RevitServices.Persistence import DocumentManager
from RevitServices.Transactions import TransactionManager

doc = DocumentManager.Instance.CurrentDBDocument
uidoc = DocumentManager.Instance.CurrentUIApplication.ActiveUIDocument



families = []
importedDWG = []
CADS = []

family_collector = FilteredElementCollector(doc).OfClass(Family)

for family in family_collector:
    
    try:
        
        family_doc = doc.EditFamily(family)
        import_instance_collector = FilteredElementCollector(family_doc).OfClass(ImportInstance)
        for element in import_instance_collector:
            if not element.IsLinked:
                families.append(family.Name)
                CADS.append(element.Id)
                for param in element.Parameters:            
                    if param.Definition.Name == "Name":
                        importedDWG.append(param.AsValueString())
    except:
        pass



OUT = families,importedDWG
# ----------------------------------------

# group: Preparação dos dados para visualizar
code_block = CodeBlock { ["",""]; }
if_ = RefactoredIf(test=n1_exportar_para_excel, true=code_block, false=get_imported_dwgs_in_families)
code_block_2 = CodeBlock(a=if_) { a[0]; a[1]; }

# group: Output
# Visualização dos dados caso não sejam exportados para Excel
nome_família = Watch(code_block_2.out0)  # graph output
nome_dwg_importado = Watch(code_block_2.out1)  # graph output

# group: Preparação dos dados para exportar para Excel
exportToExcel = Data.ExportToExcel()  # unwired: filePath, sheetName, startRow, startColumn, data
empty = List.Empty()
if_2 = RefactoredIf(test=n1_exportar_para_excel, true=exportToExcel, false=empty)
code_block_3 = CodeBlock { "Sheet1"; 0; true; }
code_block_4 = CodeBlock { [["Nome Familia","Nome DWG Importado"]]; }
transpose = List.Transpose(lists=get_imported_dwgs_in_families)
join = List.Join(list0=code_block_4, list1=transpose)
code_block_5 = CodeBlock { 0; }
flatten = List.Flatten(list=join, amount=code_block_5)

# group: Output
# Folha de excel com os dados
export_to_excel = ApplyFunction(function=if_2, argument0=n2_diretoria_a_guardar_excel, argument1=code_block_3.out0, argument2=code_block_3.out1, argument3=code_block_3.out1, argument4=flatten, argument5=code_block_3.out2, argument6=code_block_3.out2)
