# Dynamo graph TD_ImportPointsFromExcel.dyn (Dynamo 2.19.3.6394)
# author: Goncalo Bastos
# Rotina usada para importar pontos georefenciados em Excel no formato (Nome do ponto, X, Y, Z) e na folha "Coordenadas". Ao importar esses pontos, a rotina irá transformar as coordenadas reais em coordenadas internas de Revit e inserir os mesmos no modelo.

# group: Description
# note: Nome da rotina: TD-ImportPointsFromExcel
# Versão: 1.0
# Data: 27/08/2024
# Elaborou: GGB
# Descrição:
# •   Rotina usada para importar pontos georefenciados em Excel no formato (Nome do ponto, X, Y, Z) e na folha "Coordenadas";
# •  Ao importar esses pontos, a rotina irá tranformar as coordenadas reais em coordenadas internas de Revit e inserir os mesmos no modelo.
# Packages usados:
# •   Esta rotina não usa packages externos.

# group: Input
# Nós de input da rotina.
# File Path - selecionar um ficheiro excel com pontos coordenados no formato (Nome do ponto, X, Y, Z) e na folha "Coordenadas"
# Family Types - Selecionar a família que será inserida no modelo a representar o ponto: "TD_Point.rfa".
family_types = FamilyTypes()  # nothing selected; graph input
file_path = Filename("No file selected.")  # graph input

# group: Actions - Tratamento dos dados
# Este grupo de nós importa o ficheiro de excel a prepara os seus dados para serem usados na rotina Dynamo.
# a[0] - nome do ponto
# a[1] - coordenada X
# a[2] - coordenada Y
# a[3] - coordenada Z
file_from_path = FileObject(path=file_path)
code_block = CodeBlock { "Coordenadas"; false; }
importExcel = Data.ImportExcel(file=file_from_path, sheetName=code_block.out0, showExcel=code_block.out1)
transpose = List.Transpose(lists=importExcel)
code_block_2 = CodeBlock(a=transpose) { a[0]; a[1]; a[2]; a[3]; }
byCoordinates = Point.ByCoordinates(x=code_block_2.out1, y=code_block_2.out2, z=code_block_2.out3)

# group: Actions - Coordenadas do Survey Point
# Este grupo de nós lê as coordenadas X,Y,Z do Survey Point (World Coordinates) e cria uma sistem Coordenadas em Dynamo com base nessa origem
categories = Categories("OST_SharedBasePoint")
all_elements_of_category = ElementsOfCategory(Category=categories)
code_block_3 = CodeBlock { ["E/W","N/S","Elev"]; }
getParameterValueByName = Element.GetParameterValueByName(element=all_elements_of_category, parameterName=code_block_3, lacing=Longest)
code_block_4 = CodeBlock(a=getParameterValueByName) { x=a[0]; y=a[1]; z=a[2]; }
byOrigin = CoordinateSystem.ByOrigin(x=code_block_4.x, y=code_block_4.y, z=code_block_4.z)

# group: Actions - Coordenadas da Interna Origem
# Este grupo lê as coordenadas da origem interna do Revit e cria um sistema de coordenadas em Dynamo com base nessa origem
identity = CoordinateSystem.Identity()
origin = CoordinateSystem.Origin(coordinateSystem=identity)
code_block_5 = CodeBlock(a=origin) { a.X; a.Y; a.Z; }
byOrigin_2 = CoordinateSystem.ByOrigin(x=code_block_5.out0, y=code_block_5.out1, z=code_block_5.out2)

# group: Actions - Rotação da origem interna
# Este conjunto de nós faz com que o sistema de coordenadas da origem interna do Revit sofra uma rotação no valor do ângulo entre o True North e o Project North.
XY = Plane.XY()
projectRotation = Coordinates.ProjectRotation()
rotate = CoordinateSystem.Rotate(coordinateSystem=byOrigin_2, plane=XY, degrees=projectRotation)

# group: Actions - Transformação entre sistemas de coordenadas
# Este grupo transforma o sistema de coordendas do mundo real no sistema de coordenadas com origem no internal origin do Revit
transform = Geometry.Transform(geometry=byCoordinates, fromCoordinateSystem=byOrigin, contextCoordinateSystem=rotate)
origin_2 = Point.Origin()
surveyPoint = Coordinates.SurveyPoint()
byTwoPoints = Vector.ByTwoPoints(start=origin_2, end=surveyPoint)
translate = Geometry.Translate(geometry=transform, direction=byTwoPoints)

# group: Output
# Este grupo cria uma instância da família selecionada na localização do sistema de coordendas transformado e dá-lhe o nome do ponto no parâmetro respetivo.
byPoint = FamilyInstance.ByPoint(familyType=family_types, point=translate)
code_block_6 = CodeBlock { "Nome ponto"; "Coordenada X"; "Coordenada Y"; "Coordenada Z"; }
setParameterByName = Element.SetParameterByName(element=byPoint, parameterName=code_block_6.out0, value=code_block_2.out0)
setParameterByName_2 = Element.SetParameterByName(element=setParameterByName, parameterName=code_block_6.out1, value=code_block_2.out1)
setParameterByName_3 = Element.SetParameterByName(element=setParameterByName_2, parameterName=code_block_6.out2, value=code_block_2.out2)
setParameterByName_4 = Element.SetParameterByName(element=setParameterByName_3, parameterName=code_block_6.out3, value=code_block_2.out3)
watch = Watch(setParameterByName_4)  # graph output
