# Dynamo graph TD_List_InPlace_Families.dyn (Dynamo 2.19.3.6394)
# author: Goncalo Bastos
# Identifica uma listagem com as InPlace Families do modelo. O utilizador tem a opção de exportar para excel.

# group: Description
# note: Nome da rotina: TD-List-InPlace-Families.dyn
# Versão: 1.0
# Data: 04/09/2024
# Elaborou: GGB
# Descrição:
# Identifica uma listagem com as InPlace Families do modelo. O utilizador tem a opção de exportar para excel.
# Packages usados:
# •   Esta rotina não usa packages externos.

# group: Input
# Exportar para excel: True
# Não exportar: False
n1_exportar_para_excel = BoolSelector(false)  # "1. Exportar para excel?"; graph input
n2_diretoria_a_guardar_excel = Directory("No file selected.")  # "2. Diretoria a guardar Excel"; graph input

# group: Obter InPlace Families
inplace_families = Python()  # CPython3
# ---------- inplace_families.python (44 lines) ----------
import sys
import clr
import Autodesk

clr.AddReference('ProtoGeometry')
from Autodesk.DesignScript.Geometry import *

clr.AddReference('RevitAPI')
from Autodesk.Revit.DB import *
from Autodesk.Revit.DB.Structure import *

clr.AddReference('RevitAPIUI')
from Autodesk.Revit.UI import *

clr.AddReference('System')
from System.Collections.Generic import List

clr.AddReference('RevitNodes')
import Revit
clr.ImportExtensions(Revit.GeometryConversion)
clr.ImportExtensions(Revit.Elements)

clr.AddReference('RevitServices')
import RevitServices
from RevitServices.Persistence import DocumentManager
from RevitServices.Transactions import TransactionManager

doc = DocumentManager.Instance.CurrentDBDocument
uidoc = DocumentManager.Instance.CurrentUIApplication.ActiveUIDocument

inPlace = []
categories = []



family_collector = FilteredElementCollector(doc).OfClass(Family)

for family in family_collector:

    if family.IsInPlace:
        inPlace.append(family)
        categories.append(family.FamilyCategory.Name)

OUT =inPlace,categories
# ----------------------------------------

# group: Preparação dos dados para visualizar
code_block = CodeBlock { ["",""]; }
if_ = RefactoredIf(test=n1_exportar_para_excel, true=code_block, false=inplace_families)
code_block_2 = CodeBlock(a=if_) { a[0]; a[1]; }

# group: Output
# Visualização dos dados caso não sejam exportados para Excel
inplace_family = Watch(code_block_2.out0)  # graph output
category = Watch(code_block_2.out1)  # graph output

# group: Preparação dos dados para exportar para Excel
exportToExcel = Data.ExportToExcel()  # unwired: filePath, sheetName, startRow, startColumn, data
empty = List.Empty()
if_2 = RefactoredIf(test=n1_exportar_para_excel, true=exportToExcel, false=empty)
code_block_3 = CodeBlock { "Sheet1"; 0; true; }
code_block_4 = CodeBlock { [["InPlace Family","Category"]]; }
transpose = List.Transpose(lists=inplace_families)
join = List.Join(list0=code_block_4, list1=transpose)
code_block_5 = CodeBlock { 0; }
flatten = List.Flatten(list=join, amount=code_block_5)

# group: Output
# Folha de excel com os dados
export_to_excel = ApplyFunction(function=if_2, argument0=n2_diretoria_a_guardar_excel, argument1=code_block_3.out0, argument2=code_block_3.out1, argument3=code_block_3.out1, argument4=flatten, argument5=code_block_3.out2, argument6=code_block_3.out2)
