# Dynamo graph TD_Tags_STR-Foundations.dyn (Dynamo 2.19.3.6394)
# author: Goncalo Bastos
# Tags automáticas em elementos da categoria Structural Foundations, na current view.

# group: Description
# note: Nome da rotina: TD-Tags-STR-Foundations
# Versão: 2.0
# Data: 28/08/2024
# Elaborou: GGB
# Descrição:
# Tags automáticas em elementos da categoria Structural Foundations, na current view. Utilizador manipula localização das Tags.
# Packages usados:
# •   Esta rotina não usa packages externos.

# group: Input
# O utilizador deverá selecionar os elementos diretamente no modelo e definir a distância em X e Y que as Tags deverão estar do elemento.
select_model_elements = DSModelElementsSelection()  # nothing selected; graph input
tag_distance_from_element_in_x = DoubleSlider(0, range=-5..5 step 0.001)  # graph input
tag_distance_from_element_in_y = DoubleSlider(0, range=-5..5 step 0.001)  # graph input

# group: Elementos da categoria Structural Foundations
# Este grupo de nós filtra os elementos selecionados no Revit pelo utilizador e mantém uma lista apenas com elementos da categoria Structural Columns
categories = Categories("OST_StructuralFoundation")
all_elements_of_category = ElementsOfCategory(Category=categories)
setIntersection = List.SetIntersection(list1=select_model_elements, list2=all_elements_of_category)

# group: Localização do Tag
# Este conjunto de nós localiza o ponto máximo da bounding box de cada elemento e determina o ponto de inserção da Tag com base na deslocação que o utilizador dá em relação a esse ponto.
# Exemplo:
# Para uma bounding box com a forma de um quadrado (pilar com seção quadrada), o ponto de inserção da Tag será as coordenadas do canto superior direito adicionadas dos deslocamento em X e Y dados pelo utilizador nos INPUT
geometry = Element.Geometry(element=setIntersection)
byGeometry = BoundingBox.ByGeometry(geom=geometry)
maxPoint = BoundingBox.MaxPoint(boundingBox=byGeometry)
byCoordinates = Vector.ByCoordinates(x=tag_distance_from_element_in_x, y=tag_distance_from_element_in_y)
add = Point.Add(point=maxPoint, vectorToAdd=byCoordinates)

# group: Output
# Insere a Tag na localização determinada anteriormente e na vista ativa, para cada elemento selecionado.
current = Document.Current()
activeView = Document.ActiveView(document=current)
boolean = BoolSelector(true)
boolean_2 = BoolSelector(false)
byElementAndLocation = Tag.ByElementAndLocation(view=activeView, element=setIntersection, location=add, horizontal=boolean, addLeader=boolean_2)
tags_created = Watch(byElementAndLocation)  # graph output
