# Dynamo graph TD_Tags_STR-Framing.dyn (Dynamo 2.19.3.6394)
# author: Goncalo Bastos
# Tags automáticas em elementos da categoria Structural Framing, na current view.

# group: Description
# note: Nome da rotina: TD-Tags-STR-Foundations
# Versão: 2.0
# Data: 29/08/2024
# Elaborou: GGB
# Descrição:
# Tags automáticas em elementos da categoria Structural Framing, na current view. Utilizador manipula localização das Tags.
# Packages usados:
# •   Esta rotina não usa packages externos.

# group: Input
# O utilizador deverá selecionar os elementos diretamente no modelo e definir a distância em X e Y na perpendicular que as Tags deverão estar do elemento.
select_model_elements = DSModelElementsSelection()  # 16 picked in the model; graph input
tag_distance_from_element = DoubleSlider(0.3, range=-5..5 step 0.001)  # graph input

# group: Elementos da categoria Structural Framing
# Este grupo de nós filtra os elementos selecionados no Revit pelo utilizador e mantém uma lista apenas com elementos da categoria Structural Framing
categories = Categories("OST_StructuralFraming")
all_elements_of_category = ElementsOfCategory(Category=categories)
setIntersection = List.SetIntersection(list1=select_model_elements, list2=all_elements_of_category)

# group: Coloca a variávei "y justification" para Central
code_block = CodeBlock { "y Justification"; }
parameterByName = Parameter.ParameterByName(element=setIntersection, name=code_block)
code_block_2 = CodeBlock { 1; }
setValue = Parameter.SetValue(parameter=parameterByName, value=code_block_2)

# group: Definição de localização da Tag
# Este grupo recebe os elementos filtrados e define a localização da tag com base na distância que o utilizador forneceu. A Tag é colocada a meio da viga, na perpendicular, à distância definida.
# Foi necessário usar o valor do Shared Parameter "Largura" da viga no nó de Python. Para tal, foi usada a GUID deste parâmetro:  '55c1168b-b5d0-4781-a9af-60614c0034c0'
getLocation = Element.GetLocation(element=setIntersection)
length = Curve.Length(curve=getLocation)
code_block_3 = CodeBlock(x=length) { [x]/2; }
flatten = List.Flatten(list=code_block_3)
pointAtSegmentLength = Curve.PointAtSegmentLength(curve=getLocation, segmentLength=flatten)
direction = Line.Direction(line=getLocation)
XY = Plane.XY()
code_block_4 = CodeBlock { 90; }
rotate = Vector.Rotate(vector=direction, plane=XY, degrees=code_block_4)
normalized = Vector.Normalized(vector=rotate)
get_family_type_parameter = Python(IN[0]=setIntersection)  # CPython3
# ---------- get_family_type_parameter.python (20 lines) ----------
import clr
clr.AddReference('RevitServices')
import RevitServices
from RevitServices.Persistence import DocumentManager


doc = DocumentManager.Instance.CurrentDBDocument 
_guid = '55c1168b-b5d0-4781-a9af-60614c0034c0' 
elements = UnwrapElement(IN[0])

values = []
for e in elements:
    typeId = element.GetTypeId()
    famSym = doc.GetElement(typeId)
    for p in famSym.Parameters:
        if p.IsShared:
            if p.GUID.ToString() == _guid:
                values.append(float(p.AsValueString()))

OUT = values
# ----------------------------------------
code_block_5 = CodeBlock(x=get_family_type_parameter, y=tag_distance_from_element) { x/2+y; y; }
scale = Vector.Scale(vector=normalized, scale_factor=code_block_5.out0)
add = Point.Add(point=pointAtSegmentLength, vectorToAdd=scale)

# group: Output
# Insere a Tag na localização determinada anteriormente e na vista ativa, para cada elemento selecionado.
current = Document.Current()
activeView = Document.ActiveView(document=current)
boolean = BoolSelector(true)
boolean_2 = BoolSelector(false)
byElementAndLocation = Tag.ByElementAndLocation(view=activeView, element=setIntersection, location=add, horizontal=boolean, addLeader=boolean_2)
tags_created = Watch(byElementAndLocation)  # graph output
